# Grasshopper definition 010421 component.gh (Grasshopper 1.0.7)
# plug-ins: Pufferfish

# ----
# SCAN IN ->
mesh = Mesh(<mesh referenced from the Rhino model>)

# ----
# IMPORT MESH
demesh = DeconstructMesh(Mesh=mesh)  # -> Vertices, Faces, Colours, Normals
points = PointList(Points=demesh.Vertices)
panel = Panel("""8594
12722
10481
658
7004
869
12059
12003
9808
6220
6174
6112
6107
6063
3659
3664""")
panel_2 = Panel("""9454
9436
9414
9356
7506
718
414
1608
4584
6441
12371
5190
7972
8186
4854
2081
1977
8007
2325""")
panel_3 = Panel("""8646
11329
12329
9761
293
2121
7651
324
6350
7262""")
image = ImageSampler(
    FilePath="C:\Users\Luke Hillery\Documents\DE4\SOLO\Component CAD\foot top view.jpg",
    Filter="Colour",
    Interpolate=False,
    Umax=1,
    Umin=0,
    Vmax=1,
    Vmin=0,
    Wrap=1)

# ----
# Back of Heel
item = ListItem(List=demesh.Vertices, Index=2027, Wrap=True)

# ----
# Tip of Big Toe
item_2 = ListItem(List=demesh.Vertices, Index=2420, Wrap=True)

Z = UnitZ(Factor=-1)
xy = XYPlane(Origin=Point(0, 0, 0))
xy_2 = XYPlane(Origin=Point(0, 0, 0))
Z_2 = UnitZ(Factor=-1)
xy_3 = XYPlane(Origin=Point(0, 0, 0))
yz = YZPlane(Origin=Point(0, 0, 0))
xy_4 = XYPlane(Origin=Point(0, 0, 0))
# FOOT LENGTH
project = ProjectPoint(Point=item_2, Direction=Z, Geometry=xy)  # -> Point, Index
project_2 = ProjectPoint(Point=item, Direction=Z_2, Geometry=xy_2)  # -> Point, Index

# ----
# Foot Length
dist = Distance(PointA=project.Point, PointB=project_2.Point)

multiplication = Multiplication(A=dist, B=0.8)
round = Round(Number=multiplication)  # -> Nearest, Floor, Ceiling
series = Series(Start=0, Step=1, Count=5)
series_2 = Series(Start=0, Step=1, Count=5)
dom = ConstructDomain(DomainStart=Slider(6, range=0..10), DomainEnd=Slider(12, range=0..12))
dom_2 = ConstructDomain(DomainStart=Slider(4, range=0..10), DomainEnd=Slider(12, range=0..12))
xz = XZPlane(Origin=Point(0, 5, 0))
rectangle = Rectangle(Plane=xz, XSize=Domain(-50, 50), YSize=Domain(-50, 50), Radius=0)  # -> Rectangle, Length
boundary = BoundarySurfaces(Edges=rectangle.Rectangle)
Y = UnitY(Factor=-10)
extr = Extrude(Base=boundary, Direction=Y)

# ----
# CHRONOLOGICAL ORDER -->
# Foot Length (mm)
number_slider = Slider(150, range=50..300)

pt = ConstructPoint(XCoordinate=0, YCoordinate=0, ZCoordinate=0)
move2pt = MoveToPoint(Geometry=mesh, PointA=item_2, PointB=pt)  # -> Moved, Vector, Transform
demesh_2 = DeconstructMesh(Mesh=move2pt.Moved)  # -> Vertices, Faces, Colours, Normals
# Tip of 2nd Toe
item_3 = ListItem(List=demesh_2.Vertices, Index=9089, Wrap=True)
# Tip of Big Toe
item_4 = ListItem(List=demesh_2.Vertices, Index=2420, Wrap=True)

# ----
# Outside Instep
item_5 = ListItem(List=demesh_2.Vertices, Index=panel, Wrap=True)

# ----
# Instep Profile
item_6 = ListItem(List=demesh_2.Vertices, Index=panel_2, Wrap=True)

# ----
# Inside Instep
item_7 = ListItem(List=demesh_2.Vertices, Index=panel_3, Wrap=True)

ln = Line(StartPoint=item_4, EndPoint=item_3)
midpt = CurveMiddle(Curve=ln)
intcrv = Interpolate(Vertices=item_5, Degree=1, Periodic=False, KnotStyle=1)  # -> Curve, Length, Domain
intcrv_2 = Interpolate(Vertices=item_6, Degree=1, Periodic=False, KnotStyle=1)  # -> Curve, Length, Domain
intcrv_3 = Interpolate(Vertices=item_7, Degree=1, Periodic=False, KnotStyle=1)  # -> Curve, Length, Domain
project_3 = Project(Geometry=intcrv.Curve, Plane=xy_3)  # -> Geometry, Transform
project_4 = Project(Geometry=intcrv_2.Curve, Plane=yz)  # -> Geometry, Transform
project_5 = Project(Geometry=intcrv_3.Curve, Plane=xy_4)  # -> Geometry, Transform
rebcrv = RebuildCurve(Curve=project_3.Geometry, Count=4, Degree=3, EndTangents=False)
rebcrv_2 = RebuildCurve(Curve=project_5.Geometry, Count=3, Degree=2, EndTangents=False)
rebcrv_3 = RebuildCurve(Curve=project_4.Geometry, Count=8, Degree=5, EndTangents=False)
flip = FlipCurve(Curve=rebcrv_3)  # -> Curve, Flag
msh2psrf = MeshToPolysurface(Mesh=move2pt.Moved, Triangles=False, FaceMerge=False)
Y_2 = UnitY(Factor=round.Nearest)
move = Move(Geometry=pt, Motion=Y_2)  # -> Geometry, Transform
pt_2 = Point(midpt)
yz_2 = YZPlane(Origin=Point(0, 0, 0))
project_6 = Project(Geometry=pt_2, Plane=yz_2)  # -> Geometry, Transform
dist_2 = Distance(PointA=pt_2, PointB=project_6.Geometry)

# ----
# Curvature
# Interpolation
# Degree
# NOTE
# Only works at 15 and 20...
knob = ControlKnob(Decimals=0, Limit=True, Maximum=20, Minimum=10, Range=20, Value=15)

neg = Negative(Value=dist_2)
X = UnitX(Factor=neg)
# TOEBOX SHAPE
move_2 = Move(Geometry=move.Geometry, Motion=X)  # -> Geometry, Transform
ln_2 = Line(StartPoint=pt_2, EndPoint=move_2.Geometry)
divide = DivideCurve(Curve=ln_2, Count=knob, Kinks=False)  # -> Points, Tangents, Parameters

# ----
# Toebox
# Curvature Control
graph = GraphMapper(
    divide.Parameters,
    x0=0,
    x1=1,
    y0=0,
    y1=1,
    container_name="Bezier",
    cpx=[0, 0.630081296, 0.9479647875, 1],
    cpy=[0, 0, 0.05223429203, 0.7957516909])
# NOTE
# Curvature should be taken from
# raw 3D scan, either using photo with
# edge detection or with cross-section
# curves through mesh from 3D scan
number_slider_2 = Slider(50, range=30..60)

multiplication_2 = Multiplication(A=graph, B=number_slider_2)
neg_2 = Negative(Value=multiplication_2)
Z_3 = UnitZ(Factor=neg_2)
# BOUNDING VOLUME SHAPE
move_3 = Move(Geometry=divide.Points, Motion=Z_3)  # -> Geometry, Transform

# ----
# Width and Height
# Curvature Control
graph_2 = GraphMapper(
    divide.Parameters,
    x0=0,
    x1=1,
    y0=0,
    y1=1,
    container_name="Bezier",
    cpx=[0, 0.1070338339, 0.4497973323, 1],
    cpy=[0.489772439, 1, 1, 0.3865298629])
graph_3 = GraphMapper(
    divide.Parameters,
    x0=0,
    x1=1,
    y0=0,
    y1=1,
    container_name="Bezier",
    cpx=[0, 0.331707716, 0.7379239798, 1],
    cpy=[0.2553995252, 0.8880677819, 0.006016790867, 1])
# NOTE
# Curvature should be taken from
# raw 3D scan, either using photo with
# edge detection or with cross-section
# curves through mesh from 3D scan
number_slider_3 = Slider(60, range=30..60)
multiplication_3 = Multiplication(A=graph_2, B=Slider(17, range=10..60))
multiplication_4 = Multiplication(A=graph_3, B=number_slider_3)

intcrv_4 = Interpolate(Vertices=move_3.Geometry, Degree=3, Periodic=False, KnotStyle=1)  # -> Curve, Length, Domain
pframe = PerpFrame(Curve=intcrv_4.Curve, Parameter=move_3.Geometry)
pcx = CurvePlane(Curve=rebcrv_3, Plane=pframe)  # -> flatten(Points), ParamsC, ParamsP
pcx_2 = CurvePlane(Curve=rebcrv_2, Plane=pframe)  # -> graft(Points), ParamsC, ParamsP
pcx_3 = CurvePlane(Curve=rebcrv, Plane=pframe)  # -> graft(Points), ParamsC, ParamsP
cull_i = CullIndex(List=pcx.Points, Indices=0, Wrap=True)
item_8 = ListItem(List=flatten(pcx_2.Points), Index=series, Wrap=True)
item_9 = ListItem(List=flatten(pcx_3.Points), Index=series_2, Wrap=True)
arc = Arc3Pt(PointA=item_8, PointB=cull_i, PointC=item_9)  # -> Arc, Plane, Radius
clscrv = CloseCurve(Curve=arc.Arc, CloseType=2, Bulge=0.3, Tolerance=0)  # -> Closed, R
lng = ListLength(List=clscrv.Closed)
subtraction = Subtraction(A=lng, B=1)
range = Range(Domain=dom, Steps=subtraction)  # -> flatten(Range)
range_2 = Range(Domain=dom_2, Steps=subtraction)  # -> flatten(Range)
int = Integer(range)
int_2 = Integer(range_2)
rebcrv_4 = RebuildCurve(Curve=clscrv.Closed, Count=int, Degree=int_2, EndTangents=False)  # -> graft(Rebuilt)
item_10 = ListItem(List=flatten(rebcrv_4), Index=0, Wrap=True)
item_11 = ListItem(List=flatten(rebcrv_4), Index=-1, Wrap=True)
planar = Planar(Curve=item_11)  # -> Planar, Plane, Deviation
project_7 = Project(Geometry=item_10, Plane=PlaneXZ(0, 0, 0))  # -> Geometry, Transform
pcx_4 = CurvePlane(Curve=project_7.Geometry, Plane=PlaneXY(0, 0, 0))  # -> Points, ParamsC, ParamsP
item_12 = ListItem(List=pcx_4.Points, Index=1, Wrap=True)
item_13 = ListItem(List=pcx_4.Points, Index=0, Wrap=True)

yz_3 = YZPlane(Origin=Point(0, 0, 0))
project_8 = Project(Geometry=rebcrv, Plane=yz_3)  # -> Geometry, Transform
explode = Explode(Curve=rebcrv, Recursive=True)  # -> Segments, Vertices
explode_2 = Explode(Curve=project_8.Geometry, Recursive=True)  # -> Segments, Vertices
len = Length(Curve=project_8.Geometry)
item_14 = ListItem(List=explode.Vertices, Index=0, Wrap=True)
pt_3 = ConstructPoint(XCoordinate=0, YCoordinate=0, ZCoordinate=0)
item_15 = ListItem(List=explode_2.Vertices, Index=1, Wrap=True)
move2pt_2 = MoveToPoint(Geometry=rebcrv, PointA=item_14, PointB=item_12)  # -> Moved, Vector, Transform
dist_3 = Distance(PointA=pt_3, PointB=item_15)
division = Division(A=dist_3, B=len)
scale_nu = ScaleNU(Geometry=move2pt_2.Moved, Plane=PlaneXY(0, 0, 0), ScaleX=1, ScaleY=division, ScaleZ=1)  # -> Geometry, Transform

yz_4 = YZPlane(Origin=Point(0, 0, 0))
explode_3 = Explode(Curve=rebcrv_2, Recursive=True)  # -> Segments, Vertices
project_9 = Project(Geometry=rebcrv_2, Plane=yz_4)  # -> Geometry, Transform
len_2 = Length(Curve=project_9.Geometry)
explode_4 = Explode(Curve=project_9.Geometry, Recursive=True)  # -> Segments, Vertices
item_16 = ListItem(List=explode_3.Vertices, Index=0, Wrap=True)
pt_4 = ConstructPoint(XCoordinate=0, YCoordinate=0, ZCoordinate=0)
item_17 = ListItem(List=explode_4.Vertices, Index=1, Wrap=True)
move2pt_3 = MoveToPoint(Geometry=rebcrv_2, PointA=item_16, PointB=item_13)  # -> Moved, Vector, Transform
dist_4 = Distance(PointA=pt_4, PointB=item_17)
division_2 = Division(A=dist_4, B=len_2)
scale_nu_2 = ScaleNU(Geometry=move2pt_3.Moved, Plane=PlaneXY(0, 0, 0), ScaleX=1, ScaleY=division_2, ScaleZ=1)  # -> Geometry, Transform

swp2 = Sweep2(Rail1=project_7.Geometry, Rail2=item_11, Sections=flatten([scale_nu_2.Geometry, scale_nu.Geometry]), SameHeight=False)
sec = BrepPlane(Brep=swp2, Plane=planar.Plane)  # -> Curves, Points
srfsplit = SurfaceSplit(Surface=swp2, Curves=sec.Curves)
# Toebox
# (based on top-down profile)
item_18 = ListItem(List=srfsplit, Index=0, Wrap=True)

# ----
# Thickness Gradient Controls
v_count = Slider(21, range=0..100)
untrim = Untrim(Surface=item_18)
instep_thickness = Slider(6, range=0..6)
toe_thickness = Slider(-1, range=-1..10)
sdivide = DivideSurface(Surface=untrim, UCount=v_count, VCount=v_count)  # -> Points, Normals, Parameters
dom_3 = ConstructDomain(DomainStart=instep_thickness, DomainEnd=toe_thickness)
range_3 = Range(Domain=dom_3, Steps=v_count)
multiplication_5 = Multiplication(A=sdivide.Normals, B=range_3)
move_4 = Move(Geometry=sdivide.Points, Motion=multiplication_5)  # -> Geometry, Transform
srfgrid = SurfaceFromPoints(Points=flatten(move_4.Geometry), UCount=expr("x + 1", v_count), Interpolate=False)

sec_2 = BrepPlane(Brep=srfgrid, Plane=planar.Plane)  # -> Curves, Points
srfsplit_2 = SurfaceSplit(Surface=srfgrid, Curves=sec_2.Curves)
item_19 = ListItem(List=srfsplit_2, Index=0, Wrap=True)
debrep = DeconstructBrep(Brep=item_18)  # -> Faces, Edges, Vertices
debrep_2 = DeconstructBrep(Brep=item_19)  # -> Faces, Edges, Vertices
rulesrf = RuledSurface(CurveA=debrep.Edges, CurveB=debrep_2.Edges)
cap = CapHoles(Brep=item_18)
join = BrepJoin(Breps=flatten([rulesrf, item_19, item_18]))  # -> Breps, Closed
psrfclsd = IsPolysurfaceClosed(Polysurface=join.Breps)
cull = CullPattern(List=join.Breps, CullPattern=psrfclsd)
offsrf = OffsetSurface(Surface=item_18, Distance=Slider(3, range=0..10), BothSides=False, CreateSolid=True)
sint = SolidIntersection(BrepsA=extr, BrepsB=cap)
sunion = SolidUnion(Breps=flatten([offsrf, sint]))
sunion_2 = SolidUnion(Breps=flatten([sint, cull]))
# Solid
sdiff = SolidDifference(BrepsA=cap, BrepsB=msh2psrf)
# Gradient Thickness Shell
sdiff_2 = SolidDifference(BrepsA=sunion_2, BrepsB=msh2psrf)
# Constant Thickness Shell
sdiff_3 = SolidDifference(BrepsA=sunion, BrepsB=msh2psrf)
# NOTE
# Ellipse profile is close but not perfect
# Profiles need to be distorted to square off bottom edge
area = Area(Geometry=pframe)  # -> Area, graft(Centroid)
ellipse = Ellipse(Plane=pframe, Radius1=multiplication_3, Radius2=multiplication_4)  # -> Ellipse, Focus1, Focus2
divide_2 = DivideCurve(Curve=ellipse.Ellipse, Count=2, Kinks=False)  # -> Points, Tangents, Parameters
item_20 = ListItem(List=divide_2.Points, Index=0, Wrap=True)
move2pt_4 = MoveToPoint(Geometry=graft(ellipse.Ellipse), PointA=item_20, PointB=area.Centroid)  # -> Moved, Vector, Transform
loft = Loft(
    Curves=flatten(move2pt_4.Moved),
    Options={Adjust=False, Closed=False, LoftEnds=0, LoftSimp=0, LoftType=0, Rebuild=10, Refit=0.01})  # disabled

# ----
# Cull the first 40mm
len_3 = Length(Curve=ln_2)
division_3 = Division(A=len_3, B=knob)
division_4 = Division(A=40, B=division_3)
series_3 = Series(Start=0, Step=1, Count=division_4)
cull_i_2 = CullIndex(List=divide.Points, Indices=series_3, Wrap=True)

lng_2 = ListLength(List=cull_i_2)
intcrv_5 = Interpolate(Vertices=cull_i_2, Degree=3, Periodic=False, KnotStyle=1)  # -> Curve, Length, Domain
divide_3 = DivideCurve(Curve=intcrv_5.Curve, Count=lng_2, Kinks=False)  # -> Points, Tangents, Parameters
sort = SortList(Keys=divide_3.Parameters)  # -> Keys, ValuesValuesA
rev = ReverseList(List=sort.Keys)
cull_i_3 = CullIndex(List=divide_3.Points, Indices=0, Wrap=True)
item_21 = ListItem(List=rev, Index=0, Wrap=True)
# HORIZONTAL SPLITLINE
division_5 = Division(A=divide_3.Parameters, B=item_21)
cull_i_4 = CullIndex(List=division_5, Indices=0, Wrap=True)

# ----
# Split Line
# Curvature Control
number_slider_4 = Slider(34, range=30..60)
graph_4 = GraphMapper(division_5, x0=0, x1=1, y0=-1, y1=1, container_name="Bezier", cpx=[0, 0.09408602118, 1, 1], cpy=[1, 0, 0.441611886, 0])

multiplication_6 = Multiplication(A=graph_4, B=number_slider_4)
Z_4 = UnitZ(Factor=multiplication_6)
move_5 = Move(Geometry=divide_3.Points, Motion=Z_4)  # -> Geometry, Transform
lng_3 = ListLength(List=series_3)
subtraction_2 = Subtraction(A=lng_3, B=1)
cull_i_5 = CullIndex(List=series_3, Indices=subtraction_2, Wrap=True)
item_22 = ListItem(List=move_5.Geometry, Index=cull_i_5, Wrap=True)
lng_4 = ListLength(List=series_3)
lng_5 = ListLength(List=item_22)
addition = Addition(A=lng_5, B=lng_4)
series_4 = Series(Start=0, Step=1, Count=addition)
cull_i_6 = CullIndex(List=move_3.Geometry, Indices=series_4, Wrap=True)
ins = InsertItems(List=cull_i_6, Item=item_22, Indices=0, Wrap=True)
panel_4 = Panel("""80
-80""")
intcrv_6 = Interpolate(Vertices=ins, Degree=3, Periodic=False, KnotStyle=1)  # -> Curve, Length, Domain
X_2 = UnitX(Factor=panel_4)
extr_2 = Extrude(Base=intcrv_6.Curve, Direction=X_2)
knob_2 = ControlKnob(Decimals=1, Limit=True, Maximum=10, Minimum=0, Range=1, Value=5)
join_2 = BrepJoin(Breps=extr_2)  # -> Breps, Closed
Z_5 = UnitZ(Factor=knob_2)
move_6 = Move(Geometry=join_2.Breps, Motion=Z_5)  # -> Geometry, Transform
split = SplitBrep(Brep=loft, Cutter=move_6.Geometry)
# VERTICAL TRIM
item_23 = ListItem(List=split, Index=1, Wrap=True)

# ----
# Vertical Trim
# Curvature Control
graph_5 = GraphMapper(cull_i_4, x0=0, x1=1, y0=0, y1=2, container_name="Bezier", cpx=[0, 0, 1, 1], cpy=[0.8611767292, 0, 0.3125, 0])

multiplication_7 = Multiplication(A=graph_5, B=Slider(34, range=30..60))
neg_3 = Negative(Value=multiplication_7)
X_3 = UnitX(Factor=neg_3)
move_7 = Move(Geometry=cull_i_3, Motion=X_3)  # -> Geometry, Transform
cull_last_item = CullLastItem(list=move_7.Geometry)
mirror = Mirror(Geometry=cull_last_item, Plane=PlaneYZ(0, 0, 0))  # -> Geometry, Transform
rev_2 = ReverseList(List=mirror.Geometry)
intcrv_7 = Interpolate(Vertices=[cull_last_item, rev_2], Degree=3, Periodic=False, KnotStyle=1)  # -> Curve, Length, Domain
panel_5 = Panel("""-40
40""")
Z_6 = UnitZ(Factor=panel_5)
extr_3 = Extrude(Base=intcrv_7.Curve, Direction=Z_6)
join_3 = BrepJoin(Breps=extr_3)  # -> Breps, Closed
split_2 = SplitBrep(Brep=item_23, Cutter=join_3.Breps)
panel_6 = Panel("*Trimmed*")  # disabled
tmatch = MatchText(Text=split_2, Pattern=panel_6, Case=True)  # disabled
cull_2 = CullPattern(List=split_2, CullPattern=tmatch)  # disabled
offsrf_2 = OffsetSurface(Surface=cull_2, Distance=1, BothSides=False, CreateSolid=True)  # disabled
xz_2 = XZPlane(Origin=Point(0, 0, 0))  # disabled
pl_offset = PlaneOffset(BasePlane=xz_2, Offset=-4)  # disabled
# TOE CAP
item_24 = ListItem(List=flatten(move2pt_4.Moved), Index=0, Wrap=True)  # disabled
sec_3 = BrepPlane(Brep=cull_2, Plane=pl_offset)  # -> Curves, Points; disabled
crv = Curve(simplify(flatten(sec_3.Curves)))  # disabled
crv_2 = Curve(item_24)  # disabled
loft_2 = Loft(Curves=[item_24, crv], Options={Adjust=False, Closed=False, LoftEnds=0, LoftSimp=0, LoftType=0, Rebuild=10, Refit=0.01})  # disabled
cap_2 = CapHoles(Brep=loft_2)  # disabled
# BOOLEAN
sunion_3 = SolidUnion(Breps=flatten([cap_2, offsrf_2]))  # disabled
debrep_3 = DeconstructBrep(Brep=sunion_3)  # -> Faces, Edges, Vertices; disabled
panel_7 = Panel("*Elliptical*")  # disabled
panel_8 = Panel("*Elliptical*")  # disabled
panel_10 = Panel(debrep_3.Edges)  # disabled
tmatch_2 = MatchText(Text=debrep_3.Edges, Pattern=panel_7, Case=True)  # disabled
listdexs = ListIndices(List=debrep_3.Edges)  # disabled
# Fillet Outer Edge
# of Toebox
cull_3 = CullPattern(List=listdexs, CullPattern=tmatch_2)  # disabled
filedge = FilletEdge(Shape=sunion_3, Blend=0, Metric=0, Edges=cull_3, Radii=4)  # disabled
# TOEBOX FILLET
panel_11 = Panel("*Planar*")  # disabled
tmatch_3 = MatchText(Text=debrep_3.Edges, Pattern=panel_11, Case=True)  # disabled
listdexs_2 = ListIndices(List=debrep_3.Edges)  # disabled
cull_4 = CullPattern(List=listdexs_2, CullPattern=tmatch_3)  # disabled
cull_5 = CullPattern(List=debrep_3.Edges, CullPattern=tmatch_3)  # disabled
len_4 = Length(Curve=cull_5)  # disabled
sort_2 = SortList(Keys=len_4, ValuesValuesA=cull_4)  # -> Keys, ValuesValuesA; disabled
sort_3 = SortList(Keys=len_4, ValuesValuesA=cull_5)  # -> Keys, ValuesValuesA; disabled
panel_12 = Panel("""0
1
2""")  # disabled
item_25 = ListItem(List=sort_3.ValuesValuesA, Index=panel_12, Wrap=True)  # disabled
item_26 = ListItem(List=sort_2.ValuesValuesA, Index=panel_12, Wrap=True)  # disabled
filedge_2 = FilletEdge(Shape=filedge, Blend=0, Metric=0, Edges=item_26, Radii=2)  # disabled
material = CreateMaterial(Diffuse=RGB(255, 148, 180), Specular=RGB(255, 255, 255), Emission=RGB(0, 0, 0), Transparency=0, Shine=0)  # disabled
preview = CustomPreview(Geometry=filedge_2, Material=material)  # disabled

# ==== cluster CullLastItem
list = ClusterInput()
list_length = ListLength(List=list)
subtraction = Subtraction(A=list_length, B=1)
cull_index = CullIndex(List=list, Indices=subtraction, Wrap=True)
list_2 = ClusterOutput(cull_index)
