# Grasshopper definition 030421 component (from scratch).gh (Grasshopper 1.0.7)
# plug-ins: Pufferfish

# ----
# SCAN IN ->
mesh = Mesh(<mesh referenced from the Rhino model>)

# ----
# IMPORT MESH
deconstruct_mesh = DeconstructMesh(Mesh=mesh)  # -> Vertices, Faces, Colours, Normals
point_list = PointList(Points=deconstruct_mesh.Vertices)
list_item = ListItem(List=deconstruct_mesh.Vertices, Index=2420, Wrap=True)
move_to_point = MoveToPoint(Geometry=mesh, PointA=list_item, PointB=Point(0, 0, 0))  # -> Moved, Vector, Transform
mesh_to_polysurface = MeshToPolysurface(Mesh=move_to_point.Moved, Triangles=False, FaceMerge=False)
deconstruct_mesh_2 = DeconstructMesh(Mesh=move_to_point.Moved)  # -> Vertices, Faces, Colours, Normals
deconstruct_brep = DeconstructBrep(Brep=mesh_to_polysurface)  # -> Faces, Edges, Vertices
# Bisect the Foot
brep_plane = BrepPlane(Brep=mesh_to_polysurface, Plane=PlaneYZ(0, 0, 0))  # -> Curves, Points
# Generate 'Base' Plane
brep_plane_2 = BrepPlane(Brep=mesh_to_polysurface, Plane=PlaneXY(0, 0, 0))  # -> Curves, Points
# Set Shank Length to 85% of Footbase
tip_of_big_toe = ListItem(List=deconstruct_mesh_2.Vertices, Index=2420, Wrap=True)
back_of_heel = ListItem(List=deconstruct_mesh_2.Vertices, Index=2027, Wrap=True)
foot_origin = Point(Point(-10.57774937, 0, -8.295549096))
platform_height_mm = Slider(34, range=0..100)
platform_width_mm = Slider(36, range=0..100)
platform_width_mm_2 = Slider(42, range=0..100)
line = Line(StartPoint=tip_of_big_toe, EndPoint=back_of_heel)
foot_bisection_plane = Plane(PlaneYZ(-10.57774937, 0, 0))
offset_curve = OffsetCurve(Curve=brep_plane_2.Curves, Distance=-15, Plane=PlaneXY(0, 0, 0), Corners=2)
offset_curve_2 = OffsetCurve(Curve=brep_plane.Curves, Distance=-15, Plane=PlaneYZ(0, 0, 0), Corners=1)
project = Project(Geometry=line, Plane=foot_bisection_plane)  # -> Geometry, Transform
extrude = Extrude(Base=offset_curve, Direction=Vector(0, 0, -30))
division = Division(A=platform_width_mm_2, B=2)
division_2 = Division(A=platform_height_mm, B=2)
division_3 = Division(A=platform_width_mm, B=2)
extrude_2 = Extrude(Base=offset_curve_2, Direction=Vector(-70, 0, 0))
extrude_3 = Extrude(Base=offset_curve_2, Direction=Vector(70, 0, 0))
foot_base_plane = Plane(PlaneXY(-10.57774937, 0, -8.295549096))
cap_holes = CapHoles(Brep=extrude)
negative = Negative(Value=division)
negative_2 = Negative(Value=division_3)
unit_z = UnitZ(Factor=division_2)
cap_holes_2 = CapHoles(Brep=extrude_2)
cap_holes_3 = CapHoles(Brep=extrude_3)
project_2 = Project(Geometry=project.Geometry, Plane=foot_base_plane)  # -> Geometry, Transform
point_in_brep = PointInBrep(Brep=cap_holes, Point=deconstruct_brep.Vertices, Strict=False)
unit_x = UnitX(Factor=[division, negative])
unit_x_2 = UnitX(Factor=[division_3, negative_2])
cull_pattern = CullPattern(List=deconstruct_brep.Vertices, CullPattern=point_in_brep)
scale_nu = ScaleNU(Geometry=project_2.Geometry, Plane=foot_base_plane, ScaleX=1, ScaleY=0.85, ScaleZ=1)  # -> Geometry, Transform
# Side Profile Cut
divide_curve = DivideCurve(Curve=scale_nu.Geometry, Count=20, Kinks=False)  # -> Points, Tangents, Parameters
graph_mapper = GraphMapper(
    divide_curve.Parameters,
    x0=0,
    x1=1,
    y0=0,
    y1=1,
    container_name="Bezier",
    cpx=[0, 0.3863660097, 0.3824808896, 1],
    cpy=[1, 0, 0, 0])
point_in_brep_2 = PointInBrep(Brep=cap_holes_3, Point=deconstruct_brep.Vertices, Strict=False)
point_in_brep_3 = PointInBrep(Brep=cap_holes_2, Point=deconstruct_brep.Vertices, Strict=False)
move = Move(Geometry=foot_origin, Motion=unit_x)  # -> Geometry, Transform
move_2 = Move(Geometry=foot_origin, Motion=unit_x_2)  # -> Geometry, Transform
project_3 = Project(Geometry=cull_pattern, Plane=PlaneXY(0, 0, 0))  # -> Geometry, Transform
unit_z_2 = UnitZ(Factor=Slider(7, range=0..10))
cull_pattern_2 = CullPattern(List=deconstruct_brep.Vertices, CullPattern=point_in_brep_3)
cull_pattern_3 = CullPattern(List=deconstruct_brep.Vertices, CullPattern=point_in_brep_2)
end_points = EndPoints(Curve=scale_nu.Geometry)  # -> Start, End
bounding_rectangle = BoundingRectangle(Geometry=brep_plane_2.Curves, Plane=PlaneXY(0, 0, 0), Axis=0, Slide=0, Union=True)  # -> Bounding, DimensionX, DimensionY
unit_z_3 = UnitZ(Factor=graph_mapper)
move_3 = Move(Geometry=move.Geometry, Motion=unit_z_2)  # -> Geometry, Transform
list_item_2 = ListItem(List=move_2.Geometry, Index=0, Wrap=True)
multiplication = Multiplication(A=unit_z_3, B=100)
list_item_3 = ListItem(List=move_2.Geometry, Index=1, Wrap=True)
circle = Circle(Plane=end_points.End, Radius=15)
project_4 = Project(Geometry=cull_pattern_3, Plane=PlaneYZ(0, 0, 0))  # -> Geometry, Transform
project_5 = Project(Geometry=cull_pattern_2, Plane=PlaneYZ(0, 0, 0))  # -> Geometry, Transform
distance = Distance(PointA=project_3.Geometry, PointB=cull_pattern)
unit_x_3 = UnitX(Factor=bounding_rectangle.DimensionX)
move_4 = Move(Geometry=foot_origin, Motion=unit_z)  # -> Geometry, Transform
move_5 = Move(Geometry=divide_curve.Points, Motion=multiplication)  # -> Geometry, Transform
divide_curve_2 = DivideCurve(Curve=circle, Count=2, Kinks=False)  # -> Points, Tangents, Parameters
list_item_4 = ListItem(List=move_3.Geometry, Index=1, Wrap=True)
list_item_5 = ListItem(List=move_3.Geometry, Index=0, Wrap=True)
average = Average(Input=distance)
distance_2 = Distance(PointA=cull_pattern_2, PointB=project_5.Geometry)
distance_3 = Distance(PointA=cull_pattern_3, PointB=project_4.Geometry)
extrude_4 = Extrude(Base=scale_nu.Geometry, Direction=unit_x_3)
nurbs_curve = NurbsCurve(Vertices=[list_item_2, list_item_5, move_4.Geometry, list_item_4, list_item_3], Degree=2, Periodic=False)  # -> Curve, Length, Domain
interpolate = Interpolate(Vertices=move_5.Geometry, Degree=3, Periodic=False, KnotStyle=1)  # -> Curve, Length, Domain
average_2 = Average(Input=distance_2)
average_3 = Average(Input=distance_3)
negative_3 = Negative(Value=average)
close_curve = CloseCurve(Curve=nurbs_curve.Curve, CloseType=2, Bulge=0.2, Tolerance=0)  # -> Closed, ResultBoolean
list_item_6 = ListItem(List=divide_curve_2.Points, Index=1, Wrap=True)
list_item_7 = ListItem(List=divide_curve_2.Points, Index=0, Wrap=True)
extrude_5 = Extrude(Base=interpolate.Curve, Direction=[Vector(100, 0, 0), Vector(-100, 0, 0)])
foot_bisection_plane_2 = Plane(PlaneYZ(-10.57774937, 0, 0))
average_4 = Average(Input=[average_2, average_3])
brep_join = BrepJoin(Breps=extrude_5)  # -> Breps, Closed
offset_surface = OffsetSurface(Surface=brep_join.Breps, Distance=-80, BothSides=False, CreateSolid=True)
curve_plane = CurvePlane(Curve=close_curve.Closed, Plane=foot_bisection_plane_2)  # -> Points, ParamsC, ParamsP
subtraction = Subtraction(A=average_3, B=average_4)
deconstruct = Deconstruct(Point=curve_plane.Points)  # -> XComponent, YComponent, ZComponent
construct_point = ConstructPoint(XCoordinate=subtraction, YCoordinate=0, ZCoordinate=0)
construct_point_2 = ConstructPoint(XCoordinate=subtraction, YCoordinate=0, ZCoordinate=negative_3)
sort_list = SortList(Keys=deconstruct.ZComponent, ValuesValuesA=curve_plane.Points)  # -> Keys, ValuesValuesA
deconstruct_mesh_3 = DeconstructMesh(Mesh=move_to_point.Moved)  # -> Vertices, Faces, Colours, Normals
foot_origin_2 = ConstructPoint(XCoordinate=subtraction, YCoordinate=0, ZCoordinate=negative_3)
foot_bisection_plane_3 = YZPlane(Origin=construct_point)
foot_base_plane_2 = XYPlane(Origin=construct_point_2)
list_item_8 = ListItem(List=sort_list.ValuesValuesA, Index=0, Wrap=True)
move_to_point_2 = MoveToPoint(Geometry=close_curve.Closed, PointA=list_item_8, PointB=foot_origin)  # -> Moved, Vector, Transform
panel = Panel("""8594
12722
10481
658
7004
869
12059
12003
9808
6220
6174
6112
6107
6063
3659
3664""")
panel_2 = Panel("""9454
9436
9414
9356
7506
718
414
1608
4584
6441
12371
5190
7972
8186
4854
2081
1977
8007
2325""")
panel_3 = Panel("""8646
11329
12329
9761
293
2121
7651
324
6350
7262""")
image_sampler = ImageSampler(
    FilePath="C:\Users\Luke Hillery\Documents\DE4\SOLO\Component CAD\foot top view.jpg",
    Filter="Colour",
    Interpolate=False,
    Umax=1,
    Umin=0,
    Vmax=1,
    Vmin=0,
    Wrap=1)
# Tip of 2nd Toe
list_item_9 = ListItem(List=deconstruct_mesh_3.Vertices, Index=9089, Wrap=True)
# Tip of Big Toe
list_item_10 = ListItem(List=deconstruct_mesh_3.Vertices, Index=2420, Wrap=True)

# ----
# Back of Heel
list_item_11 = ListItem(List=deconstruct_mesh.Vertices, Index=2027, Wrap=True)

# ----
# Outside Instep
list_item_12 = ListItem(List=deconstruct_mesh_3.Vertices, Index=panel, Wrap=True)

# ----
# Instep Profile
list_item_13 = ListItem(List=deconstruct_mesh_3.Vertices, Index=panel_2, Wrap=True)

# ----
# Inside Instep
list_item_14 = ListItem(List=deconstruct_mesh_3.Vertices, Index=panel_3, Wrap=True)

line_2 = Line(StartPoint=list_item_10, EndPoint=list_item_9)
interpolate_2 = Interpolate(Vertices=list_item_14, Degree=1, Periodic=False, KnotStyle=1)  # -> Curve, Length, Domain
interpolate_3 = Interpolate(Vertices=list_item_13, Degree=1, Periodic=False, KnotStyle=1)  # -> Curve, Length, Domain
interpolate_4 = Interpolate(Vertices=list_item_12, Degree=1, Periodic=False, KnotStyle=1)  # -> Curve, Length, Domain
curve_middle = CurveMiddle(Curve=line_2)
# Tip of Big Toe
xy_plane = XYPlane(Origin=Point(0, 0, 0))
# FOOT LENGTH
unit_z_4 = UnitZ(Factor=-1)
unit_z_5 = UnitZ(Factor=-1)
xy_plane_2 = XYPlane(Origin=Point(0, 0, 0))
project_6 = Project(Geometry=interpolate_4.Curve, Plane=PlaneXY(0, 0, 0))  # -> Geometry, Transform
project_7 = Project(Geometry=interpolate_2.Curve, Plane=PlaneXY(0, 0, 0))  # -> Geometry, Transform
project_8 = Project(Geometry=interpolate_3.Curve, Plane=PlaneYZ(0, 0, 0))  # -> Geometry, Transform
project_point = ProjectPoint(Point=list_item, Direction=unit_z_4, Geometry=xy_plane)  # -> Point, Index
project_point_2 = ProjectPoint(Point=list_item_11, Direction=unit_z_5, Geometry=xy_plane_2)  # -> Point, Index
rebuild_curve = RebuildCurve(Curve=project_6.Geometry, Count=4, Degree=3, EndTangents=False)
rebuild_curve_2 = RebuildCurve(Curve=project_7.Geometry, Count=3, Degree=2, EndTangents=False)
rebuild_curve_3 = RebuildCurve(Curve=project_8.Geometry, Count=8, Degree=5, EndTangents=False)

# ----
# Foot Length
distance_4 = Distance(PointA=project_point.Point, PointB=project_point_2.Point)

xz_plane = XZPlane(Origin=foot_origin_2)
offset_plane = OffsetPlane(Plane=xz_plane, Distance=-70, BothSides=False, OffsetX=False, OffsetY=False, OffsetZ=True)
multiplication_2 = Multiplication(A=distance_4, B=0.8)
round = Round(Number=multiplication_2)  # -> Nearest, Floor, Ceiling
brep_plane_3 = BrepPlane(Brep=mesh_to_polysurface, Plane=offset_plane)  # -> Curves, Points
series = Series(Start=0, Step=1, Count=5)
rebuild_curve_4 = RebuildCurve(Curve=brep_plane_3.Curves, Count=20, Degree=5, EndTangents=False)
rebuild_curve_5 = RebuildCurve(Curve=move_to_point_2.Moved, Count=20, Degree=5, EndTangents=False)
number_slider = Slider(20, range=0..100)
addition = Addition(A=series, B=1)
division_4 = Division(A=number_slider, B=2)
align_curve_seams = AlignCurveSeams(Curves=[rebuild_curve_4, rebuild_curve_5], Seam=1, Snap=False, Iterative=True)  # -> Aligned, Points, ResultBoolean
perp_frames = PerpFrames(Curve=scale_nu.Geometry, Count=number_slider, Align=True)  # -> Frames, Parameters
series_2 = Series(Start=0, Step=1, Count=division_4)
list_item_15 = ListItem(List=perp_frames.Frames, Index=series_2, Wrap=True)
construct_domain = ConstructDomain(DomainStart=Slider(2, range=0..10), DomainEnd=Slider(10, range=0..12))
brep_plane_4 = BrepPlane(Brep=mesh_to_polysurface, Plane=list_item_15)  # -> Curves, Points
offset_curve_3 = OffsetCurve(Curve=brep_plane_4.Curves, Distance=-1, Plane=PlaneXZ(0, 0, 0), Corners=1)
list_item_16 = ListItem(List=flatten(offset_curve_3), Index=1, Wrap=True)
rebuild_curve_6 = RebuildCurve(Curve=offset_curve_3, Degree=2, Count=50, Tangents=False)  # -> simplify(Curve)
curve_plane_2 = CurvePlane(Curve=list_item_16, Plane=PlaneXY(0, 0, 0))  # -> Points, ParamsC, ParamsP
unit_z_6 = UnitZ(Factor=[-50, 50])
list_item_17 = ListItem(List=curve_plane_2.Points, Index=0, Wrap=True)
flip_curve = FlipCurve(Curve=move_to_point_2.Moved)  # -> Curve, Flag
extrude_6 = Extrude(Base=circle, Direction=unit_z_6)
align_curve_seams_2 = AlignCurveSeams(Curves=rebuild_curve_6, Guide=list_item_17, Seam=1, Snap=False, Iterative=True)  # -> Aligned, Points, ResultBoolean
rebuild_curve_7 = RebuildCurve(Curve=flip_curve.Curve, Count=50, EndTangents=False)
cap_holes_4 = CapHoles(Brep=extrude_6)
list_item_18 = ListItem(List=flatten(align_curve_seams_2.Aligned), Index=-1, Wrap=True)
unit_z_7 = UnitZ(Factor=[-50, 50])
solid_union = SolidUnion(Breps=cap_holes_4)
align_curve_seams_3 = AlignCurveSeams(Curves=[list_item_18, rebuild_curve_7], Guide=list_item_17, Seam=1, Snap=False, Iterative=True)  # -> Aligned, Points, ResultBoolean
# Shell of Foot
loft = Loft(
    Curves=flatten(align_curve_seams_2.Aligned),
    Options={Adjust=False, Closed=False, LoftEnds=0, LoftSimp=0, LoftType=0, Rebuild=10, Refit=0.01})
list_item_19 = ListItem(List=flatten(align_curve_seams_2.Aligned), Index=0, Wrap=True)
list_item_20 = ListItem(List=flatten(align_curve_seams_2.Aligned), Index=-1, Wrap=True)
brep_curve = BrepCurve(Brep=brep_join.Breps, Curve=list_item_20)  # -> Curves, Points
list_item_21 = ListItem(List=brep_curve.Points, Index=1, Wrap=True)
list_item_22 = ListItem(List=brep_curve.Points, Index=0, Wrap=True)
line_3 = Line(StartPoint=list_item_21, EndPoint=list_item_6)
line_4 = Line(StartPoint=list_item_22, EndPoint=list_item_7)
divide_curve_3 = DivideCurve(Curve=line_3, Count=20, Kinks=False)  # -> Points, Tangents, Parameters
divide_curve_4 = DivideCurve(Curve=line_4, Count=20, Kinks=False)  # -> Points, Tangents, Parameters
graph_mapper_2 = GraphMapper(
    divide_curve_3.Parameters,
    x0=0,
    x1=1,
    y0=-1,
    y1=1,
    container_name="Bezier",
    cpx=[0, 0.159441635, 0, 1],
    cpy=[0.5015228987, 0.5297356844, 0.3050661087, 0.5008969307])
graph_mapper_3 = GraphMapper(
    divide_curve_4.Parameters,
    x0=0,
    x1=1,
    y0=-1,
    y1=1,
    container_name="Bezier",
    cpx=[0, 0, 0.4491433203, 1],
    cpy=[0.50220263, 0.5211445093, 0.4125546217, 0.499735415])
multiplication_3 = Multiplication(A=graph_mapper_2, B=-40)
multiplication_4 = Multiplication(A=graph_mapper_3, B=40)
unit_x_4 = UnitX(Factor=multiplication_3)
unit_x_5 = UnitX(Factor=multiplication_4)
move_6 = Move(Geometry=divide_curve_3.Points, Motion=unit_x_4)  # -> Geometry, Transform
move_7 = Move(Geometry=divide_curve_4.Points, Motion=unit_x_5)  # -> Geometry, Transform
interpolate_5 = Interpolate(Vertices=move_7.Geometry, Degree=3, Periodic=False, KnotStyle=1)  # -> Curve, Length, Domain
interpolate_6 = Interpolate(Vertices=move_6.Geometry, Degree=3, Periodic=False, KnotStyle=1)  # -> Curve, Length, Domain
project_9 = Project(Curve=interpolate_5.Curve, Brep=brep_join.Breps, Direction=Vector(0, 0, 1))
project_10 = Project(Curve=interpolate_6.Curve, Brep=brep_join.Breps, Direction=Vector(0, 0, 1))
flip_curve_2 = FlipCurve(Curve=project_10)  # -> Curve, Flag
ruled_surface = RuledSurface(CurveA=project_9, CurveB=flip_curve_2.Curve)
split_with_breps = SplitWithBreps(Curve=list_item_20, Brep=brep_join.Breps)  # -> Curve, Points
extrude_7 = Extrude(Base=ruled_surface, Direction=unit_z_7)
length = Length(Curve=split_with_breps.Curve)
sort_list_2 = SortList(Keys=length, ValuesA=split_with_breps.Curve)  # -> Keys, ValuesA
solid_union_2 = SolidUnion(Breps=extrude_7)
list_item_23 = ListItem(List=flatten(align_curve_seams_3.Aligned), Index=-1, Wrap=True)
unit_y = UnitY(Factor=300)
list_item_24 = ListItem(List=sort_list_2.ValuesA, Index=0, Wrap=True)
curve_plane_3 = CurvePlane(Curve=list_item_23, Plane=PlaneXY(0, 0, 0))  # -> Points, ParamsC, ParamsP
extrude_8 = Extrude(Base=list_item_24, Direction=unit_y)
offset_surface_2 = OffsetSurface(Surface=flatten(loft), Distance=-1, BothSides=False, CreateSolid=True)
offset_surface_3 = OffsetSurface(Surface=extrude_8, Distance=-1, BothSides=False, CreateSolid=True)
solid_intersection = SolidIntersection(BrepsA=offset_surface_3, BrepsB=solid_union)
solid_intersection_2 = SolidIntersection(BrepsA=offset_surface_3, BrepsB=solid_union_2)
brep_plane_5 = BrepPlane(Brep=loft, Plane=PlaneXY(0, 0, 0))  # -> Curves, Points
solid_union_3 = SolidUnion(Breps=[solid_intersection_2, solid_intersection])
list_item_25 = ListItem(List=brep_plane_5.Curves, Index=0, Wrap=True)
list_item_26 = ListItem(List=brep_plane_5.Curves, Index=1, Wrap=True)
end_points_2 = EndPoints(Curve=list_item_26)  # -> Start, End
end_points_3 = EndPoints(Curve=list_item_25)  # -> Start, End
list_item_27 = ListItem(List=curve_plane_3.Points, Index=0, Wrap=True)
list_item_28 = ListItem(List=curve_plane_3.Points, Index=1, Wrap=True)
project_11 = Project(Geometry=end_points_2.Start, Plane=PlaneXZ(0, 0, 0))  # -> Geometry, Transform
project_12 = Project(Geometry=end_points_2.End, Plane=PlaneXZ(0, 0, 0))  # -> Geometry, Transform
move_to_point_3 = MoveToPoint(Geometry=list_item_25, PointA=end_points_3.End, PointB=list_item_28)  # -> Moved, Vector, Transform
move_to_point_4 = MoveToPoint(Geometry=list_item_26, PointA=end_points_2.Start, PointB=list_item_27)  # -> Moved, Vector, Transform
project_13 = Project(Geometry=end_points_3.End, Plane=PlaneXZ(0, 0, 0))  # -> Geometry, Transform
project_14 = Project(Geometry=end_points_3.Start, Plane=PlaneXZ(0, 0, 0))  # -> Geometry, Transform
distance_5 = Distance(PointA=project_11.Geometry, PointB=project_12.Geometry)
distance_6 = Distance(PointA=list_item_27, PointB=project_12.Geometry)
distance_7 = Distance(PointA=list_item_28, PointB=project_14.Geometry)
distance_8 = Distance(PointA=project_13.Geometry, PointB=project_14.Geometry)
division_5 = Division(A=distance_6, B=distance_5)
xy_plane_3 = XYPlane(Origin=Point(0, 0, 0))
xy_plane_4 = XYPlane(Origin=Point(0, 0, 0))
division_6 = Division(A=distance_7, B=distance_8)
plane_origin = PlaneOrigin(Base=xy_plane_3, Origin=list_item_27)
plane_origin_2 = PlaneOrigin(Base=xy_plane_4, Origin=list_item_28)
scale_nu_2 = ScaleNU(Geometry=move_to_point_4.Moved, Plane=plane_origin, ScaleX=division_5, ScaleY=1, ScaleZ=1)  # -> Geometry, Transform
scale_nu_3 = ScaleNU(Geometry=move_to_point_3.Moved, Plane=plane_origin_2, ScaleX=division_6, ScaleY=1, ScaleZ=1)  # -> Geometry, Transform
flip_curve_3 = FlipCurve(Curve=scale_nu_2.Geometry)  # -> Curve, Flag
end_points_4 = EndPoints(Curve=scale_nu.Geometry)  # -> Start, End
divide_curve_5 = DivideCurve(Curve=scale_nu_3.Geometry, Count=50, Kinks=False)  # -> Points, Tangents, Parameters
divide_curve_6 = DivideCurve(Curve=flip_curve_3.Curve, Count=50, Kinks=False)  # -> Points, Tangents, Parameters
rebuild_curve_8 = RebuildCurve(Curve=scale_nu_3.Geometry, Count=10, Degree=4, EndTangents=True)
line_5 = Line(StartPoint=end_points_2.End, EndPoint=end_points_4.End)
interpolate_7 = Interpolate(Vertices=divide_curve_6.Points, Degree=3, Periodic=False, KnotStyle=1)  # -> Curve, Length, Domain
interpolate_8 = Interpolate(Vertices=divide_curve_5.Points, Degree=3, Periodic=False, KnotStyle=1)  # -> Curve, Length, Domain
sweep2 = Sweep2(Rail1=list_item_23, Rail2=list_item_20, Sections=[interpolate_8.Curve, interpolate_7.Curve], SameHeight=True)
cap_holes_5 = CapHoles(Brep=loft)
offset_surface_4 = OffsetSurface(Surface=flatten(sweep2), Distance=-2, BothSides=False, CreateSolid=True)
xz_plane_2 = XZPlane(Origin=Point(0, 5, 0))  # disabled
number_slider_2 = Slider(3, range=0..10)  # disabled
rectangle = Rectangle(Plane=xz_plane_2, XSize=Domain(-50, 50), YSize=Domain(-50, 50), Radius=0)  # -> Rectangle, Length; disabled

# ----
# CHRONOLOGICAL ORDER -->
# Foot Length (mm)
number_slider_3 = Slider(150, range=50..300)

boundary_surfaces = BoundarySurfaces(Edges=rectangle.Rectangle)  # disabled
unit_y_2 = UnitY(Factor=-10)  # disabled
extrude_9 = Extrude(Base=boundary_surfaces, Direction=unit_y_2)  # disabled
construct_point_3 = ConstructPoint(XCoordinate=0, YCoordinate=0, ZCoordinate=0)
unit_y_3 = UnitY(Factor=round.Nearest)
move_8 = Move(Geometry=construct_point_3, Motion=unit_y_3)  # -> Geometry, Transform
yz_plane = YZPlane(Origin=Point(0, 0, 0))
mesh_to_polysurface_2 = MeshToPolysurface(Mesh=move_to_point.Moved, Triangles=False, FaceMerge=False)  # disabled
point = Point(curve_middle)
project_15 = Project(Geometry=point, Plane=yz_plane)  # -> Geometry, Transform
distance_9 = Distance(PointA=point, PointB=project_15.Geometry)

# ----
# Curvature
# Interpolation
# Degree
# NOTE
# Only works at 15 and 20...
control_knob = ControlKnob(Decimals=0, Limit=True, Maximum=20, Minimum=10, Range=20, Value=15)

negative_4 = Negative(Value=distance_9)
unit_x_6 = UnitX(Factor=negative_4)
# TOEBOX SHAPE
move_9 = Move(Geometry=move_8.Geometry, Motion=unit_x_6)  # -> Geometry, Transform
line_6 = Line(StartPoint=point, EndPoint=move_9.Geometry)
divide_curve_7 = DivideCurve(Curve=line_6, Count=control_knob, Kinks=False)  # -> Points, Tangents, Parameters

# ----
# Toebox
# Curvature Control
graph_mapper_4 = GraphMapper(
    divide_curve_7.Parameters,
    x0=0,
    x1=1,
    y0=0,
    y1=1,
    container_name="Bezier",
    cpx=[0, 0.630081296, 0.9479647875, 1],
    cpy=[0, 0, 0.05223429203, 0.7957516909])
# NOTE
# Curvature should be taken from
# raw 3D scan, either using photo with
# edge detection or with cross-section
# curves through mesh from 3D scan
number_slider_4 = Slider(50, range=30..60)

multiplication_5 = Multiplication(A=graph_mapper_4, B=number_slider_4)
negative_5 = Negative(Value=multiplication_5)
unit_z_8 = UnitZ(Factor=negative_5)
move_10 = Move(Geometry=divide_curve_7.Points, Motion=unit_z_8)  # -> Geometry, Transform

# ----
# Width and Height
# Curvature Control
graph_mapper_5 = GraphMapper(
    divide_curve_7.Parameters,
    x0=0,
    x1=1,
    y0=0,
    y1=1,
    container_name="Bezier",
    cpx=[0, 0.1070338339, 0.4497973323, 1],
    cpy=[0.489772439, 1, 1, 0.3865298629])
graph_mapper_6 = GraphMapper(
    divide_curve_7.Parameters,
    x0=0,
    x1=1,
    y0=0,
    y1=1,
    container_name="Bezier",
    cpx=[0, 0.331707716, 0.7379239798, 1],
    cpy=[0.2553995252, 0.8880677819, 0.006016790867, 1])
# NOTE
# Curvature should be taken from
# raw 3D scan, either using photo with
# edge detection or with cross-section
# curves through mesh from 3D scan
number_slider_5 = Slider(60, range=30..60)
multiplication_6 = Multiplication(A=graph_mapper_5, B=Slider(17, range=10..60))
multiplication_7 = Multiplication(A=graph_mapper_6, B=number_slider_5)

interpolate_9 = Interpolate(Vertices=move_10.Geometry, Degree=3, Periodic=False, KnotStyle=1)  # -> Curve, Length, Domain
perp_frame = PerpFrame(Curve=interpolate_9.Curve, Parameter=move_10.Geometry)
curve_plane_4 = CurvePlane(Curve=rebuild_curve, Plane=perp_frame)  # -> graft(Points), ParamsC, ParamsP
curve_plane_5 = CurvePlane(Curve=rebuild_curve_3, Plane=perp_frame)  # -> flatten(Points), ParamsC, ParamsP
curve_plane_6 = CurvePlane(Curve=rebuild_curve_2, Plane=perp_frame)  # -> graft(Points), ParamsC, ParamsP
cull_index = CullIndex(List=curve_plane_5.Points, Indices=0, Wrap=True)
deconstruct_2 = Deconstruct(Point=perp_frame)  # -> XComponent, YComponent, ZComponent
list_item_29 = ListItem(List=flatten(curve_plane_6.Points), Index=series, Wrap=True)
list_item_30 = ListItem(List=flatten(curve_plane_4.Points), Index=series, Wrap=True)
sort_list_3 = SortList(Keys=deconstruct_2.YComponent, ValuesValuesA=perp_frame)  # -> Keys, flatten(ValuesValuesA)
interpolate_10 = Interpolate(Vertices=cull_index, Degree=3, Periodic=False, KnotStyle=1)  # -> Curve, Length, Domain
interpolate_11 = Interpolate(Vertices=list_item_30, Degree=3, Periodic=False, KnotStyle=1)  # -> Curve, Length, Domain
interpolate_12 = Interpolate(Vertices=list_item_29, Degree=3, Periodic=False, KnotStyle=1)  # -> Curve, Length, Domain
list_item_31 = ListItem(List=sort_list_3.ValuesValuesA, Index=addition, Wrap=True)
arc_3pt = Arc3Pt(PointA=list_item_29, PointB=cull_index, PointC=list_item_30)  # -> Arc, Plane, Radius
list_item_32 = ListItem(List=list_item_31, Index=-1, Wrap=True)
close_curve_2 = CloseCurve(Curve=arc_3pt.Arc, CloseType=2, Bulge=0.3, Tolerance=0)  # -> Closed, ResultBoolean
list_length = ListLength(List=close_curve_2.Closed)
subtraction_2 = Subtraction(A=list_length, B=1)
curve_plane_7 = CurvePlane(Curve=rebuild_curve_2, Plane=list_item_32)  # -> Points, ParamsC, ParamsP
range = Range(Domain=construct_domain, Steps=subtraction_2)  # -> flatten(Range)
integer = Integer(range)
rebuild_curve_9 = RebuildCurve(Curve=close_curve_2.Closed, Count=6, Degree=integer, EndTangents=False)  # -> graft(Rebuilt)
offset_curve_4 = OffsetCurve(Curve=rebuild_curve_9, Distance=5, Plane=PlaneXZ(0, 0, 0), Corners=1)
list_item_33 = ListItem(List=flatten(offset_curve_4), Index=0, Wrap=True)
list_item_34 = ListItem(List=flatten(offset_curve_4), Index=-1, Wrap=True)
project_16 = Project(Geometry=list_item_33, Plane=PlaneXZ(0, 0, 0))  # -> Geometry, Transform; disabled
planar = Planar(Curve=list_item_34)  # -> Planar, Plane, Deviation; disabled
curve_plane_8 = CurvePlane(Curve=project_16.Geometry, Plane=PlaneXY(0, 0, 0))  # -> Points, ParamsC, ParamsP; disabled
deconstruct_3 = Deconstruct(Point=curve_plane_8.Points)  # -> XComponent, YComponent, ZComponent; disabled
larger_than = LargerThan(FirstNumber=deconstruct_3.XComponent, SecondNumber=0)  # -> LargerThan, OrEqualTo; disabled
reverse_list = ReverseList(List=larger_than.LargerThan)  # disabled
cull_pattern_4 = CullPattern(List=curve_plane_8.Points, CullPattern=larger_than.LargerThan)  # disabled
cull_pattern_5 = CullPattern(List=curve_plane_8.Points, CullPattern=reverse_list)  # disabled

project_17 = Project(Geometry=interpolate_12.Curve, Plane=PlaneYZ(0, 0, 0))  # -> Geometry, Transform; disabled
explode = Explode(Curve=interpolate_12.Curve, Recursive=True)  # -> Segments, Vertices; disabled
explode_2 = Explode(Curve=project_17.Geometry, Recursive=True)  # -> Segments, Vertices; disabled
length_2 = Length(Curve=project_17.Geometry)  # disabled
list_item_35 = ListItem(List=explode.Vertices, Index=0, Wrap=True)  # disabled
move_to_point_5 = MoveToPoint(Geometry=interpolate_12.Curve, PointA=list_item_35, PointB=cull_pattern_4)  # -> Moved, Vector, Transform; disabled
list_item_36 = ListItem(List=explode_2.Vertices, Index=1, Wrap=True)  # disabled
distance_10 = Distance(PointA=Point(0, 0, 0), PointB=list_item_36)  # disabled
division_7 = Division(A=distance_10, B=length_2)  # disabled
scale_nu_4 = ScaleNU(Geometry=move_to_point_5.Moved, Plane=PlaneXY(0, 0, 0), ScaleX=1, ScaleY=division_7, ScaleZ=1)  # -> Geometry, Transform; disabled

yz_plane_2 = YZPlane(Origin=Point(0, 0, 0))  # disabled
project_18 = Project(Geometry=interpolate_11.Curve, Plane=yz_plane_2)  # -> Geometry, Transform; disabled
explode_3 = Explode(Curve=rebuild_curve, Recursive=True)  # -> Segments, Vertices; disabled
explode_4 = Explode(Curve=project_18.Geometry, Recursive=True)  # -> Segments, Vertices; disabled
length_3 = Length(Curve=project_18.Geometry)  # disabled
construct_point_4 = ConstructPoint(XCoordinate=0, YCoordinate=0, ZCoordinate=0)  # disabled
list_item_37 = ListItem(List=explode_3.Vertices, Index=0, Wrap=True)  # disabled
list_item_38 = ListItem(List=explode_4.Vertices, Index=1, Wrap=True)  # disabled
move_to_point_6 = MoveToPoint(Geometry=rebuild_curve, PointA=list_item_37, PointB=cull_pattern_5)  # -> Moved, Vector, Transform; disabled
distance_11 = Distance(PointA=construct_point_4, PointB=list_item_38)  # disabled
division_8 = Division(A=distance_11, B=length_3)  # disabled
scale_nu_5 = ScaleNU(Geometry=move_to_point_6.Moved, Plane=PlaneXY(0, 0, 0), ScaleX=1, ScaleY=division_8, ScaleZ=1)  # -> Geometry, Transform; disabled

project_19 = Project(Geometry=interpolate_11.Curve, Plane=PlaneYZ(0, 0, 0))  # -> Geometry, Transform; disabled
explode_5 = Explode(Curve=interpolate_11.Curve, Recursive=True)  # -> Segments, Vertices; disabled
explode_6 = Explode(Curve=project_19.Geometry, Recursive=True)  # -> Segments, Vertices; disabled
length_4 = Length(Curve=project_19.Geometry)  # disabled
list_item_39 = ListItem(List=explode_5.Vertices, Index=0, Wrap=True)  # disabled
move_to_point_7 = MoveToPoint(Geometry=interpolate_11.Curve, PointA=list_item_39, PointB=cull_pattern_5)  # -> Moved, Vector, Transform; disabled
list_item_40 = ListItem(List=explode_6.Vertices, Index=1, Wrap=True)  # disabled
distance_12 = Distance(PointA=Point(0, 0, 0), PointB=list_item_40)  # disabled
division_9 = Division(A=distance_12, B=length_4)  # disabled
scale_nu_6 = ScaleNU(Geometry=move_to_point_7.Moved, Plane=PlaneXY(0, 0, 0), ScaleX=1, ScaleY=division_9, ScaleZ=1)  # -> Geometry, Transform; disabled

sweep2_2 = Sweep2(
    Rail1=project_16.Geometry,
    Rail2=list_item_34,
    Sections=flatten([scale_nu_4.Geometry, scale_nu_6.Geometry]),
    SameHeight=False)  # disabled
brep_plane_6 = BrepPlane(Brep=sweep2_2, Plane=planar.Plane)  # -> Curves, Points; disabled
surface_split = SurfaceSplit(Surface=sweep2_2, Curves=brep_plane_6.Curves)  # disabled
# Toebox
# (based on top-down profile)
list_item_41 = ListItem(List=surface_split, Index=0, Wrap=True)  # disabled

# ----
# Thickness Gradient Controls
v_count = Slider(21, range=0..100)  # disabled
untrim = Untrim(Surface=list_item_41)  # disabled
divide_surface = DivideSurface(Surface=untrim, UCount=v_count, VCount=v_count)  # -> Points, Normals, Parameters; disabled
instep_thickness = Slider(6, range=0..6)  # disabled
toe_thickness = Slider(-1, range=-1..10)  # disabled
construct_domain_2 = ConstructDomain(DomainStart=instep_thickness, DomainEnd=toe_thickness)  # disabled
range_2 = Range(Domain=construct_domain_2, Steps=v_count)  # disabled
multiplication_8 = Multiplication(A=divide_surface.Normals, B=range_2)  # disabled
move_11 = Move(Geometry=divide_surface.Points, Motion=multiplication_8)  # -> Geometry, Transform; disabled
surface_from_points = SurfaceFromPoints(Points=flatten(move_11.Geometry), UCount=expr("x + 1", v_count), Interpolate=False)  # disabled

brep_plane_7 = BrepPlane(Brep=surface_from_points, Plane=planar.Plane)  # -> Curves, Points; disabled
surface_split_2 = SurfaceSplit(Surface=surface_from_points, Curves=brep_plane_7.Curves)  # disabled
list_item_42 = ListItem(List=surface_split_2, Index=0, Wrap=True)  # disabled
deconstruct_brep_2 = DeconstructBrep(Brep=list_item_41)  # -> Faces, Edges, Vertices; disabled
deconstruct_brep_3 = DeconstructBrep(Brep=list_item_42)  # -> Faces, Edges, Vertices; disabled
ruled_surface_2 = RuledSurface(CurveA=deconstruct_brep_2.Edges, CurveB=deconstruct_brep_3.Edges)  # disabled
# BOUNDING VOLUME SHAPE
cap_holes_6 = CapHoles(Brep=list_item_41)  # disabled
brep_join_2 = BrepJoin(Breps=flatten([ruled_surface_2, list_item_42, list_item_41]))  # -> Breps, Closed; disabled
is_polysurface_closed = IsPolysurfaceClosed(Polysurface=brep_join_2.Breps)  # disabled
cull_pattern_6 = CullPattern(List=brep_join_2.Breps, CullPattern=is_polysurface_closed)  # disabled
offset_surface_5 = OffsetSurface(Surface=list_item_41, Distance=number_slider_2, BothSides=False, CreateSolid=True)  # disabled
solid_intersection_3 = SolidIntersection(BrepsA=extrude_9, BrepsB=cap_holes_6)  # disabled
solid_union_4 = SolidUnion(Breps=flatten([offset_surface_5, solid_intersection_3]))  # disabled
solid_union_5 = SolidUnion(Breps=flatten([solid_intersection_3, cull_pattern_6]))  # disabled
# Solid
solid_difference = SolidDifference(BrepsA=cap_holes_6, BrepsB=mesh_to_polysurface_2)  # disabled
# Gradient Thickness Shell
solid_difference_2 = SolidDifference(BrepsA=solid_union_5, BrepsB=mesh_to_polysurface_2)  # disabled
# Constant Thickness Shell
solid_difference_3 = SolidDifference(BrepsA=solid_union_4, BrepsB=mesh_to_polysurface_2)  # disabled
# NOTE
# Ellipse profile is close but not perfect
# Profiles need to be distorted to square off bottom edge
area = Area(Geometry=perp_frame)  # -> Area, graft(Centroid)
ellipse = Ellipse(Plane=perp_frame, Radius1=multiplication_6, Radius2=multiplication_7)  # -> Ellipse, Focus1, Focus2
divide_curve_8 = DivideCurve(Curve=ellipse.Ellipse, Count=2, Kinks=False)  # -> Points, Tangents, Parameters
list_item_43 = ListItem(List=divide_curve_8.Points, Index=0, Wrap=True)
# BOOLEAN
# TOE CAP
# Vertical Trim
# Curvature Control
# Fillet Outer Edge
# of Toebox
move_to_point_8 = MoveToPoint(Geometry=graft(ellipse.Ellipse), PointA=list_item_43, PointB=area.Centroid)  # -> Moved, Vector, Transform
