# Grasshopper definition 030421 component.gh (Grasshopper 1.0.7)
# plug-ins: Pufferfish

# ----
# SCAN IN ->
mesh = Mesh(<mesh referenced from the Rhino model>)

# ----
# IMPORT MESH
deconstruct_mesh = DeconstructMesh(Mesh=mesh)  # -> Vertices, Faces, Colours, Normals
point_list = PointList(Points=deconstruct_mesh.Vertices)
panel = Panel("""8594
12722
10481
658
7004
869
12059
12003
9808
6220
6174
6112
6107
6063
3659
3664""")
panel_2 = Panel("""9454
9436
9414
9356
7506
718
414
1608
4584
6441
12371
5190
7972
8186
4854
2081
1977
8007
2325""")
panel_3 = Panel("""8646
11329
12329
9761
293
2121
7651
324
6350
7262""")
image_sampler = ImageSampler(
    FilePath="C:\Users\Luke Hillery\Documents\DE4\SOLO\Component CAD\foot top view.jpg",
    Filter="Colour",
    Interpolate=False,
    Umax=1,
    Umin=0,
    Vmax=1,
    Vmin=0,
    Wrap=1)

# ----
# Back of Heel
list_item = ListItem(List=deconstruct_mesh.Vertices, Index=2027, Wrap=True)

# ----
# Tip of Big Toe
list_item_2 = ListItem(List=deconstruct_mesh.Vertices, Index=2420, Wrap=True)

unit_z = UnitZ(Factor=-1)
xy_plane = XYPlane(Origin=Point(0, 0, 0))
unit_z_2 = UnitZ(Factor=-1)
xy_plane_2 = XYPlane(Origin=Point(0, 0, 0))
# FOOT LENGTH
project_point = ProjectPoint(Point=list_item_2, Direction=unit_z, Geometry=xy_plane)  # -> Point, Index
project_point_2 = ProjectPoint(Point=list_item, Direction=unit_z_2, Geometry=xy_plane_2)  # -> Point, Index

# ----
# Foot Length
distance = Distance(PointA=project_point.Point, PointB=project_point_2.Point)

multiplication = Multiplication(A=distance, B=0.8)
round = Round(Number=multiplication)  # -> Nearest, Floor, Ceiling
series = Series(Start=0, Step=1, Count=5)
addition = Addition(A=series, B=1)
construct_domain = ConstructDomain(DomainStart=Slider(2, range=0..10), DomainEnd=Slider(10, range=0..12))
xz_plane = XZPlane(Origin=Point(0, 5, 0))
rectangle = Rectangle(Plane=xz_plane, XSize=Domain(-50, 50), YSize=Domain(-50, 50), Radius=0)  # -> Rectangle, Length

# ----
# CHRONOLOGICAL ORDER -->
# Foot Length (mm)
number_slider = Slider(150, range=50..300)

boundary_surfaces = BoundarySurfaces(Edges=rectangle.Rectangle)
unit_y = UnitY(Factor=-10)
extrude = Extrude(Base=boundary_surfaces, Direction=unit_y)
construct_point = ConstructPoint(XCoordinate=0, YCoordinate=0, ZCoordinate=0)
move_to_point = MoveToPoint(Geometry=mesh, PointA=list_item_2, PointB=construct_point)  # -> Moved, Vector, Transform
deconstruct_mesh_2 = DeconstructMesh(Mesh=move_to_point.Moved)  # -> Vertices, Faces, Colours, Normals
# Tip of 2nd Toe
list_item_3 = ListItem(List=deconstruct_mesh_2.Vertices, Index=9089, Wrap=True)
# Tip of Big Toe
list_item_4 = ListItem(List=deconstruct_mesh_2.Vertices, Index=2420, Wrap=True)

# ----
# Outside Instep
list_item_5 = ListItem(List=deconstruct_mesh_2.Vertices, Index=panel, Wrap=True)

# ----
# Instep Profile
list_item_6 = ListItem(List=deconstruct_mesh_2.Vertices, Index=panel_2, Wrap=True)

# ----
# Inside Instep
list_item_7 = ListItem(List=deconstruct_mesh_2.Vertices, Index=panel_3, Wrap=True)

line = Line(StartPoint=list_item_4, EndPoint=list_item_3)
curve_middle = CurveMiddle(Curve=line)
interpolate = Interpolate(Vertices=list_item_5, Degree=1, Periodic=False, KnotStyle=1)  # -> Curve, Length, Domain
interpolate_2 = Interpolate(Vertices=list_item_6, Degree=1, Periodic=False, KnotStyle=1)  # -> Curve, Length, Domain
interpolate_3 = Interpolate(Vertices=list_item_7, Degree=1, Periodic=False, KnotStyle=1)  # -> Curve, Length, Domain
project = Project(Geometry=interpolate_2.Curve, Plane=PlaneYZ(0, 0, 0))  # -> Geometry, Transform
project_2 = Project(Geometry=interpolate.Curve, Plane=PlaneXY(0, 0, 0))  # -> Geometry, Transform
project_3 = Project(Geometry=interpolate_3.Curve, Plane=PlaneXY(0, 0, 0))  # -> Geometry, Transform
rebuild_curve = RebuildCurve(Curve=project_2.Geometry, Count=4, Degree=3, EndTangents=False)
rebuild_curve_2 = RebuildCurve(Curve=project_3.Geometry, Count=3, Degree=2, EndTangents=False)
rebuild_curve_3 = RebuildCurve(Curve=project.Geometry, Count=8, Degree=5, EndTangents=False)
unit_y_2 = UnitY(Factor=round.Nearest)
move = Move(Geometry=construct_point, Motion=unit_y_2)  # -> Geometry, Transform
yz_plane = YZPlane(Origin=Point(0, 0, 0))
mesh_to_polysurface = MeshToPolysurface(Mesh=move_to_point.Moved, Triangles=False, FaceMerge=False)
point = Point(curve_middle)
project_4 = Project(Geometry=point, Plane=yz_plane)  # -> Geometry, Transform
distance_2 = Distance(PointA=point, PointB=project_4.Geometry)

# ----
# Curvature
# Interpolation
# Degree
# NOTE
# Only works at 15 and 20...
control_knob = ControlKnob(Decimals=0, Limit=True, Maximum=20, Minimum=10, Range=20, Value=15)

negative = Negative(Value=distance_2)
unit_x = UnitX(Factor=negative)
# TOEBOX SHAPE
move_2 = Move(Geometry=move.Geometry, Motion=unit_x)  # -> Geometry, Transform
line_2 = Line(StartPoint=point, EndPoint=move_2.Geometry)
divide_curve = DivideCurve(Curve=line_2, Count=control_knob, Kinks=False)  # -> Points, Tangents, Parameters

# ----
# Toebox
# Curvature Control
graph_mapper = GraphMapper(
    divide_curve.Parameters,
    x0=0,
    x1=1,
    y0=0,
    y1=1,
    container_name="Bezier",
    cpx=[0, 0.630081296, 0.9479647875, 1],
    cpy=[0, 0, 0.05223429203, 0.7957516909])
# NOTE
# Curvature should be taken from
# raw 3D scan, either using photo with
# edge detection or with cross-section
# curves through mesh from 3D scan
number_slider_2 = Slider(50, range=30..60)

multiplication_2 = Multiplication(A=graph_mapper, B=number_slider_2)
negative_2 = Negative(Value=multiplication_2)
unit_z_3 = UnitZ(Factor=negative_2)
# BOUNDING VOLUME SHAPE
move_3 = Move(Geometry=divide_curve.Points, Motion=unit_z_3)  # -> Geometry, Transform

# ----
# Width and Height
# Curvature Control
graph_mapper_2 = GraphMapper(
    divide_curve.Parameters,
    x0=0,
    x1=1,
    y0=0,
    y1=1,
    container_name="Bezier",
    cpx=[0, 0.1070338339, 0.4497973323, 1],
    cpy=[0.489772439, 1, 1, 0.3865298629])
graph_mapper_3 = GraphMapper(
    divide_curve.Parameters,
    x0=0,
    x1=1,
    y0=0,
    y1=1,
    container_name="Bezier",
    cpx=[0, 0.331707716, 0.7379239798, 1],
    cpy=[0.2553995252, 0.8880677819, 0.006016790867, 1])
# NOTE
# Curvature should be taken from
# raw 3D scan, either using photo with
# edge detection or with cross-section
# curves through mesh from 3D scan
number_slider_3 = Slider(60, range=30..60)
multiplication_3 = Multiplication(A=graph_mapper_2, B=Slider(17, range=10..60))
multiplication_4 = Multiplication(A=graph_mapper_3, B=number_slider_3)

interpolate_4 = Interpolate(Vertices=move_3.Geometry, Degree=3, Periodic=False, KnotStyle=1)  # -> Curve, Length, Domain
perp_frame = PerpFrame(Curve=interpolate_4.Curve, Parameter=move_3.Geometry)
curve_plane = CurvePlane(Curve=rebuild_curve, Plane=perp_frame)  # -> graft(Points), ParamsC, ParamsP
curve_plane_2 = CurvePlane(Curve=rebuild_curve_3, Plane=perp_frame)  # -> flatten(Points), ParamsC, ParamsP
curve_plane_3 = CurvePlane(Curve=rebuild_curve_2, Plane=perp_frame)  # -> graft(Points), ParamsC, ParamsP
cull_index = CullIndex(List=curve_plane_2.Points, Indices=0, Wrap=True)
deconstruct = Deconstruct(Point=perp_frame)  # -> XComponent, YComponent, ZComponent
list_item_8 = ListItem(List=flatten(curve_plane_3.Points), Index=series, Wrap=True)
list_item_9 = ListItem(List=flatten(curve_plane.Points), Index=series, Wrap=True)
sort_list = SortList(Keys=deconstruct.YComponent, ValuesValuesA=perp_frame)  # -> Keys, flatten(ValuesValuesA)
interpolate_5 = Interpolate(Vertices=cull_index, Degree=3, Periodic=False, KnotStyle=1)  # -> Curve, Length, Domain
interpolate_6 = Interpolate(Vertices=list_item_9, Degree=3, Periodic=False, KnotStyle=1)  # -> Curve, Length, Domain
interpolate_7 = Interpolate(Vertices=list_item_8, Degree=3, Periodic=False, KnotStyle=1)  # -> Curve, Length, Domain
list_item_10 = ListItem(List=sort_list.ValuesValuesA, Index=addition, Wrap=True)
arc_3pt = Arc3Pt(PointA=list_item_8, PointB=cull_index, PointC=list_item_9)  # -> Arc, Plane, Radius
list_item_11 = ListItem(List=list_item_10, Index=-1, Wrap=True)
close_curve = CloseCurve(Curve=arc_3pt.Arc, CloseType=2, Bulge=0.3, Tolerance=0)  # -> Closed, ResultBoolean
list_length = ListLength(List=close_curve.Closed)
subtraction = Subtraction(A=list_length, B=1)
curve_plane_4 = CurvePlane(Curve=rebuild_curve_2, Plane=list_item_11)  # -> Points, ParamsC, ParamsP
range = Range(Domain=construct_domain, Steps=subtraction)  # -> flatten(Range)
integer = Integer(range)
rebuild_curve_4 = RebuildCurve(Curve=close_curve.Closed, Count=6, Degree=integer, EndTangents=False)  # -> graft(Rebuilt)
offset_curve = OffsetCurve(Curve=rebuild_curve_4, Distance=5, Plane=PlaneXZ(0, 0, 0), Corners=1)
list_item_12 = ListItem(List=flatten(offset_curve), Index=0, Wrap=True)
list_item_13 = ListItem(List=flatten(offset_curve), Index=-1, Wrap=True)
project_5 = Project(Geometry=list_item_12, Plane=PlaneXZ(0, 0, 0))  # -> Geometry, Transform
planar = Planar(Curve=list_item_13)  # -> Planar, Plane, Deviation
curve_plane_5 = CurvePlane(Curve=project_5.Geometry, Plane=PlaneXY(0, 0, 0))  # -> Points, ParamsC, ParamsP
deconstruct_2 = Deconstruct(Point=curve_plane_5.Points)  # -> XComponent, YComponent, ZComponent
larger_than = LargerThan(FirstNumber=deconstruct_2.XComponent, SecondNumber=0)  # -> LargerThan, OrEqualTo
reverse_list = ReverseList(List=larger_than.LargerThan)
cull_pattern = CullPattern(List=curve_plane_5.Points, CullPattern=larger_than.LargerThan)
cull_pattern_2 = CullPattern(List=curve_plane_5.Points, CullPattern=reverse_list)

project_6 = Project(Geometry=interpolate_7.Curve, Plane=PlaneYZ(0, 0, 0))  # -> Geometry, Transform
explode = Explode(Curve=interpolate_7.Curve, Recursive=True)  # -> Segments, Vertices
explode_2 = Explode(Curve=project_6.Geometry, Recursive=True)  # -> Segments, Vertices
length = Length(Curve=project_6.Geometry)
list_item_14 = ListItem(List=explode.Vertices, Index=0, Wrap=True)
move_to_point_2 = MoveToPoint(Geometry=interpolate_7.Curve, PointA=list_item_14, PointB=cull_pattern)  # -> Moved, Vector, Transform
list_item_15 = ListItem(List=explode_2.Vertices, Index=1, Wrap=True)
distance_3 = Distance(PointA=Point(0, 0, 0), PointB=list_item_15)
division = Division(A=distance_3, B=length)
scale_nu = ScaleNU(Geometry=move_to_point_2.Moved, Plane=PlaneXY(0, 0, 0), ScaleX=1, ScaleY=division, ScaleZ=1)  # -> Geometry, Transform

yz_plane_2 = YZPlane(Origin=Point(0, 0, 0))
project_7 = Project(Geometry=interpolate_6.Curve, Plane=yz_plane_2)  # -> Geometry, Transform
explode_3 = Explode(Curve=rebuild_curve, Recursive=True)  # -> Segments, Vertices
explode_4 = Explode(Curve=project_7.Geometry, Recursive=True)  # -> Segments, Vertices
length_2 = Length(Curve=project_7.Geometry)
construct_point_2 = ConstructPoint(XCoordinate=0, YCoordinate=0, ZCoordinate=0)
list_item_16 = ListItem(List=explode_3.Vertices, Index=0, Wrap=True)
list_item_17 = ListItem(List=explode_4.Vertices, Index=1, Wrap=True)
move_to_point_3 = MoveToPoint(Geometry=rebuild_curve, PointA=list_item_16, PointB=cull_pattern_2)  # -> Moved, Vector, Transform
distance_4 = Distance(PointA=construct_point_2, PointB=list_item_17)
division_2 = Division(A=distance_4, B=length_2)
scale_nu_2 = ScaleNU(Geometry=move_to_point_3.Moved, Plane=PlaneXY(0, 0, 0), ScaleX=1, ScaleY=division_2, ScaleZ=1)  # -> Geometry, Transform

sweep2 = Sweep2(Rail1=project_5.Geometry, Rail2=list_item_13, Sections=flatten(scale_nu.Geometry), SameHeight=False)
brep_plane = BrepPlane(Brep=sweep2, Plane=planar.Plane)  # -> Curves, Points
surface_split = SurfaceSplit(Surface=sweep2, Curves=brep_plane.Curves)
# Toebox
# (based on top-down profile)
list_item_18 = ListItem(List=surface_split, Index=0, Wrap=True)

# ----
# Thickness Gradient Controls
v_count = Slider(21, range=0..100)
untrim = Untrim(Surface=list_item_18)
divide_surface = DivideSurface(Surface=untrim, UCount=v_count, VCount=v_count)  # -> Points, Normals, Parameters
instep_thickness = Slider(6, range=0..6)
toe_thickness = Slider(-1, range=-1..10)
construct_domain_2 = ConstructDomain(DomainStart=instep_thickness, DomainEnd=toe_thickness)
range_2 = Range(Domain=construct_domain_2, Steps=v_count)
multiplication_5 = Multiplication(A=divide_surface.Normals, B=range_2)
move_4 = Move(Geometry=divide_surface.Points, Motion=multiplication_5)  # -> Geometry, Transform
surface_from_points = SurfaceFromPoints(Points=flatten(move_4.Geometry), UCount=expr("x + 1", v_count), Interpolate=False)

brep_plane_2 = BrepPlane(Brep=surface_from_points, Plane=planar.Plane)  # -> Curves, Points
surface_split_2 = SurfaceSplit(Surface=surface_from_points, Curves=brep_plane_2.Curves)
list_item_19 = ListItem(List=surface_split_2, Index=0, Wrap=True)
deconstruct_brep = DeconstructBrep(Brep=list_item_18)  # -> Faces, Edges, Vertices
deconstruct_brep_2 = DeconstructBrep(Brep=list_item_19)  # -> Faces, Edges, Vertices
ruled_surface = RuledSurface(CurveA=deconstruct_brep.Edges, CurveB=deconstruct_brep_2.Edges)
cap_holes = CapHoles(Brep=list_item_18)
brep_join = BrepJoin(Breps=flatten([ruled_surface, list_item_19, list_item_18]))  # -> Breps, Closed
is_polysurface_closed = IsPolysurfaceClosed(Polysurface=brep_join.Breps)
cull_pattern_3 = CullPattern(List=brep_join.Breps, CullPattern=is_polysurface_closed)
offset_surface = OffsetSurface(Surface=list_item_18, Distance=Slider(3, range=0..10), BothSides=False, CreateSolid=True)
solid_intersection = SolidIntersection(BrepsA=extrude, BrepsB=cap_holes)
solid_union = SolidUnion(Breps=flatten([offset_surface, solid_intersection]))
solid_union_2 = SolidUnion(Breps=flatten([solid_intersection, cull_pattern_3]))
# Solid
solid_difference = SolidDifference(BrepsA=cap_holes, BrepsB=mesh_to_polysurface)  # disabled
# Gradient Thickness Shell
solid_difference_2 = SolidDifference(BrepsA=solid_union_2, BrepsB=mesh_to_polysurface)  # disabled
# Constant Thickness Shell
solid_difference_3 = SolidDifference(BrepsA=solid_union, BrepsB=mesh_to_polysurface)  # disabled
# NOTE
# Ellipse profile is close but not perfect
# Profiles need to be distorted to square off bottom edge
area = Area(Geometry=perp_frame)  # -> Area, graft(Centroid)
ellipse = Ellipse(Plane=perp_frame, Radius1=multiplication_3, Radius2=multiplication_4)  # -> Ellipse, Focus1, Focus2
divide_curve_2 = DivideCurve(Curve=ellipse.Ellipse, Count=2, Kinks=False)  # -> Points, Tangents, Parameters
list_item_20 = ListItem(List=divide_curve_2.Points, Index=0, Wrap=True)
move_to_point_4 = MoveToPoint(Geometry=graft(ellipse.Ellipse), PointA=list_item_20, PointB=area.Centroid)  # -> Moved, Vector, Transform
loft = Loft(
    Curves=flatten(move_to_point_4.Moved),
    Options={Adjust=False, Closed=False, LoftEnds=0, LoftSimp=0, LoftType=0, Rebuild=10, Refit=0.01})  # disabled

# ----
# Cull the first 40mm
length_3 = Length(Curve=line_2)
division_3 = Division(A=length_3, B=control_knob)
division_4 = Division(A=40, B=division_3)
series_2 = Series(Start=0, Step=1, Count=division_4)
cull_index_2 = CullIndex(List=divide_curve.Points, Indices=series_2, Wrap=True)

interpolate_8 = Interpolate(Vertices=cull_index_2, Degree=3, Periodic=False, KnotStyle=1)  # -> Curve, Length, Domain
list_length_2 = ListLength(List=cull_index_2)
divide_curve_3 = DivideCurve(Curve=interpolate_8.Curve, Count=list_length_2, Kinks=False)  # -> Points, Tangents, Parameters
sort_list_2 = SortList(Keys=divide_curve_3.Parameters)  # -> Keys, ValuesValuesA
reverse_list_2 = ReverseList(List=sort_list_2.Keys)
cull_index_3 = CullIndex(List=divide_curve_3.Points, Indices=0, Wrap=True)
list_item_21 = ListItem(List=reverse_list_2, Index=0, Wrap=True)
# HORIZONTAL SPLITLINE
division_5 = Division(A=divide_curve_3.Parameters, B=list_item_21)
cull_index_4 = CullIndex(List=division_5, Indices=0, Wrap=True)

# ----
# Split Line
# Curvature Control
number_slider_4 = Slider(34, range=30..60)
graph_mapper_4 = GraphMapper(division_5, x0=0, x1=1, y0=-1, y1=1, container_name="Bezier", cpx=[0, 0.09408602118, 1, 1], cpy=[1, 0, 0.441611886, 0])

multiplication_6 = Multiplication(A=graph_mapper_4, B=number_slider_4)
unit_z_4 = UnitZ(Factor=multiplication_6)
move_5 = Move(Geometry=divide_curve_3.Points, Motion=unit_z_4)  # -> Geometry, Transform
list_length_3 = ListLength(List=series_2)
subtraction_2 = Subtraction(A=list_length_3, B=1)
cull_index_5 = CullIndex(List=series_2, Indices=subtraction_2, Wrap=True)
list_item_22 = ListItem(List=move_5.Geometry, Index=cull_index_5, Wrap=True)
list_length_4 = ListLength(List=series_2)
list_length_5 = ListLength(List=list_item_22)
addition_2 = Addition(A=list_length_5, B=list_length_4)
series_3 = Series(Start=0, Step=1, Count=addition_2)
cull_index_6 = CullIndex(List=move_3.Geometry, Indices=series_3, Wrap=True)
insert_items = InsertItems(List=cull_index_6, Item=list_item_22, Indices=0, Wrap=True)
panel_4 = Panel("""80
-80""")
interpolate_9 = Interpolate(Vertices=insert_items, Degree=3, Periodic=False, KnotStyle=1)  # -> Curve, Length, Domain
unit_x_2 = UnitX(Factor=panel_4)
extrude_2 = Extrude(Base=interpolate_9.Curve, Direction=unit_x_2)
control_knob_2 = ControlKnob(Decimals=1, Limit=True, Maximum=10, Minimum=0, Range=1, Value=5)
brep_join_2 = BrepJoin(Breps=extrude_2)  # -> Breps, Closed
unit_z_5 = UnitZ(Factor=control_knob_2)
move_6 = Move(Geometry=brep_join_2.Breps, Motion=unit_z_5)  # -> Geometry, Transform
split_brep = SplitBrep(Brep=loft, Cutter=move_6.Geometry)
# VERTICAL TRIM
list_item_23 = ListItem(List=split_brep, Index=1, Wrap=True)

# ----
# Vertical Trim
# Curvature Control
graph_mapper_5 = GraphMapper(cull_index_4, x0=0, x1=1, y0=0, y1=2, container_name="Bezier", cpx=[0, 0, 1, 1], cpy=[0.8611767292, 0, 0.3125, 0])

multiplication_7 = Multiplication(A=graph_mapper_5, B=Slider(34, range=30..60))
negative_3 = Negative(Value=multiplication_7)
unit_x_3 = UnitX(Factor=negative_3)
move_7 = Move(Geometry=cull_index_3, Motion=unit_x_3)  # -> Geometry, Transform
cull_last_item = CullLastItem(list=move_7.Geometry)
mirror = Mirror(Geometry=cull_last_item, Plane=PlaneYZ(0, 0, 0))  # -> Geometry, Transform
reverse_list_3 = ReverseList(List=mirror.Geometry)
interpolate_10 = Interpolate(Vertices=[cull_last_item, reverse_list_3], Degree=3, Periodic=False, KnotStyle=1)  # -> Curve, Length, Domain
panel_5 = Panel("""-40
40""")
unit_z_6 = UnitZ(Factor=panel_5)
extrude_3 = Extrude(Base=interpolate_10.Curve, Direction=unit_z_6)
brep_join_3 = BrepJoin(Breps=extrude_3)  # -> Breps, Closed
split_brep_2 = SplitBrep(Brep=list_item_23, Cutter=brep_join_3.Breps)
panel_6 = Panel("*Trimmed*")  # disabled
match_text = MatchText(Text=split_brep_2, Pattern=panel_6, Case=True)  # disabled
cull_pattern_4 = CullPattern(List=split_brep_2, CullPattern=match_text)  # disabled
offset_surface_2 = OffsetSurface(Surface=cull_pattern_4, Distance=1, BothSides=False, CreateSolid=True)  # disabled
xz_plane_2 = XZPlane(Origin=Point(0, 0, 0))  # disabled
plane_offset = PlaneOffset(BasePlane=xz_plane_2, Offset=-4)  # disabled
# TOE CAP
list_item_24 = ListItem(List=flatten(move_to_point_4.Moved), Index=0, Wrap=True)  # disabled
brep_plane_3 = BrepPlane(Brep=cull_pattern_4, Plane=plane_offset)  # -> Curves, Points; disabled
curve = Curve(simplify(flatten(brep_plane_3.Curves)))  # disabled
curve_2 = Curve(list_item_24)  # disabled
loft_2 = Loft(
    Curves=[list_item_24, curve],
    Options={Adjust=False, Closed=False, LoftEnds=0, LoftSimp=0, LoftType=0, Rebuild=10, Refit=0.01})  # disabled
cap_holes_2 = CapHoles(Brep=loft_2)  # disabled
# BOOLEAN
solid_union_3 = SolidUnion(Breps=flatten([cap_holes_2, offset_surface_2]))  # disabled
deconstruct_brep_3 = DeconstructBrep(Brep=solid_union_3)  # -> Faces, Edges, Vertices; disabled
panel_7 = Panel("*Elliptical*")  # disabled
panel_8 = Panel("*Elliptical*")  # disabled
panel_10 = Panel(deconstruct_brep_3.Edges)  # disabled
match_text_2 = MatchText(Text=deconstruct_brep_3.Edges, Pattern=panel_7, Case=True)  # disabled
list_indices = ListIndices(List=deconstruct_brep_3.Edges)  # disabled
cull_pattern_5 = CullPattern(List=list_indices, CullPattern=match_text_2)  # disabled
# Fillet Outer Edge
# of Toebox
fillet_edge = FilletEdge(Shape=solid_union_3, Blend=0, Metric=0, Edges=cull_pattern_5, Radii=4)  # disabled
# TOEBOX FILLET
panel_11 = Panel("*Planar*")  # disabled
match_text_3 = MatchText(Text=deconstruct_brep_3.Edges, Pattern=panel_11, Case=True)  # disabled
list_indices_2 = ListIndices(List=deconstruct_brep_3.Edges)  # disabled
cull_pattern_6 = CullPattern(List=list_indices_2, CullPattern=match_text_3)  # disabled
cull_pattern_7 = CullPattern(List=deconstruct_brep_3.Edges, CullPattern=match_text_3)  # disabled
length_4 = Length(Curve=cull_pattern_7)  # disabled
sort_list_3 = SortList(Keys=length_4, ValuesValuesA=cull_pattern_6)  # -> Keys, ValuesValuesA; disabled
sort_list_4 = SortList(Keys=length_4, ValuesValuesA=cull_pattern_7)  # -> Keys, ValuesValuesA; disabled
panel_12 = Panel("""0
1
2""")  # disabled
list_item_25 = ListItem(List=sort_list_4.ValuesValuesA, Index=panel_12, Wrap=True)  # disabled
list_item_26 = ListItem(List=sort_list_3.ValuesValuesA, Index=panel_12, Wrap=True)  # disabled
fillet_edge_2 = FilletEdge(Shape=fillet_edge, Blend=0, Metric=0, Edges=list_item_26, Radii=2)  # disabled
create_material = CreateMaterial(Diffuse=RGB(255, 148, 180), Specular=RGB(255, 255, 255), Emission=RGB(0, 0, 0), Transparency=0, Shine=0)  # disabled
custom_preview = CustomPreview(Geometry=fillet_edge_2, Material=create_material)  # disabled

# ==== cluster CullLastItem
list = ClusterInput()
list_length = ListLength(List=list)
subtraction = Subtraction(A=list_length, B=1)
cull_index = CullIndex(List=list, Indices=subtraction, Wrap=True)
list_2 = ClusterOutput(cull_index)
