# Grasshopper definition 050321 component.gh (Grasshopper 1.0.7)
# plug-ins: Pufferfish

# ----
# Foot Length (mm)
number_slider = Slider(150, range=50..300)

mesh = Mesh(<mesh referenced from the Rhino model>)
# IMPORT MESH
deconstruct_mesh = DeconstructMesh(Mesh=mesh)  # -> Vertices, Faces, Colours, Normals
# CHRONOLOGICAL ORDER -->
construct_point = ConstructPoint(XCoordinate=0, YCoordinate=0, ZCoordinate=0)
point_list = PointList(Points=deconstruct_mesh.Vertices)
panel = Panel(deconstruct_mesh.Vertices)
unit_y = UnitY(Factor=number_slider)
move = Move(Geometry=construct_point, Motion=unit_y)  # -> Geometry, Transform
line = Line(StartPoint=construct_point, EndPoint=move.Geometry)
panel_2 = Panel("""9454
9436
9414
9356
7506
718
414
1608
4584
6441
12371
5190
7972
8186
4854
2081
1977
8007
2325""")
panel_3 = Panel("""8646
11329
12329
9761
293
2121
7651
324
6350
7262""")
panel_4 = Panel("""8594
12722
10481
658
7004
869
12059
12003
9808
6220
6174
6112
6107
6063
3659
3664""")

# ----
# Curvature
# Interpolation
# Degree
# NOTE
# Only works at 15 and 20...
control_knob = ControlKnob(Decimals=0, Limit=True, Maximum=20, Minimum=10, Range=20, Value=15)

image_sampler = ImageSampler(
    FilePath="C:\Users\Luke Hillery\Documents\DE4\SOLO\Component CAD\foot top view.jpg",
    Filter="Colour",
    Interpolate=False,
    Umax=1,
    Umin=0,
    Vmax=1,
    Vmin=0,
    Wrap=1)
# TOEBOX SHAPE
divide_curve = DivideCurve(Curve=line, Count=control_knob, Kinks=False)  # -> Points, Tangents, Parameters

# ----
# Back of Heel
list_item = ListItem(List=deconstruct_mesh.Vertices, Index=2027, Wrap=True)

# ----
# Instep Profile
list_item_2 = ListItem(List=deconstruct_mesh.Vertices, Index=panel_2, Wrap=True)

# ----
# Inside Instep
list_item_3 = ListItem(List=deconstruct_mesh.Vertices, Index=panel_3, Wrap=True)

# ----
# Outside Instep
list_item_4 = ListItem(List=deconstruct_mesh.Vertices, Index=panel_4, Wrap=True)

# ----
# Tip of Big Toe
list_item_5 = ListItem(List=deconstruct_mesh.Vertices, Index=2420, Wrap=True)

# ----
# Toebox
# Curvature Control
graph_mapper = GraphMapper(
    divide_curve.Parameters,
    x0=0,
    x1=1,
    y0=0,
    y1=1,
    container_name="Bezier",
    cpx=[0, 0.6174137592, 0.9479647875, 1],
    cpy=[0, 0, 0.05223429203, 0.7957516909])
# NOTE
# Curvature should be taken from
# raw 3D scan, either using photo with
# edge detection or with cross-section
# curves through mesh from 3D scan
number_slider_2 = Slider(50, range=30..60)

interpolate = Interpolate(Vertices=list_item_2, Degree=1, Periodic=False, KnotStyle=1)  # -> Curve, Length, Domain
interpolate_2 = Interpolate(Vertices=list_item_3, Degree=1, Periodic=False, KnotStyle=1)  # -> Curve, Length, Domain
interpolate_3 = Interpolate(Vertices=list_item_4, Degree=1, Periodic=False, KnotStyle=1)  # -> Curve, Length, Domain
xy_plane = XYPlane(Origin=Point(0, 0, 0))
xy_plane_2 = XYPlane(Origin=Point(0, 0, 0))
xy_plane_3 = XYPlane(Origin=Point(0, 0, 0))
multiplication = Multiplication(A=graph_mapper, B=number_slider_2)
unit_z = UnitZ(Factor=-1)
unit_z_2 = UnitZ(Factor=-1)
project = Project(Geometry=interpolate.Curve, Plane=xy_plane)  # -> Geometry, Transform
project_2 = Project(Geometry=interpolate_3.Curve, Plane=xy_plane_2)  # -> Geometry, Transform
xy_plane_4 = XYPlane(Origin=Point(0, 0, 0))
project_3 = Project(Geometry=interpolate_2.Curve, Plane=xy_plane_3)  # -> Geometry, Transform
xy_plane_5 = XYPlane(Origin=Point(0, 0, 0))
negative = Negative(Value=multiplication)
project_point = ProjectPoint(Point=list_item, Direction=unit_z, Geometry=xy_plane_4)  # -> Point, Index
# FOOT LENGTH
project_point_2 = ProjectPoint(Point=list_item_5, Direction=unit_z_2, Geometry=xy_plane_5)  # -> Point, Index
unit_z_3 = UnitZ(Factor=negative)
# BOUNDING VOLUME SHAPE
move_2 = Move(Geometry=divide_curve.Points, Motion=unit_z_3)  # -> Geometry, Transform

# ----
# Foot Length
distance = Distance(PointA=project_point_2.Point, PointB=project_point.Point)

# ----
# Width and Height
# Curvature Control
graph_mapper_2 = GraphMapper(
    divide_curve.Parameters,
    x0=0,
    x1=1,
    y0=0,
    y1=1,
    container_name="Bezier",
    cpx=[0, 0.1070338339, 0.4497973323, 1],
    cpy=[0.489772439, 1, 1, 0.3865298629])
graph_mapper_3 = GraphMapper(
    divide_curve.Parameters,
    x0=0,
    x1=1,
    y0=0,
    y1=1,
    container_name="Bezier",
    cpx=[0, 0.331707716, 0.7379239798, 1],
    cpy=[0.2553995252, 0.8880677819, 0.006016790867, 1])
# NOTE
# Curvature should be taken from
# raw 3D scan, either using photo with
# edge detection or with cross-section
# curves through mesh from 3D scan
number_slider_3 = Slider(60, range=30..60)
multiplication_2 = Multiplication(A=graph_mapper_2, B=Slider(17, range=10..60))
multiplication_3 = Multiplication(A=graph_mapper_3, B=number_slider_3)

interpolate_4 = Interpolate(Vertices=move_2.Geometry, Degree=3, Periodic=False, KnotStyle=1)  # -> Curve, Length, Domain
perp_frame = PerpFrame(Curve=interpolate_4.Curve, Parameter=move_2.Geometry)
# NOTE
# Ellipse profile is close but not perfect
# Profiles need to be distorted to square off bottom edge
area = Area(Geometry=perp_frame)  # -> Area, graft(Centroid)
ellipse = Ellipse(Plane=perp_frame, Radius1=multiplication_2, Radius2=multiplication_3)  # -> Ellipse, Focus1, Focus2
divide_curve_2 = DivideCurve(Curve=ellipse.Ellipse, Count=2, Kinks=False)  # -> Points, Tangents, Parameters
list_item_6 = ListItem(List=divide_curve_2.Points, Index=0, Wrap=True)
move_to_point = MoveToPoint(Geometry=graft(ellipse.Ellipse), PointA=list_item_6, PointB=area.Centroid)  # -> Moved, Vector, Transform
loft = Loft(
    Curves=flatten(move_to_point.Moved),
    Options={Adjust=False, Closed=False, LoftEnds=0, LoftSimp=0, LoftType=0, Rebuild=10, Refit=0.01})

# ----
# Cull the first 40mm
length = Length(Curve=line)
division = Division(A=length, B=control_knob)
division_2 = Division(A=40, B=division)
series = Series(Start=0, Step=1, Count=division_2)
cull_index = CullIndex(List=divide_curve.Points, Indices=series, Wrap=True)

interpolate_5 = Interpolate(Vertices=cull_index, Degree=3, Periodic=False, KnotStyle=1)  # -> Curve, Length, Domain
list_length = ListLength(List=cull_index)
divide_curve_3 = DivideCurve(Curve=interpolate_5.Curve, Count=list_length, Kinks=False)  # -> Points, Tangents, Parameters
sort_list = SortList(Keys=divide_curve_3.Parameters)  # -> Keys, ValuesValuesA
reverse_list = ReverseList(List=sort_list.Keys)
cull_index_2 = CullIndex(List=divide_curve_3.Points, Indices=0, Wrap=True)
list_item_7 = ListItem(List=reverse_list, Index=0, Wrap=True)
# HORIZONTAL SPLITLINE
division_3 = Division(A=divide_curve_3.Parameters, B=list_item_7)
cull_index_3 = CullIndex(List=division_3, Indices=0, Wrap=True)

# ----
# Split Line
# Curvature Control
number_slider_4 = Slider(34, range=30..60)
graph_mapper_4 = GraphMapper(division_3, x0=0, x1=1, y0=-1, y1=1, container_name="Bezier", cpx=[0, 0.09408602118, 1, 1], cpy=[1, 0, 0.441611886, 0])

multiplication_4 = Multiplication(A=graph_mapper_4, B=number_slider_4)
unit_z_4 = UnitZ(Factor=multiplication_4)
move_3 = Move(Geometry=divide_curve_3.Points, Motion=unit_z_4)  # -> Geometry, Transform
list_length_2 = ListLength(List=series)
subtraction = Subtraction(A=list_length_2, B=1)
cull_index_4 = CullIndex(List=series, Indices=subtraction, Wrap=True)
list_item_8 = ListItem(List=move_3.Geometry, Index=cull_index_4, Wrap=True)
list_length_3 = ListLength(List=series)
list_length_4 = ListLength(List=list_item_8)
addition = Addition(A=list_length_4, B=list_length_3)
series_2 = Series(Start=0, Step=1, Count=addition)
cull_index_5 = CullIndex(List=move_2.Geometry, Indices=series_2, Wrap=True)
insert_items = InsertItems(List=cull_index_5, Item=list_item_8, Indices=0, Wrap=True)
panel_5 = Panel("""80
-80""")
interpolate_6 = Interpolate(Vertices=insert_items, Degree=3, Periodic=False, KnotStyle=1)  # -> Curve, Length, Domain
unit_x = UnitX(Factor=panel_5)
extrude = Extrude(Base=interpolate_6.Curve, Direction=unit_x)
control_knob_2 = ControlKnob(Decimals=1, Limit=True, Maximum=10, Minimum=0, Range=1, Value=5)
brep_join = BrepJoin(Breps=extrude)  # -> Breps, Closed
unit_z_5 = UnitZ(Factor=control_knob_2)
move_4 = Move(Geometry=brep_join.Breps, Motion=unit_z_5)  # -> Geometry, Transform
split_brep = SplitBrep(Brep=loft, Cutter=move_4.Geometry)
# VERTICAL TRIM
list_item_9 = ListItem(List=split_brep, Index=1, Wrap=True)

# ----
# Vertical Trim
# Curvature Control
graph_mapper_5 = GraphMapper(cull_index_3, x0=0, x1=1, y0=0, y1=2, container_name="Bezier", cpx=[0, 0, 1, 1], cpy=[0.8611767292, 0, 0.3125, 0])

multiplication_5 = Multiplication(A=graph_mapper_5, B=Slider(34, range=30..60))
negative_2 = Negative(Value=multiplication_5)
unit_x_2 = UnitX(Factor=negative_2)
move_5 = Move(Geometry=cull_index_2, Motion=unit_x_2)  # -> Geometry, Transform
cull_last_item = CullLastItem(list=move_5.Geometry)
mirror = Mirror(Geometry=cull_last_item, Plane=PlaneYZ(0, 0, 0))  # -> Geometry, Transform
reverse_list_2 = ReverseList(List=mirror.Geometry)
interpolate_7 = Interpolate(Vertices=[cull_last_item, reverse_list_2], Degree=3, Periodic=False, KnotStyle=1)  # -> Curve, Length, Domain
panel_6 = Panel("""-40
40""")
unit_z_6 = UnitZ(Factor=panel_6)
extrude_2 = Extrude(Base=interpolate_7.Curve, Direction=unit_z_6)
brep_join_2 = BrepJoin(Breps=extrude_2)  # -> Breps, Closed
split_brep_2 = SplitBrep(Brep=list_item_9, Cutter=brep_join_2.Breps)
match_text = MatchText(Text=split_brep_2, Pattern="*Trimmed*", Case=True)
cull_pattern = CullPattern(List=split_brep_2, CullPattern=match_text)
offset_surface = OffsetSurface(Surface=cull_pattern, Distance=1, BothSides=False, CreateSolid=True)
xz_plane = XZPlane(Origin=Point(0, 0, 0))
plane_offset = PlaneOffset(BasePlane=xz_plane, Offset=-4)
# TOE CAP
list_item_10 = ListItem(List=flatten(move_to_point.Moved), Index=0, Wrap=True)
brep_plane = BrepPlane(Brep=cull_pattern, Plane=plane_offset)  # -> Curves, Points
curve = Curve(simplify(flatten(brep_plane.Curves)))
curve_2 = Curve(list_item_10)
loft_2 = Loft(
    Curves=[list_item_10, curve],
    Options={Adjust=False, Closed=False, LoftEnds=0, LoftSimp=0, LoftType=0, Rebuild=10, Refit=0.01})
cap_holes = CapHoles(Brep=loft_2)
# BOOLEAN
solid_union = SolidUnion(Breps=flatten([cap_holes, offset_surface]))
deconstruct_brep = DeconstructBrep(Brep=solid_union)  # -> Faces, Edges, Vertices
panel_7 = Panel("*Elliptical*")
panel_9 = Panel(deconstruct_brep.Edges)
match_text_2 = MatchText(Text=deconstruct_brep.Edges, Pattern="*Elliptical*", Case=True)
list_indices = ListIndices(List=deconstruct_brep.Edges)
cull_pattern_2 = CullPattern(List=list_indices, CullPattern=match_text_2)
# Fillet Outer Edge
# of Toebox
fillet_edge = FilletEdge(Shape=solid_union, Blend=0, Metric=0, Edges=cull_pattern_2, Radii=4)
# TOEBOX FILLET
panel_10 = Panel("*Planar*")
match_text_3 = MatchText(Text=deconstruct_brep.Edges, Pattern=panel_10, Case=True)
list_indices_2 = ListIndices(List=deconstruct_brep.Edges)
cull_pattern_3 = CullPattern(List=list_indices_2, CullPattern=match_text_3)
cull_pattern_4 = CullPattern(List=deconstruct_brep.Edges, CullPattern=match_text_3)
length_2 = Length(Curve=cull_pattern_4)
sort_list_2 = SortList(Keys=length_2, ValuesValuesA=cull_pattern_3)  # -> Keys, ValuesValuesA
sort_list_3 = SortList(Keys=length_2, ValuesValuesA=cull_pattern_4)  # -> Keys, ValuesValuesA
panel_11 = Panel("""0
1
2""")
list_item_11 = ListItem(List=sort_list_3.ValuesValuesA, Index=panel_11, Wrap=True)
list_item_12 = ListItem(List=sort_list_2.ValuesValuesA, Index=panel_11, Wrap=True)
fillet_edge_2 = FilletEdge(Shape=fillet_edge, Blend=0, Metric=0, Edges=list_item_12, Radii=2)
create_material = CreateMaterial(Diffuse=RGB(255, 148, 180), Specular=RGB(255, 255, 255), Emission=RGB(0, 0, 0), Transparency=0, Shine=0)
custom_preview = CustomPreview(Geometry=fillet_edge_2, Material=create_material)

# ==== cluster CullLastItem
list = ClusterInput()
list_length = ListLength(List=list)
subtraction = Subtraction(A=list_length, B=1)
cull_index = CullIndex(List=list, Indices=subtraction, Wrap=True)
list_2 = ClusterOutput(cull_index)
