# Grasshopper definition 070421 component.gh (Grasshopper 1.0.7)
# plug-ins: Pufferfish

# ----
# SCAN IN ->
mesh = Mesh(<mesh referenced from the Rhino model>)

# ----
# IMPORT MESH
deconstruct_mesh = DeconstructMesh(Mesh=mesh)  # -> Vertices, Faces, Colours, Normals
point_list = PointList(Points=deconstruct_mesh.Vertices)
list_item = ListItem(List=deconstruct_mesh.Vertices, Index=2420, Wrap=True)
move_to_point = MoveToPoint(Geometry=mesh, PointA=list_item, PointB=Point(0, 0, 0))  # -> Moved, Vector, Transform
mesh_to_polysurface = MeshToPolysurface(Mesh=move_to_point.Moved, Triangles=False, FaceMerge=False)
deconstruct_mesh_2 = DeconstructMesh(Mesh=move_to_point.Moved)  # -> Vertices, Faces, Colours, Normals
deconstruct_brep = DeconstructBrep(Brep=mesh_to_polysurface)  # -> Faces, Edges, Vertices
deconstruct_mesh_3 = DeconstructMesh(Mesh=move_to_point.Moved)  # -> Vertices, Faces, Colours, Normals; disabled
# Bisect the Foot
brep_plane = BrepPlane(Brep=mesh_to_polysurface, Plane=PlaneYZ(0, 0, 0))  # -> Curves, Points
# Generate 'Base' Plane
brep_plane_2 = BrepPlane(Brep=mesh_to_polysurface, Plane=PlaneXY(0, 0, 0))  # -> Curves, Points
# Set Shank Length to 85% of Footbase
tip_of_big_toe = ListItem(List=deconstruct_mesh_2.Vertices, Index=2420, Wrap=True)
back_of_heel = ListItem(List=deconstruct_mesh_2.Vertices, Index=2027, Wrap=True)
platform_height_mm = Slider(34, range=0..100)
platform_width_mm = Slider(36, range=0..100)
platform_width_mm_2 = Slider(42, range=0..100)
line = Line(StartPoint=tip_of_big_toe, EndPoint=back_of_heel)
panel = Panel("""8594
12722
10481
658
7004
869
12059
12003
9808
6220
6174
6112
6107
6063
3659
3664""")  # disabled
panel_2 = Panel("""9454
9436
9414
9356
7506
718
414
1608
4584
6441
12371
5190
7972
8186
4854
2081
1977
8007
2325""")  # disabled
panel_3 = Panel("""8646
11329
12329
9761
293
2121
7651
324
6350
7262""")  # disabled
offset_curve = OffsetCurve(Curve=brep_plane_2.Curves, Distance=-15, Plane=PlaneXY(0, 0, 0), Corners=2)
offset_curve_2 = OffsetCurve(Curve=brep_plane.Curves, Distance=-15, Plane=PlaneYZ(0, 0, 0), Corners=1)
image_sampler = ImageSampler(
    FilePath="C:\Users\Luke Hillery\Documents\DE4\SOLO\Component CAD\foot top view.jpg",
    Filter="Colour",
    Interpolate=False,
    Umax=1,
    Umin=0,
    Vmax=1,
    Vmin=0,
    Wrap=1)  # disabled
# Tip of 2nd Toe
list_item_2 = ListItem(List=deconstruct_mesh_3.Vertices, Index=9089, Wrap=True)  # disabled
# Tip of Big Toe
list_item_3 = ListItem(List=deconstruct_mesh_3.Vertices, Index=2420, Wrap=True)  # disabled
extrude = Extrude(Base=offset_curve, Direction=Vector(0, 0, -30))
division = Division(A=platform_width_mm_2, B=2)
division_2 = Division(A=platform_height_mm, B=2)
division_3 = Division(A=platform_width_mm, B=2)
extrude_2 = Extrude(Base=offset_curve_2, Direction=Vector(-70, 0, 0))
extrude_3 = Extrude(Base=offset_curve_2, Direction=Vector(70, 0, 0))

# ----
# Back of Heel
list_item_4 = ListItem(List=deconstruct_mesh.Vertices, Index=2027, Wrap=True)  # disabled

# ----
# Outside Instep
list_item_5 = ListItem(List=deconstruct_mesh_3.Vertices, Index=panel, Wrap=True)  # disabled

# ----
# Instep Profile
list_item_6 = ListItem(List=deconstruct_mesh_3.Vertices, Index=panel_2, Wrap=True)  # disabled

# ----
# Inside Instep
list_item_7 = ListItem(List=deconstruct_mesh_3.Vertices, Index=panel_3, Wrap=True)  # disabled

line_2 = Line(StartPoint=list_item_3, EndPoint=list_item_2)  # disabled
cap_holes = CapHoles(Brep=extrude)
negative = Negative(Value=division)
negative_2 = Negative(Value=division_3)
unit_z = UnitZ(Factor=division_2)
cap_holes_2 = CapHoles(Brep=extrude_2)
cap_holes_3 = CapHoles(Brep=extrude_3)
point_in_brep = PointInBrep(Brep=cap_holes, Point=deconstruct_brep.Vertices, Strict=False)
interpolate = Interpolate(Vertices=list_item_7, Degree=1, Periodic=False, KnotStyle=1)  # -> Curve, Length, Domain; disabled
interpolate_2 = Interpolate(Vertices=list_item_6, Degree=1, Periodic=False, KnotStyle=1)  # -> Curve, Length, Domain; disabled
interpolate_3 = Interpolate(Vertices=list_item_5, Degree=1, Periodic=False, KnotStyle=1)  # -> Curve, Length, Domain; disabled
curve_middle = CurveMiddle(Curve=line_2)  # disabled
unit_x = UnitX(Factor=[division, negative])
unit_x_2 = UnitX(Factor=[division_3, negative_2])
# Tip of Big Toe
xy_plane = XYPlane(Origin=Point(0, 0, 0))  # disabled
point_in_brep_2 = PointInBrep(Brep=cap_holes_3, Point=deconstruct_brep.Vertices, Strict=False)
# FOOT LENGTH
unit_z_2 = UnitZ(Factor=-1)  # disabled
point_in_brep_3 = PointInBrep(Brep=cap_holes_2, Point=deconstruct_brep.Vertices, Strict=False)
cull_pattern = CullPattern(List=deconstruct_brep.Vertices, CullPattern=point_in_brep)
unit_z_3 = UnitZ(Factor=-1)  # disabled
xy_plane_2 = XYPlane(Origin=Point(0, 0, 0))  # disabled
project = Project(Geometry=interpolate_3.Curve, Plane=PlaneXY(0, 0, 0))  # -> Geometry, Transform; disabled
project_2 = Project(Geometry=interpolate.Curve, Plane=PlaneXY(0, 0, 0))  # -> Geometry, Transform; disabled
project_3 = Project(Geometry=interpolate_2.Curve, Plane=PlaneYZ(0, 0, 0))  # -> Geometry, Transform; disabled
project_point = ProjectPoint(Point=list_item, Direction=unit_z_2, Geometry=xy_plane)  # -> Point, Index; disabled
project_point_2 = ProjectPoint(Point=list_item_4, Direction=unit_z_3, Geometry=xy_plane_2)  # -> Point, Index; disabled
unit_z_4 = UnitZ(Factor=Slider(7, range=0..10))
project_4 = Project(Geometry=cull_pattern, Plane=PlaneXY(0, 0, 0))  # -> Geometry, Transform
cull_pattern_2 = CullPattern(List=deconstruct_brep.Vertices, CullPattern=point_in_brep_3)
cull_pattern_3 = CullPattern(List=deconstruct_brep.Vertices, CullPattern=point_in_brep_2)
rebuild_curve = RebuildCurve(Curve=project.Geometry, Count=4, Degree=3, EndTangents=False)  # disabled
rebuild_curve_2 = RebuildCurve(Curve=project_2.Geometry, Count=3, Degree=2, EndTangents=False)  # disabled
rebuild_curve_3 = RebuildCurve(Curve=project_3.Geometry, Count=8, Degree=5, EndTangents=False)  # disabled

# ----
# Foot Length
distance = Distance(PointA=project_point.Point, PointB=project_point_2.Point)  # disabled

project_5 = Project(Geometry=cull_pattern_3, Plane=PlaneYZ(0, 0, 0))  # -> Geometry, Transform
project_6 = Project(Geometry=cull_pattern_2, Plane=PlaneYZ(0, 0, 0))  # -> Geometry, Transform
distance_2 = Distance(PointA=project_4.Geometry, PointB=cull_pattern)
multiplication = Multiplication(A=distance, B=0.8)  # disabled
average = Average(Input=distance_2)
distance_3 = Distance(PointA=cull_pattern_2, PointB=project_6.Geometry)
distance_4 = Distance(PointA=cull_pattern_3, PointB=project_5.Geometry)
round = Round(Number=multiplication)  # -> Nearest, Floor, Ceiling; disabled
series = Series(Start=0, Step=1, Count=5)  # disabled
average_2 = Average(Input=distance_3)
average_3 = Average(Input=distance_4)
negative_3 = Negative(Value=average)
average_4 = Average(Input=[average_2, average_3])
addition = Addition(A=series, B=1)  # disabled
subtraction = Subtraction(A=average_3, B=average_4)
number_slider = Slider(10, range=0..12)  # disabled
number_slider_2 = Slider(2, range=0..10)  # disabled
construct_point = ConstructPoint(XCoordinate=subtraction, YCoordinate=0, ZCoordinate=0)
construct_point_2 = ConstructPoint(XCoordinate=subtraction, YCoordinate=0, ZCoordinate=negative_3)
# 1D Measurement Extraction
tip_of_big_toe_2 = ListItem(List=deconstruct_mesh_2.Vertices, Index=2420, Wrap=True)
back_of_heel_2 = ListItem(List=deconstruct_mesh_2.Vertices, Index=2027, Wrap=True)
construct_domain = ConstructDomain(DomainStart=number_slider_2, DomainEnd=number_slider)  # disabled
line_3 = Line(StartPoint=tip_of_big_toe_2, EndPoint=back_of_heel_2)

# ----
# ORIGIN OUT
foot_origin = ConstructPoint(XCoordinate=subtraction, YCoordinate=0, ZCoordinate=negative_3)

foot_origin_2 = Point(foot_origin)
move = Move(Geometry=foot_origin_2, Motion=unit_x)  # -> Geometry, Transform
move_2 = Move(Geometry=foot_origin_2, Motion=unit_x_2)  # -> Geometry, Transform
move_3 = Move(Geometry=move.Geometry, Motion=unit_z_4)  # -> Geometry, Transform
list_item_8 = ListItem(List=move_2.Geometry, Index=0, Wrap=True)
list_item_9 = ListItem(List=move_2.Geometry, Index=1, Wrap=True)
move_4 = Move(Geometry=foot_origin_2, Motion=unit_z)  # -> Geometry, Transform
list_item_10 = ListItem(List=move_3.Geometry, Index=1, Wrap=True)
list_item_11 = ListItem(List=move_3.Geometry, Index=0, Wrap=True)
nurbs_curve = NurbsCurve(Vertices=[list_item_8, list_item_11, move_4.Geometry, list_item_10, list_item_9], Degree=2, Periodic=False)  # -> Curve, Length, Domain
close_curve = CloseCurve(Curve=nurbs_curve.Curve, CloseType=2, Bulge=0.2, Tolerance=0)  # -> Closed, ResultBoolean

# ----
# BISECTION PLANE OUT
foot_bisection_plane = YZPlane(Origin=construct_point)

project_7 = Project(Geometry=line, Plane=foot_bisection_plane)  # -> Geometry, Transform
curve_plane = CurvePlane(Curve=close_curve.Closed, Plane=foot_bisection_plane)  # -> Points, ParamsC, ParamsP
deconstruct = Deconstruct(Point=curve_plane.Points)  # -> XComponent, YComponent, ZComponent
sort_list = SortList(Keys=deconstruct.ZComponent, ValuesValuesA=curve_plane.Points)  # -> Keys, ValuesValuesA
list_item_12 = ListItem(List=sort_list.ValuesValuesA, Index=0, Wrap=True)
project_8 = Project(Geometry=line_3, Plane=foot_bisection_plane)  # -> Geometry, Transform

# ----
# BASE PLANE OUT
foot_base_plane = XYPlane(Origin=construct_point_2)

project_9 = Project(Geometry=project_7.Geometry, Plane=foot_base_plane)  # -> Geometry, Transform
scale_nu = ScaleNU(Geometry=project_9.Geometry, Plane=foot_base_plane, ScaleX=1, ScaleY=0.85, ScaleZ=1)  # -> Geometry, Transform
divide_curve = DivideCurve(Curve=scale_nu.Geometry, Count=20, Kinks=False)  # -> Points, Tangents, Parameters
# Side Profile Cut
graph_mapper = GraphMapper(
    divide_curve.Parameters,
    x0=0,
    x1=1,
    y0=0,
    y1=1,
    container_name="Bezier",
    cpx=[0, 0.3863660097, 0.3824808896, 1],
    cpy=[1, 0, 0, 0])
end_points = EndPoints(Curve=scale_nu.Geometry)  # -> Start, End
unit_z_5 = UnitZ(Factor=graph_mapper)
multiplication_2 = Multiplication(A=unit_z_5, B=100)
circle = Circle(Plane=end_points.End, Radius=15)
move_5 = Move(Geometry=divide_curve.Points, Motion=multiplication_2)  # -> Geometry, Transform
divide_curve_2 = DivideCurve(Curve=circle, Count=2, Kinks=False)  # -> Points, Tangents, Parameters
interpolate_4 = Interpolate(Vertices=move_5.Geometry, Degree=3, Periodic=False, KnotStyle=1)  # -> Curve, Length, Domain
list_item_13 = ListItem(List=divide_curve_2.Points, Index=1, Wrap=True)
list_item_14 = ListItem(List=divide_curve_2.Points, Index=0, Wrap=True)
move_6 = Move(Geometry=interpolate_4.Curve, Motion=Vector(100, 0, 0))  # -> Geometry, Transform
extrude_4 = Extrude(Base=move_6.Geometry, Direction=Vector(-200, 0, 0))
offset_surface = OffsetSurface(Surface=extrude_4, Distance=80, BothSides=False, CreateSolid=True)
move_to_point_2 = MoveToPoint(Geometry=close_curve.Closed, PointA=list_item_12, PointB=foot_origin_2)  # -> Moved, Vector, Transform

# ----
# Foot Length
project_10 = Project(Geometry=project_8.Geometry, Plane=foot_base_plane)  # -> Geometry, Transform

scale_nu_2 = ScaleNU(Geometry=project_10.Geometry, Plane=foot_base_plane, ScaleX=1, ScaleY=0.85, ScaleZ=1)  # -> Geometry, Transform
end_points_2 = EndPoints(Curve=scale_nu_2.Geometry)  # -> Start, End
length = Length(Curve=scale_nu_2.Geometry)
deconstruct_2 = Deconstruct(Point=end_points_2.Start)  # -> XComponent, YComponent, ZComponent
division_4 = Division(A=length, B=3)
addition_2 = Addition(A=deconstruct_2.YComponent, B=division_4)
construct_point_3 = ConstructPoint(XCoordinate=deconstruct_2.XComponent, YCoordinate=addition_2, ZCoordinate=deconstruct_2.ZComponent)
xz_plane = XZPlane(Origin=foot_origin)
xz_plane_2 = XZPlane(Origin=construct_point_3)
offset_plane = OffsetPlane(Plane=xz_plane, Distance=-70, BothSides=False, OffsetX=False, OffsetY=False, OffsetZ=True)
brep_plane_3 = BrepPlane(Brep=mesh_to_polysurface, Plane=xz_plane_2)  # -> Curves, Points
brep_plane_4 = BrepPlane(Brep=mesh_to_polysurface, Plane=offset_plane)  # -> Curves, Points
divide_curve_3 = DivideCurve(Curve=brep_plane_3.Curves, Count=50, Kinks=False)  # -> Points, Tangents, Parameters
rebuild_curve_4 = RebuildCurve(Curve=brep_plane_4.Curves, Count=20, Degree=5, EndTangents=False)
rebuild_curve_5 = RebuildCurve(Curve=move_to_point_2.Moved, Count=20, Degree=5, EndTangents=False)
project_11 = Project(Geometry=divide_curve_3.Points, Plane=PlaneYZ(0, 0, 0))  # -> Geometry, Transform
number_slider_3 = Slider(20, range=0..100)
project_12 = Project(Geometry=divide_curve_3.Points, Plane=PlaneXY(0, 0, 0))  # -> Geometry, Transform
division_5 = Division(A=number_slider_3, B=2)
deconstruct_3 = Deconstruct(Point=project_12.Geometry)  # -> XComponent, YComponent, ZComponent
deconstruct_4 = Deconstruct(Point=project_11.Geometry)  # -> XComponent, YComponent, ZComponent
align_curve_seams = AlignCurveSeams(Curves=[rebuild_curve_4, rebuild_curve_5], Seam=1, Snap=False, Iterative=True)  # -> Aligned, Points, ResultBoolean
perp_frames = PerpFrames(Curve=scale_nu.Geometry, Count=number_slider_3, Align=True)  # -> Frames, Parameters
series_2 = Series(Start=0, Step=1, Count=division_5)
sort_list_2 = SortList(Keys=deconstruct_3.XComponent, ValuesA=project_12.Geometry)  # -> Keys, ValuesA
sort_list_3 = SortList(Keys=deconstruct_4.ZComponent, ValuesValuesA=project_11.Geometry)  # -> Keys, ValuesValuesA
list_item_15 = ListItem(List=perp_frames.Frames, Index=series_2, Wrap=True)
brep_plane_5 = BrepPlane(Brep=mesh_to_polysurface, Plane=list_item_15)  # -> Curves, Points
list_item_16 = ListItem(List=sort_list_2.ValuesA, Index=0, Wrap=True)
list_item_17 = ListItem(List=sort_list_3.ValuesValuesA, Index=0, Wrap=True)
list_item_18 = ListItem(List=sort_list_2.ValuesA, Index=-1, Wrap=True)
list_item_19 = ListItem(List=sort_list_3.ValuesValuesA, Index=-1, Wrap=True)
offset_curve_3 = OffsetCurve(Curve=brep_plane_5.Curves, Distance=-1, Plane=PlaneXZ(0, 0, 0), Corners=1)
list_item_20 = ListItem(List=flatten(offset_curve_3), Index=1, Wrap=True)

# ----
# Instep Width
distance_5 = Distance(PointA=list_item_16, PointB=list_item_18)

# ----
# Instep Height
distance_6 = Distance(PointA=list_item_17, PointB=list_item_19)

rebuild_curve_6 = RebuildCurve(Curve=offset_curve_3, Degree=2, Count=50, Tangents=False)  # -> simplify(Curve)
curve_plane_2 = CurvePlane(Curve=list_item_20, Plane=PlaneXY(0, 0, 0))  # -> Points, ParamsC, ParamsP
unit_z_6 = UnitZ(Factor=[-50, 50])
list_item_21 = ListItem(List=curve_plane_2.Points, Index=0, Wrap=True)
extrude_5 = Extrude(Base=circle, Direction=unit_z_6)
align_curve_seams_2 = AlignCurveSeams(Curves=rebuild_curve_6, Guide=list_item_21, Seam=1, Snap=False, Iterative=True)  # -> Aligned, Points, ResultBoolean
unit_z_7 = UnitZ(Factor=[-50, 50])
cap_holes_4 = CapHoles(Brep=extrude_5)
solid_union = SolidUnion(Breps=cap_holes_4)
loft = Loft(
    Curves=flatten(align_curve_seams_2.Aligned),
    Options={Adjust=False, Closed=False, LoftEnds=0, LoftSimp=0, LoftType=0, Rebuild=10, Refit=0.01})
list_item_22 = ListItem(List=flatten(align_curve_seams_2.Aligned), Index=0, Wrap=True)
list_item_23 = ListItem(List=flatten(align_curve_seams_2.Aligned), Index=-1, Wrap=True)
brep_curve = BrepCurve(Brep=extrude_4, Curve=list_item_23)  # -> Curves, Points
list_item_24 = ListItem(List=brep_curve.Points, Index=1, Wrap=True)
list_item_25 = ListItem(List=brep_curve.Points, Index=0, Wrap=True)
line_4 = Line(StartPoint=list_item_25, EndPoint=list_item_13)
line_5 = Line(StartPoint=list_item_24, EndPoint=list_item_14)
divide_curve_4 = DivideCurve(Curve=line_4, Count=20, Kinks=False)  # -> Points, Tangents, Parameters
divide_curve_5 = DivideCurve(Curve=line_5, Count=20, Kinks=False)  # -> Points, Tangents, Parameters
graph_mapper_2 = GraphMapper(
    divide_curve_4.Parameters,
    x0=0,
    x1=1,
    y0=-1,
    y1=1,
    container_name="Bezier",
    cpx=[0, 0.159441635, 0, 1],
    cpy=[0.5015228987, 0.5297356844, 0.3050661087, 0.5008969307])
graph_mapper_3 = GraphMapper(
    divide_curve_5.Parameters,
    x0=0,
    x1=1,
    y0=-1,
    y1=1,
    container_name="Bezier",
    cpx=[0, 0, 0.4491433203, 1],
    cpy=[0.50220263, 0.5211445093, 0.4125546217, 0.499735415])
multiplication_3 = Multiplication(A=graph_mapper_2, B=-40)
multiplication_4 = Multiplication(A=graph_mapper_3, B=40)
unit_x_3 = UnitX(Factor=multiplication_3)
unit_x_4 = UnitX(Factor=multiplication_4)
move_7 = Move(Geometry=divide_curve_4.Points, Motion=unit_x_3)  # -> Geometry, Transform
move_8 = Move(Geometry=divide_curve_5.Points, Motion=unit_x_4)  # -> Geometry, Transform
interpolate_5 = Interpolate(Vertices=move_8.Geometry, Degree=3, Periodic=False, KnotStyle=1)  # -> Curve, Length, Domain
interpolate_6 = Interpolate(Vertices=move_7.Geometry, Degree=3, Periodic=False, KnotStyle=1)  # -> Curve, Length, Domain
project_13 = Project(Curve=interpolate_6.Curve, Brep=extrude_4, Direction=Vector(0, 0, 1))
project_14 = Project(Curve=interpolate_5.Curve, Brep=extrude_4, Direction=Vector(0, 0, 1))
flip_curve = FlipCurve(Curve=project_13)  # -> Curve, Flag
ruled_surface = RuledSurface(CurveA=project_14, CurveB=project_13)
split_with_breps = SplitWithBreps(Curve=list_item_23, Brep=extrude_4)  # -> Curve, Points
extrude_6 = Extrude(Base=ruled_surface, Direction=unit_z_7)
length_2 = Length(Curve=split_with_breps.Curve)
sort_list_4 = SortList(Keys=length_2, ValuesValuesA=split_with_breps.Curve)  # -> Keys, ValuesValuesA
solid_union_2 = SolidUnion(Breps=extrude_6)
unit_y = UnitY(Factor=300)
list_item_26 = ListItem(List=sort_list_4.ValuesValuesA, Index=0, Wrap=True)
extrude_7 = Extrude(Base=list_item_26, Direction=unit_y)
offset_surface_2 = OffsetSurface(Surface=extrude_7, Distance=-1, BothSides=False, CreateSolid=True)
solid_intersection = SolidIntersection(BrepsA=offset_surface_2, BrepsB=solid_union_2)
solid_intersection_2 = SolidIntersection(BrepsA=offset_surface_2, BrepsB=solid_union)
solid_union_3 = SolidUnion(Breps=flatten([solid_intersection, solid_intersection_2]))
brep_brep = BrepBrep(BrepA=extrude_4, BrepB=loft)  # -> Curves, Points
end_points_3 = EndPoints(Curve=brep_brep.Curves)  # -> Start, End
xz_plane_3 = XZPlane(Origin=Point(0, 5, 0))  # disabled
curve_closest_point = CurveClosestPoint(Point=[end_points_3.Start, end_points_3.End], Curve=list_item_23)  # -> Point, Parameter, Distance
number_slider_4 = Slider(3, range=0..10)  # disabled
flip_curve_2 = FlipCurve(Curve=move_to_point_2.Moved)  # -> Curve, Flag
shatter = Shatter(Curve=list_item_23, Parameters=simplify(curve_closest_point.Parameter))
rectangle = Rectangle(Plane=xz_plane_3, XSize=Domain(-50, 50), YSize=Domain(-50, 50), Radius=0)  # -> Rectangle, Length; disabled
rebuild_curve_7 = RebuildCurve(Curve=flip_curve_2.Curve, Count=50, EndTangents=False)

# ----
# CHRONOLOGICAL ORDER -->
# Foot Length (mm)
number_slider_5 = Slider(150, range=50..300)  # disabled

boundary_surfaces = BoundarySurfaces(Edges=rectangle.Rectangle)  # disabled
unit_y_2 = UnitY(Factor=-10)  # disabled
length_3 = Length(Curve=shatter)
extrude_8 = Extrude(Base=boundary_surfaces, Direction=unit_y_2)  # disabled
sort_list_5 = SortList(Keys=length_3, ValuesValuesA=shatter)  # -> Keys, ValuesValuesA
construct_point_4 = ConstructPoint(XCoordinate=0, YCoordinate=0, ZCoordinate=0)  # disabled
unit_y_3 = UnitY(Factor=round.Nearest)  # disabled
longer_curve_segment = ListItem(List=sort_list_5.ValuesValuesA, Index=1, Wrap=True)
shorter_curve_segment = ListItem(List=sort_list_5.ValuesValuesA, Index=0, Wrap=True)
mesh_to_polysurface_2 = MeshToPolysurface(Mesh=move_to_point.Moved, Triangles=False, FaceMerge=False)  # disabled
brep_plane_6 = BrepPlane(Brep=loft, Plane=PlaneXY(0, 0, 0))  # -> Curves, Points
point = Point(curve_middle)  # disabled
move_9 = Move(Geometry=construct_point_4, Motion=unit_y_3)  # -> Geometry, Transform; disabled
join_curves = JoinCurves(Curves=flatten([brep_brep.Curves, shorter_curve_segment]), Preserve=False)
list_item_27 = ListItem(List=flatten(join_curves), Index=-1, Wrap=True)
align_curve_seams_3 = AlignCurveSeams(Curves=[list_item_27, rebuild_curve_7], Guide=curve_closest_point.Point, Seam=1, Snap=False, Iterative=True)  # -> Aligned, Points, ResultBoolean
list_item_28 = ListItem(List=flatten(align_curve_seams_3.Aligned), Index=-1, Wrap=True)
list_item_29 = ListItem(List=flatten(align_curve_seams_3.Aligned), Index=0, Wrap=True)
curve_plane_3 = CurvePlane(Curve=list_item_28, Plane=PlaneXY(0, 0, 0))  # -> Points, ParamsC, ParamsP
list_item_30 = ListItem(List=brep_plane_6.Curves, Index=0, Wrap=True)
list_item_31 = ListItem(List=brep_plane_6.Curves, Index=1, Wrap=True)
yz_plane = YZPlane(Origin=Point(0, 0, 0))  # disabled
end_points_4 = EndPoints(Curve=list_item_31)  # -> Start, End
end_points_5 = EndPoints(Curve=list_item_30)  # -> Start, End
list_item_32 = ListItem(List=curve_plane_3.Points, Index=0, Wrap=True)
list_item_33 = ListItem(List=curve_plane_3.Points, Index=1, Wrap=True)
project_15 = Project(Geometry=point, Plane=yz_plane)  # -> Geometry, Transform; disabled
curve_plane_4 = CurvePlane(Curve=flip_curve_2.Curve, Plane=foot_bisection_plane)  # -> Points, ParamsC, ParamsP
curve_plane_5 = CurvePlane(Curve=shorter_curve_segment, Plane=foot_bisection_plane)  # -> Points, ParamsC, ParamsP
project_16 = Project(Geometry=end_points_4.Start, Plane=PlaneXZ(0, 0, 0))  # -> Geometry, Transform
project_17 = Project(Geometry=end_points_4.End, Plane=PlaneXZ(0, 0, 0))  # -> Geometry, Transform
distance_7 = Distance(PointA=point, PointB=project_15.Geometry)  # disabled
move_to_point_3 = MoveToPoint(Geometry=list_item_30, PointA=end_points_5.End, PointB=list_item_33)  # -> Moved, Vector, Transform
move_to_point_4 = MoveToPoint(Geometry=list_item_31, PointA=end_points_4.Start, PointB=list_item_32)  # -> Moved, Vector, Transform
project_18 = Project(Geometry=end_points_5.End, Plane=PlaneXZ(0, 0, 0))  # -> Geometry, Transform
project_19 = Project(Geometry=end_points_5.Start, Plane=PlaneXZ(0, 0, 0))  # -> Geometry, Transform

# ----
# Curvature
# Interpolation
# Degree
# NOTE
# Only works at 15 and 20...
control_knob = ControlKnob(Decimals=0, Limit=True, Maximum=20, Minimum=10, Range=20, Value=15)  # disabled

deconstruct_5 = Deconstruct(Point=curve_plane_4.Points)  # -> XComponent, YComponent, ZComponent
negative_4 = Negative(Value=distance_7)  # disabled
distance_8 = Distance(PointA=project_16.Geometry, PointB=project_17.Geometry)
distance_9 = Distance(PointA=list_item_32, PointB=project_17.Geometry)
distance_10 = Distance(PointA=list_item_33, PointB=project_19.Geometry)
distance_11 = Distance(PointA=project_18.Geometry, PointB=project_19.Geometry)
unit_x_5 = UnitX(Factor=negative_4)  # disabled
sort_list_6 = SortList(Keys=deconstruct_5.ZComponent, ValuesValuesA=curve_plane_4.Points)  # -> Keys, ValuesValuesA
division_6 = Division(A=distance_9, B=distance_8)
xy_plane_3 = XYPlane(Origin=Point(0, 0, 0))
xy_plane_4 = XYPlane(Origin=Point(0, 0, 0))
division_7 = Division(A=distance_10, B=distance_11)
list_item_34 = ListItem(List=sort_list_6.ValuesValuesA, Index=0, Wrap=True)
# TOEBOX SHAPE
move_10 = Move(Geometry=move_9.Geometry, Motion=unit_x_5)  # -> Geometry, Transform; disabled
line_6 = Line(StartPoint=point, EndPoint=move_10.Geometry)  # disabled
divide_curve_6 = DivideCurve(Curve=line_6, Count=control_knob, Kinks=False)  # -> Points, Tangents, Parameters; disabled
plane_origin = PlaneOrigin(Base=xy_plane_3, Origin=list_item_32)

# ----
# Toebox
# Curvature Control
graph_mapper_4 = GraphMapper(
    divide_curve_6.Parameters,
    x0=0,
    x1=1,
    y0=0,
    y1=1,
    container_name="Bezier",
    cpx=[0, 0.630081296, 0.9479647875, 1],
    cpy=[0, 0, 0.05223429203, 0.7957516909])  # disabled
# NOTE
# Curvature should be taken from
# raw 3D scan, either using photo with
# edge detection or with cross-section
# curves through mesh from 3D scan
number_slider_6 = Slider(50, range=30..60)  # disabled

plane_origin_2 = PlaneOrigin(Base=xy_plane_4, Origin=list_item_33)
line_7 = Line(StartPoint=curve_plane_5.Points, EndPoint=list_item_34)  # -> simplify(Line)
scale_nu_3 = ScaleNU(Geometry=move_to_point_4.Moved, Plane=plane_origin, ScaleX=division_6, ScaleY=1, ScaleZ=1)  # -> Geometry, Transform
scale_nu_4 = ScaleNU(Geometry=move_to_point_3.Moved, Plane=plane_origin_2, ScaleX=division_7, ScaleY=1, ScaleZ=1)  # -> Geometry, Transform
flip_curve_3 = FlipCurve(Curve=scale_nu_3.Geometry)  # -> Curve, Flag
flip_curve_4 = FlipCurve(Curve=list_item_29)  # -> Curve, Flag
multiplication_5 = Multiplication(A=graph_mapper_4, B=number_slider_6)  # disabled
end_points_6 = EndPoints(Curve=scale_nu.Geometry)  # -> Start, End
negative_5 = Negative(Value=multiplication_5)  # disabled
divide_curve_7 = DivideCurve(Curve=scale_nu_4.Geometry, Count=50, Kinks=False)  # -> Points, Tangents, Parameters
divide_curve_8 = DivideCurve(Curve=flip_curve_3.Curve, Count=50, Kinks=False)  # -> Points, Tangents, Parameters
rebuild_curve_8 = RebuildCurve(Curve=scale_nu_4.Geometry, Count=10, Degree=4, EndTangents=True)
line_8 = Line(StartPoint=end_points_4.End, EndPoint=end_points_6.End)
unit_z_8 = UnitZ(Factor=negative_5)  # disabled
interpolate_7 = Interpolate(Vertices=divide_curve_8.Points, Degree=3, Periodic=False, KnotStyle=1)  # -> Curve, Length, Domain
interpolate_8 = Interpolate(Vertices=divide_curve_7.Points, Degree=3, Periodic=False, KnotStyle=1)  # -> Curve, Length, Domain
move_11 = Move(Geometry=divide_curve_6.Points, Motion=unit_z_8)  # -> Geometry, Transform; disabled
insert_items = InsertItems(List=interpolate_7.Curve, Item=interpolate_8.Curve, Indices=1, Wrap=True)

# ----
# Width and Height
# Curvature Control
graph_mapper_5 = GraphMapper(
    divide_curve_6.Parameters,
    x0=0,
    x1=1,
    y0=0,
    y1=1,
    container_name="Bezier",
    cpx=[0, 0.1070338339, 0.4497973323, 1],
    cpy=[0.489772439, 1, 1, 0.3865298629])  # disabled
graph_mapper_6 = GraphMapper(
    divide_curve_6.Parameters,
    x0=0,
    x1=1,
    y0=0,
    y1=1,
    container_name="Bezier",
    cpx=[0, 0.331707716, 0.7379239798, 1],
    cpy=[0.2553995252, 0.8880677819, 0.006016790867, 1])  # disabled
number_slider_7 = Slider(17, range=10..60)  # disabled
# NOTE
# Curvature should be taken from
# raw 3D scan, either using photo with
# edge detection or with cross-section
# curves through mesh from 3D scan
number_slider_8 = Slider(60, range=30..60)  # disabled
multiplication_6 = Multiplication(A=graph_mapper_5, B=number_slider_7)  # disabled
multiplication_7 = Multiplication(A=graph_mapper_6, B=number_slider_8)  # disabled

insert_items_2 = InsertItems(List=insert_items, Item=line_7, Indices=1, Wrap=True)
interpolate_9 = Interpolate(Vertices=move_11.Geometry, Degree=3, Periodic=False, KnotStyle=1)  # -> Curve, Length, Domain; disabled
reverse_list = ReverseList(List=insert_items)
sweep2 = Sweep2(Rail1=list_item_28, Rail2=flip_curve_4.Curve, Sections=reverse_list, SameHeight=False)
cap_holes_5 = CapHoles(Brep=loft)
offset_surface_3 = OffsetSurface(Surface=flatten(loft), Distance=-1, BothSides=False, CreateSolid=True)
number_slider_9 = Slider(4, range=0..10)
number_slider_10 = Slider(20, range=0..100)
perp_frame = PerpFrame(Curve=interpolate_9.Curve, Parameter=move_11.Geometry)  # disabled
curve_plane_6 = CurvePlane(Curve=rebuild_curve, Plane=perp_frame)  # -> graft(Points), ParamsC, ParamsP; disabled
curve_plane_7 = CurvePlane(Curve=rebuild_curve_3, Plane=perp_frame)  # -> flatten(Points), ParamsC, ParamsP; disabled
curve_plane_8 = CurvePlane(Curve=rebuild_curve_2, Plane=perp_frame)  # -> graft(Points), ParamsC, ParamsP; disabled
cull_index = CullIndex(List=curve_plane_7.Points, Indices=0, Wrap=True)  # disabled
deconstruct_6 = Deconstruct(Point=perp_frame)  # -> XComponent, YComponent, ZComponent; disabled
list_item_35 = ListItem(List=flatten(curve_plane_8.Points), Index=series, Wrap=True)  # disabled
list_item_36 = ListItem(List=flatten(curve_plane_6.Points), Index=series, Wrap=True)  # disabled
sort_list_7 = SortList(Keys=deconstruct_6.YComponent, ValuesValuesA=perp_frame)  # -> Keys, flatten(ValuesValuesA); disabled
interpolate_10 = Interpolate(Vertices=cull_index, Degree=3, Periodic=False, KnotStyle=1)  # -> Curve, Length, Domain; disabled
interpolate_11 = Interpolate(Vertices=list_item_36, Degree=3, Periodic=False, KnotStyle=1)  # -> Curve, Length, Domain; disabled
interpolate_12 = Interpolate(Vertices=list_item_35, Degree=3, Periodic=False, KnotStyle=1)  # -> Curve, Length, Domain; disabled
list_item_37 = ListItem(List=sort_list_7.ValuesValuesA, Index=addition, Wrap=True)  # disabled
arc_3pt = Arc3Pt(PointA=list_item_35, PointB=cull_index, PointC=list_item_36)  # -> Arc, Plane, Radius; disabled
list_item_38 = ListItem(List=list_item_37, Index=-1, Wrap=True)  # disabled
close_curve_2 = CloseCurve(Curve=arc_3pt.Arc, CloseType=2, Bulge=0.3, Tolerance=0)  # -> Closed, ResultBoolean; disabled
list_length = ListLength(List=close_curve_2.Closed)  # disabled
subtraction_2 = Subtraction(A=list_length, B=1)  # disabled
curve_plane_9 = CurvePlane(Curve=rebuild_curve_2, Plane=list_item_38)  # -> Points, ParamsC, ParamsP; disabled
range = Range(Domain=construct_domain, Steps=subtraction_2)  # -> flatten(Range); disabled
integer = Integer(range)  # disabled
rebuild_curve_9 = RebuildCurve(Curve=close_curve_2.Closed, Count=6, Degree=integer, EndTangents=False)  # -> graft(Rebuilt); disabled
offset_curve_4 = OffsetCurve(Curve=rebuild_curve_9, Distance=5, Plane=PlaneXZ(0, 0, 0), Corners=1)  # disabled
list_item_39 = ListItem(List=flatten(offset_curve_4), Index=0, Wrap=True)  # disabled
list_item_40 = ListItem(List=flatten(offset_curve_4), Index=-1, Wrap=True)  # disabled
project_20 = Project(Geometry=list_item_39, Plane=PlaneXZ(0, 0, 0))  # -> Geometry, Transform; disabled
planar = Planar(Curve=list_item_40)  # -> Planar, Plane, Deviation; disabled
curve_plane_10 = CurvePlane(Curve=project_20.Geometry, Plane=PlaneXY(0, 0, 0))  # -> Points, ParamsC, ParamsP; disabled
deconstruct_7 = Deconstruct(Point=curve_plane_10.Points)  # -> XComponent, YComponent, ZComponent; disabled
larger_than = LargerThan(FirstNumber=deconstruct_7.XComponent, SecondNumber=0)  # -> LargerThan, OrEqualTo; disabled
reverse_list_2 = ReverseList(List=larger_than.LargerThan)  # disabled
cull_pattern_4 = CullPattern(List=curve_plane_10.Points, CullPattern=larger_than.LargerThan)  # disabled
cull_pattern_5 = CullPattern(List=curve_plane_10.Points, CullPattern=reverse_list_2)  # disabled

project_21 = Project(Geometry=interpolate_12.Curve, Plane=PlaneYZ(0, 0, 0))  # -> Geometry, Transform; disabled
explode = Explode(Curve=interpolate_12.Curve, Recursive=True)  # -> Segments, Vertices; disabled
explode_2 = Explode(Curve=project_21.Geometry, Recursive=True)  # -> Segments, Vertices; disabled
length_4 = Length(Curve=project_21.Geometry)  # disabled
list_item_41 = ListItem(List=explode.Vertices, Index=0, Wrap=True)  # disabled
move_to_point_5 = MoveToPoint(Geometry=interpolate_12.Curve, PointA=list_item_41, PointB=cull_pattern_4)  # -> Moved, Vector, Transform; disabled
list_item_42 = ListItem(List=explode_2.Vertices, Index=1, Wrap=True)  # disabled
distance_12 = Distance(PointA=Point(0, 0, 0), PointB=list_item_42)  # disabled
division_8 = Division(A=distance_12, B=length_4)  # disabled
scale_nu_5 = ScaleNU(Geometry=move_to_point_5.Moved, Plane=PlaneXY(0, 0, 0), ScaleX=1, ScaleY=division_8, ScaleZ=1)  # -> Geometry, Transform; disabled

project_22 = Project(Geometry=interpolate_11.Curve, Plane=PlaneYZ(0, 0, 0))  # -> Geometry, Transform; disabled
explode_3 = Explode(Curve=interpolate_11.Curve, Recursive=True)  # -> Segments, Vertices; disabled
explode_4 = Explode(Curve=project_22.Geometry, Recursive=True)  # -> Segments, Vertices; disabled
length_5 = Length(Curve=project_22.Geometry)  # disabled
list_item_43 = ListItem(List=explode_3.Vertices, Index=0, Wrap=True)  # disabled
move_to_point_6 = MoveToPoint(Geometry=interpolate_11.Curve, PointA=list_item_43, PointB=cull_pattern_5)  # -> Moved, Vector, Transform; disabled
list_item_44 = ListItem(List=explode_4.Vertices, Index=1, Wrap=True)  # disabled
distance_13 = Distance(PointA=Point(0, 0, 0), PointB=list_item_44)  # disabled
division_9 = Division(A=distance_13, B=length_5)  # disabled
scale_nu_6 = ScaleNU(Geometry=move_to_point_6.Moved, Plane=PlaneXY(0, 0, 0), ScaleX=1, ScaleY=division_9, ScaleZ=1)  # -> Geometry, Transform; disabled

yz_plane_2 = YZPlane(Origin=Point(0, 0, 0))  # disabled
project_23 = Project(Geometry=interpolate_11.Curve, Plane=yz_plane_2)  # -> Geometry, Transform; disabled
explode_5 = Explode(Curve=rebuild_curve, Recursive=True)  # -> Segments, Vertices; disabled
explode_6 = Explode(Curve=project_23.Geometry, Recursive=True)  # -> Segments, Vertices; disabled
length_6 = Length(Curve=project_23.Geometry)  # disabled
construct_point_5 = ConstructPoint(XCoordinate=0, YCoordinate=0, ZCoordinate=0)  # disabled
list_item_45 = ListItem(List=explode_5.Vertices, Index=0, Wrap=True)  # disabled
list_item_46 = ListItem(List=explode_6.Vertices, Index=1, Wrap=True)  # disabled
move_to_point_7 = MoveToPoint(Geometry=rebuild_curve, PointA=list_item_45, PointB=cull_pattern_5)  # -> Moved, Vector, Transform; disabled
distance_14 = Distance(PointA=construct_point_5, PointB=list_item_46)  # disabled
division_10 = Division(A=distance_14, B=length_6)  # disabled
scale_nu_7 = ScaleNU(Geometry=move_to_point_7.Moved, Plane=PlaneXY(0, 0, 0), ScaleX=1, ScaleY=division_10, ScaleZ=1)  # -> Geometry, Transform; disabled

sweep2_2 = Sweep2(
    Rail1=project_20.Geometry,
    Rail2=list_item_40,
    Sections=flatten([scale_nu_5.Geometry, scale_nu_6.Geometry]),
    SameHeight=False)  # disabled
brep_plane_7 = BrepPlane(Brep=sweep2_2, Plane=planar.Plane)  # -> Curves, Points; disabled
surface_split = SurfaceSplit(Surface=sweep2_2, Curves=brep_plane_7.Curves)  # disabled
# Toebox
# (based on top-down profile)
list_item_47 = ListItem(List=surface_split, Index=0, Wrap=True)  # disabled

# ----
# Thickness Gradient Controls
v_count = Slider(21, range=0..100)  # disabled
untrim = Untrim(Surface=list_item_47)  # disabled
divide_surface = DivideSurface(Surface=untrim, UCount=v_count, VCount=v_count)  # -> Points, Normals, Parameters; disabled
instep_thickness = Slider(6, range=0..6)  # disabled
toe_thickness = Slider(-1, range=-1..10)  # disabled
construct_domain_2 = ConstructDomain(DomainStart=instep_thickness, DomainEnd=toe_thickness)  # disabled
range_2 = Range(Domain=construct_domain_2, Steps=v_count)  # disabled
multiplication_8 = Multiplication(A=divide_surface.Normals, B=range_2)  # disabled
move_12 = Move(Geometry=divide_surface.Points, Motion=multiplication_8)  # -> Geometry, Transform; disabled
surface_from_points = SurfaceFromPoints(Points=flatten(move_12.Geometry), UCount=expr("x + 1", v_count), Interpolate=False)  # disabled

brep_plane_8 = BrepPlane(Brep=surface_from_points, Plane=planar.Plane)  # -> Curves, Points; disabled
surface_split_2 = SurfaceSplit(Surface=surface_from_points, Curves=brep_plane_8.Curves)  # disabled
list_item_48 = ListItem(List=surface_split_2, Index=0, Wrap=True)  # disabled
deconstruct_brep_2 = DeconstructBrep(Brep=list_item_47)  # -> Faces, Edges, Vertices; disabled
deconstruct_brep_3 = DeconstructBrep(Brep=list_item_48)  # -> Faces, Edges, Vertices; disabled
ruled_surface_2 = RuledSurface(CurveA=deconstruct_brep_2.Edges, CurveB=deconstruct_brep_3.Edges)  # disabled
# BOUNDING VOLUME SHAPE
cap_holes_6 = CapHoles(Brep=list_item_47)  # disabled
brep_join = BrepJoin(Breps=flatten([ruled_surface_2, list_item_48, list_item_47]))  # -> Breps, Closed; disabled
is_polysurface_closed = IsPolysurfaceClosed(Polysurface=brep_join.Breps)  # disabled
cull_pattern_6 = CullPattern(List=brep_join.Breps, CullPattern=is_polysurface_closed)  # disabled
offset_surface_4 = OffsetSurface(Surface=list_item_47, Distance=number_slider_4, BothSides=False, CreateSolid=True)  # disabled
solid_intersection_3 = SolidIntersection(BrepsA=extrude_8, BrepsB=cap_holes_6)  # disabled
solid_union_4 = SolidUnion(Breps=flatten([offset_surface_4, solid_intersection_3]))  # disabled
solid_union_5 = SolidUnion(Breps=flatten([solid_intersection_3, cull_pattern_6]))  # disabled
# Solid
solid_difference = SolidDifference(BrepsA=cap_holes_6, BrepsB=mesh_to_polysurface_2)  # disabled
# Gradient Thickness Shell
solid_difference_2 = SolidDifference(BrepsA=solid_union_5, BrepsB=mesh_to_polysurface_2)  # disabled
# Constant Thickness Shell
solid_difference_3 = SolidDifference(BrepsA=solid_union_4, BrepsB=mesh_to_polysurface_2)  # disabled
rebuild_surface = RebuildSurface(Surface=sweep2, CountU=number_slider_10, CountV=number_slider_10, DegreeU=number_slider_9, DegreeV=number_slider_9)
cap_holes_7 = CapHoles(Brep=rebuild_surface)
offset_surface_5 = OffsetSurface(Surface=sweep2, Distance=1, BothSides=False, CreateSolid=True)
# NOTE
# Ellipse profile is close but not perfect
# Profiles need to be distorted to square off bottom edge
area = Area(Geometry=perp_frame)  # -> Area, graft(Centroid); disabled
ellipse = Ellipse(Plane=perp_frame, Radius1=multiplication_6, Radius2=multiplication_7)  # -> Ellipse, Focus1, Focus2; disabled
# Outer Surface
solid_union_6 = SolidUnion(Breps=flatten(offset_surface_5))
divide_curve_9 = DivideCurve(Curve=ellipse.Ellipse, Count=2, Kinks=False)  # -> Points, Tangents, Parameters; disabled
# Inner Surface
solid_intersection_4 = SolidIntersection(BrepsA=offset_surface, BrepsB=offset_surface_3)
list_item_49 = ListItem(List=divide_curve_9.Points, Index=0, Wrap=True)  # disabled
# Inner Surface + Shank
solid_union_7 = SolidUnion(Breps=flatten([solid_intersection_4, solid_union_3]))
move_to_point_8 = MoveToPoint(Geometry=graft(ellipse.Ellipse), PointA=list_item_49, PointB=area.Centroid)  # -> Moved, Vector, Transform; disabled

# ----
# Bending the Shank
# Original Shank Out
# Shank Length In
# Curved Shank Out
end_points_7 = EndPoints(Curve=scale_nu.Geometry)  # -> Start, End
line_9 = Line(StartPoint=end_points_7.Start, EndPoint=end_points_7.End)
divide_curve_10 = DivideCurve(Curve=line_9, Count=15, Kinks=False)  # -> Points, Tangents, Parameters

# ----
# Shank
# Curvature Control
graph_mapper_7 = GraphMapper(
    divide_curve_10.Parameters,
    x0=0,
    x1=1,
    y0=0,
    y1=1,
    container_name="Bezier",
    cpx=[0, 0.6294739246, 0.8841106296, 1],
    cpy=[0, 0.008542716503, 0.05280476809, 0.7957516909])

multiplication_9 = Multiplication(A=graph_mapper_7, B=Slider(39, range=30..60))
unit_z_9 = UnitZ(Factor=expr("x*-1", multiplication_9))
move_13 = Move(Geometry=divide_curve_10.Points, Motion=unit_z_9)  # -> Geometry, Transform
interpolate_13 = Interpolate(Vertices=move_13.Geometry, Degree=3, Periodic=False, KnotStyle=1)  # -> Curve, Length, Domain

# ----
# BOOLEAN
# TOE CAP
# Fillet Outer Edge
# of Toebox
# Full Curved Component
flow = Flow(
    Geometry=solid_union_7,
    Base=scale_nu.Geometry,
    Target=interpolate_13.Curve,
    ReverseBase=False,
    ReverseTarget=False,
    Stretch=True,
    Rigid=False)
