# Grasshopper definition 110421 component.gh (Grasshopper 1.0.7)
# plug-ins: Pufferfish

# ----
# SCAN IN ->
mesh = Mesh(<mesh referenced from the Rhino model>)

deconstruct_mesh = DeconstructMesh(Mesh=mesh)  # -> Vertices, Faces, Colours, Normals

# ----
# EXPERIMENTAL
extract_toe_tip = ExtractToeTip(point=deconstruct_mesh.Vertices)
extract_heel = ExtractToeTip(point=deconstruct_mesh.Vertices)

point_list = PointList(Points=deconstruct_mesh.Vertices)
list_item = ListItem(List=deconstruct_mesh.Vertices, Index=2420, Wrap=True)
move_to_point = MoveToPoint(Geometry=mesh, PointA=list_item, PointB=Point(0, 0, 0))  # -> Moved, Vector, Transform
mesh_to_polysurface = MeshToPolysurface(Mesh=move_to_point.Moved, Triangles=False, FaceMerge=False)
deconstruct_mesh_2 = DeconstructMesh(Mesh=move_to_point.Moved)  # -> Vertices, Faces, Colours, Normals
# Bisect the Foot
brep_plane = BrepPlane(Brep=mesh_to_polysurface, Plane=PlaneYZ(0, 0, 0))  # -> Curves, Points
# Generate 'Base' Plane
brep_plane_2 = BrepPlane(Brep=mesh_to_polysurface, Plane=PlaneXY(0, 0, 0))  # -> Curves, Points
# Set Shank Length to 85% of Footbase
tip_of_big_toe = ListItem(List=deconstruct_mesh_2.Vertices, Index=2420, Wrap=True)
back_of_heel = ListItem(List=deconstruct_mesh_2.Vertices, Index=2027, Wrap=True)
deconstruct_brep = DeconstructBrep(Brep=mesh_to_polysurface)  # -> Faces, Edges, Vertices
line = Line(StartPoint=tip_of_big_toe, EndPoint=back_of_heel)
offset_curve = OffsetCurve(Curve=brep_plane_2.Curves, Distance=-15, Plane=PlaneXY(0, 0, 0), Corners=2)
offset_curve_2 = OffsetCurve(Curve=brep_plane.Curves, Distance=-15, Plane=PlaneYZ(0, 0, 0), Corners=1)
extrude = Extrude(Base=offset_curve, Direction=Vector(0, 0, -30))
extrude_2 = Extrude(Base=offset_curve_2, Direction=Vector(-70, 0, 0))
extrude_3 = Extrude(Base=offset_curve_2, Direction=Vector(70, 0, 0))
cap_holes = CapHoles(Brep=extrude)
cap_holes_2 = CapHoles(Brep=extrude_2)
cap_holes_3 = CapHoles(Brep=extrude_3)
point_in_brep = PointInBrep(Brep=cap_holes, Point=deconstruct_brep.Vertices, Strict=False)
point_in_brep_2 = PointInBrep(Brep=cap_holes_3, Point=deconstruct_brep.Vertices, Strict=False)
point_in_brep_3 = PointInBrep(Brep=cap_holes_2, Point=deconstruct_brep.Vertices, Strict=False)
cull_pattern = CullPattern(List=deconstruct_brep.Vertices, CullPattern=point_in_brep)
project = Project(Geometry=cull_pattern, Plane=PlaneXY(0, 0, 0))  # -> Geometry, Transform
cull_pattern_2 = CullPattern(List=deconstruct_brep.Vertices, CullPattern=point_in_brep_3)
cull_pattern_3 = CullPattern(List=deconstruct_brep.Vertices, CullPattern=point_in_brep_2)
project_2 = Project(Geometry=cull_pattern_3, Plane=PlaneYZ(0, 0, 0))  # -> Geometry, Transform
project_3 = Project(Geometry=cull_pattern_2, Plane=PlaneYZ(0, 0, 0))  # -> Geometry, Transform
distance = Distance(PointA=project.Geometry, PointB=cull_pattern)
number_slider = Slider(20, range=0..100)
average = Average(Input=distance)
distance_2 = Distance(PointA=cull_pattern_2, PointB=project_3.Geometry)
distance_3 = Distance(PointA=cull_pattern_3, PointB=project_2.Geometry)
division = Division(A=number_slider, B=2)
average_2 = Average(Input=distance_2)
average_3 = Average(Input=distance_3)
negative = Negative(Value=average)
series = Series(Start=0, Step=1, Count=division)
average_4 = Average(Input=[average_2, average_3])
subtraction = Subtraction(A=average_3, B=average_4)
construct_point = ConstructPoint(XCoordinate=subtraction, YCoordinate=0, ZCoordinate=0)
construct_point_2 = ConstructPoint(XCoordinate=subtraction, YCoordinate=0, ZCoordinate=negative)
# 1D Measurement Extraction
tip_of_big_toe_2 = ListItem(List=deconstruct_mesh_2.Vertices, Index=2420, Wrap=True)
back_of_heel_2 = ListItem(List=deconstruct_mesh_2.Vertices, Index=2027, Wrap=True)
line_2 = Line(StartPoint=tip_of_big_toe_2, EndPoint=back_of_heel_2)

# ----
# ORIGIN OUT
foot_origin = ConstructPoint(XCoordinate=subtraction, YCoordinate=0, ZCoordinate=negative)

# ----
# BASE PLANE OUT
foot_base_plane = XYPlane(Origin=construct_point_2)

# ----
# BISECTION PLANE OUT
foot_bisection_plane = YZPlane(Origin=construct_point)

project_4 = Project(Geometry=line, Plane=foot_bisection_plane)  # -> Geometry, Transform
project_5 = Project(Geometry=project_4.Geometry, Plane=foot_base_plane)  # -> Geometry, Transform
scale_nu = ScaleNU(Geometry=project_5.Geometry, Plane=foot_base_plane, ScaleX=1, ScaleY=0.85, ScaleZ=1)  # -> Geometry, Transform
# Side Profile Cutting Line
divide_curve = DivideCurve(Curve=scale_nu.Geometry, Count=20, Kinks=False)  # -> Points, Tangents, Parameters
graph_mapper = GraphMapper(
    divide_curve.Parameters,
    x0=0,
    x1=1,
    y0=0,
    y1=1,
    container_name="Bezier",
    cpx=[0, 0.3863660097, 0.3824808896, 1],
    cpy=[1, 0, 0, 0])
# Extract Instep Cross-Section
perp_frames = PerpFrames(Curve=scale_nu.Geometry, Count=number_slider, Align=True)  # -> Frames, Parameters
list_item_2 = ListItem(List=perp_frames.Frames, Index=series, Wrap=True)
brep_plane_3 = BrepPlane(Brep=mesh_to_polysurface, Plane=list_item_2)  # -> Curves, Points
unit_z = UnitZ(Factor=graph_mapper)
offset_curve_3 = OffsetCurve(Curve=brep_plane_3.Curves, Distance=-1, Plane=PlaneXZ(0, 0, 0), Corners=1)
multiplication = Multiplication(A=unit_z, B=100)
list_item_3 = ListItem(List=flatten(offset_curve_3), Index=1, Wrap=True)
move = Move(Geometry=divide_curve.Points, Motion=multiplication)  # -> Geometry, Transform
rebuild_curve = RebuildCurve(Curve=offset_curve_3, Degree=2, Count=50, Tangents=False)  # -> simplify(Curve)
curve_plane = CurvePlane(Curve=list_item_3, Plane=PlaneXY(0, 0, 0))  # -> Points, ParamsC, ParamsP
list_item_4 = ListItem(List=curve_plane.Points, Index=0, Wrap=True)
interpolate = Interpolate(Vertices=move.Geometry, Degree=3, Periodic=False, KnotStyle=1)  # -> Curve, Length, Domain
align_curve_seams = AlignCurveSeams(Curves=rebuild_curve, Guide=list_item_4, Seam=1, Snap=False, Iterative=True)  # -> Aligned, Points, ResultBoolean
move_2 = Move(Geometry=interpolate.Curve, Motion=Vector(100, 0, 0))  # -> Geometry, Transform
project_6 = Project(Geometry=line_2, Plane=foot_bisection_plane)  # -> Geometry, Transform

# ----
# Cutting Plane
extrude_4 = Extrude(Base=move_2.Geometry, Direction=Vector(-200, 0, 0))

# ----
# Inner Surface
loft = Loft(
    Curves=flatten(align_curve_seams.Aligned),
    Options={Adjust=False, Closed=False, LoftEnds=0, LoftSimp=0, LoftType=0, Rebuild=10, Refit=0.01})

list_item_5 = ListItem(List=flatten(align_curve_seams.Aligned), Index=0, Wrap=True)
list_item_6 = ListItem(List=flatten(align_curve_seams.Aligned), Index=-1, Wrap=True)

# ----
# Foot Length
project_7 = Project(Geometry=project_6.Geometry, Plane=foot_base_plane)  # -> Geometry, Transform

scale_nu_2 = ScaleNU(Geometry=project_7.Geometry, Plane=foot_base_plane, ScaleX=1, ScaleY=0.85, ScaleZ=1)  # -> Geometry, Transform
# 2D Profile Extraction
# Select Forefoot Only
length = Length(Curve=project_5.Geometry)
length_2 = Length(Curve=project_6.Geometry)  # -> expr("x/3", Length)
check_extrude_direction = CheckExtrudeDirection(surface=extrude_4)
unit_y = UnitY(Factor=expr("x/3", length))
end_points = EndPoints(Curve=scale_nu_2.Geometry)  # -> Start, End
move_3 = Move(Geometry=foot_origin, Motion=unit_y)  # -> Geometry, Transform
deconstruct = Deconstruct(Point=end_points.Start)  # -> XComponent, YComponent, ZComponent

# ----
# Cutting Brep
# For Intersections
offset_surface = OffsetSurface(Surface=extrude_4, Distance=check_extrude_direction, BothSides=False, CreateSolid=True)

addition = Addition(A=deconstruct.YComponent, B=length_2)
xz_plane = XZPlane(Origin=move_3.Geometry)
move_4 = Move(Geometry=foot_origin, Motion=Vector(0, 5, 0))  # -> Geometry, Transform
construct_point_3 = ConstructPoint(XCoordinate=deconstruct.XComponent, YCoordinate=addition, ZCoordinate=deconstruct.ZComponent)
# Build Straight Shank
end_points_2 = EndPoints(Curve=scale_nu.Geometry)  # -> Start, End
mesh_split_plane = MeshSplitPlane(Mesh=move_to_point.Moved, Plane=xz_plane)  # -> Above, Below
xz_plane_2 = XZPlane(Origin=construct_point_3)
insert_items = InsertItems(List=end_points_2.Start, Item=end_points_2.End, Indices=0, Wrap=True)
xz_plane_3 = XZPlane(Origin=move_4.Geometry)
smallest_mesh = SmallestMesh(content=mesh_split_plane.Above, content_2=mesh_split_plane.Below)

# ----
# Build Platform
platform_height_mm = Slider(34, range=0..100)
foot_origin_2 = Point(foot_origin)
platform_width_mm = Slider(36, range=0..100)
platform_width_mm_2 = Slider(42, range=0..100)
division_2 = Division(A=platform_width_mm_2, B=2)
division_3 = Division(A=platform_height_mm, B=2)
division_4 = Division(A=platform_width_mm, B=2)
negative_2 = Negative(Value=division_2)
negative_3 = Negative(Value=division_4)
unit_z_2 = UnitZ(Factor=division_3)
unit_x = UnitX(Factor=[division_2, negative_2])
unit_x_2 = UnitX(Factor=[division_4, negative_3])
move_5 = Move(Geometry=foot_origin_2, Motion=unit_x)  # -> Geometry, Transform
move_6 = Move(Geometry=foot_origin_2, Motion=unit_x_2)  # -> Geometry, Transform
unit_z_3 = UnitZ(Factor=Slider(7, range=0..10))
move_7 = Move(Geometry=move_5.Geometry, Motion=unit_z_3)  # -> Geometry, Transform
list_item_7 = ListItem(List=move_6.Geometry, Index=0, Wrap=True)
list_item_8 = ListItem(List=move_6.Geometry, Index=1, Wrap=True)
move_8 = Move(Geometry=foot_origin_2, Motion=unit_z_2)  # -> Geometry, Transform
list_item_9 = ListItem(List=move_7.Geometry, Index=1, Wrap=True)
list_item_10 = ListItem(List=move_7.Geometry, Index=0, Wrap=True)
nurbs_curve = NurbsCurve(Vertices=[list_item_7, list_item_10, move_8.Geometry, list_item_9, list_item_8], Degree=2, Periodic=False)  # -> Curve, Length, Domain
close_curve = CloseCurve(Curve=nurbs_curve.Curve, CloseType=2, Bulge=0.2, Tolerance=0)  # -> Closed, ResultBoolean
curve_plane_2 = CurvePlane(Curve=close_curve.Closed, Plane=foot_bisection_plane)  # -> Points, ParamsC, ParamsP
deconstruct_2 = Deconstruct(Point=curve_plane_2.Points)  # -> XComponent, YComponent, ZComponent
sort_list = SortList(Keys=deconstruct_2.ZComponent, ValuesValuesA=curve_plane_2.Points)  # -> Keys, ValuesValuesA
list_item_11 = ListItem(List=sort_list.ValuesValuesA, Index=0, Wrap=True)
move_to_point_2 = MoveToPoint(Geometry=close_curve.Closed, PointA=list_item_11, PointB=foot_origin_2)  # -> Moved, Vector, Transform

least_y = LeastY()
most_y = MostY(point=insert_items)
brep_plane_4 = BrepPlane(Brep=mesh_to_polysurface, Plane=xz_plane_2)  # -> Curves, Points
mesh_split_plane_2 = MeshSplitPlane(Mesh=smallest_mesh, Plane=xz_plane_3)  # -> Above, Below
circle = Circle(Plane=most_y, Radius=15)
xz_plane_4 = XZPlane(Origin=most_y)
divide_curve_2 = DivideCurve(Curve=brep_plane_4.Curves, Count=50, Kinks=False)  # -> Points, Tangents, Parameters

# ----
# Forefoot
# Mesh
mesh_2 = Mesh(smallest_mesh)

largest_mesh = LargestMesh(content=mesh_split_plane_2.Above, content_2=mesh_split_plane_2.Below)
project_8 = Project(Geometry=divide_curve_2.Points, Plane=PlaneYZ(0, 0, 0))  # -> Geometry, Transform
project_9 = Project(Geometry=divide_curve_2.Points, Plane=PlaneXY(0, 0, 0))  # -> Geometry, Transform
curve_plane_3 = CurvePlane(Curve=circle, Plane=xz_plane_4)  # -> Points, ParamsC, ParamsP
brep_curve = BrepCurve(Brep=extrude_4, Curve=list_item_6)  # -> Curves, Points
deconstruct_3 = Deconstruct(Point=project_9.Geometry)  # -> XComponent, YComponent, ZComponent
deconstruct_4 = Deconstruct(Point=project_8.Geometry)  # -> XComponent, YComponent, ZComponent
most_x = MostX(point_list=curve_plane_3.Points)
least_x = LeastX(point_list=curve_plane_3.Points)
least_x_2 = LeastX(point_list=brep_curve.Points)
most_x_2 = MostX(point_list=brep_curve.Points)
sort_list_2 = SortList(Keys=deconstruct_3.XComponent, ValuesValuesA=project_9.Geometry)  # -> Keys, ValuesValuesA
sort_list_3 = SortList(Keys=deconstruct_4.ZComponent, ValuesValuesA=project_8.Geometry)  # -> Keys, ValuesValuesA
line_3 = Line(StartPoint=least_x_2, EndPoint=least_x)
line_4 = Line(StartPoint=most_x_2, EndPoint=most_x)
split_with_breps = SplitWithBreps(Curve=list_item_6, Brep=extrude_4)  # -> Curve, Points

# ----
# Plan Profile
mesh_shadow = MeshShadow(Mesh=largest_mesh, Light=Vector(0, 0, 1), Plane=foot_base_plane)

# ----
# Side Profile
mesh_shadow_2 = MeshShadow(Mesh=largest_mesh, Light=Vector(1, 0, 0), Plane=foot_bisection_plane)

list_item_12 = ListItem(List=sort_list_3.ValuesValuesA, Index=0, Wrap=True)
list_item_13 = ListItem(List=sort_list_2.ValuesValuesA, Index=0, Wrap=True)
list_item_14 = ListItem(List=sort_list_2.ValuesValuesA, Index=-1, Wrap=True)
list_item_15 = ListItem(List=sort_list_3.ValuesValuesA, Index=-1, Wrap=True)
divide_curve_3 = DivideCurve(Curve=line_3, Count=20, Kinks=False)  # -> Points, Tangents, Parameters
divide_curve_4 = DivideCurve(Curve=line_4, Count=20, Kinks=False)  # -> Points, Tangents, Parameters
preview_measurement = PreviewMeasurement(start=list_item_13, end=list_item_14)
divide_curve_5 = DivideCurve(Curve=mesh_shadow, Count=400, Kinks=False)  # -> Points, Tangents, Parameters
preview_measurement_2 = PreviewMeasurement(start=list_item_12, end=list_item_15)
divide_curve_6 = DivideCurve(Curve=mesh_shadow_2, Count=400, Kinks=False)  # -> Points, Tangents, Parameters
graph_mapper_2 = GraphMapper(
    divide_curve_3.Parameters,
    x0=0,
    x1=1,
    y0=-1,
    y1=1,
    container_name="Bezier",
    cpx=[0, 0.159441635, 0, 1],
    cpy=[0.5015228987, 0.5297356844, 0.3050661087, 0.5008969307])
graph_mapper_3 = GraphMapper(
    divide_curve_4.Parameters,
    x0=0,
    x1=1,
    y0=-1,
    y1=1,
    container_name="Bezier",
    cpx=[0, 0, 0.4491433203, 1],
    cpy=[0.50220263, 0.5211445093, 0.4125546217, 0.499735415])
deconstruct_5 = Deconstruct(Point=divide_curve_5.Points)  # -> XComponent, YComponent, ZComponent
deconstruct_6 = Deconstruct(Point=divide_curve_6.Points)  # -> XComponent, YComponent, ZComponent
sort_list_4 = SortList(Keys=deconstruct_5.YComponent, ValuesValuesA=divide_curve_5.Points)  # -> Keys, ValuesValuesA
sort_list_5 = SortList(Keys=deconstruct_6.YComponent, ValuesValuesA=divide_curve_6.Points)  # -> Keys, ValuesValuesA

# ----
# Instep Width
distance_4 = Distance(PointA=list_item_13, PointB=list_item_14)

# ----
# Foot Length (mm)
# Foot Length
length_3 = Length(Curve=project_7.Geometry)

# ----
# Instep Height
distance_5 = Distance(PointA=list_item_12, PointB=list_item_15)

unit_x_3 = UnitX(Factor=expr("x*(-40)", graph_mapper_2))
unit_x_4 = UnitX(Factor=expr("x*40", graph_mapper_3))
list_item_16 = ListItem(List=sort_list_4.ValuesValuesA, Index=0, Wrap=True)
list_item_17 = ListItem(List=sort_list_5.ValuesValuesA, Index=0, Wrap=True)
move_9 = Move(Geometry=divide_curve_3.Points, Motion=unit_x_3)  # -> Geometry, Transform
move_10 = Move(Geometry=divide_curve_4.Points, Motion=unit_x_4)  # -> Geometry, Transform
# Build Toebox
brep_brep = BrepBrep(BrepA=extrude_4, BrepB=loft)  # -> Curves, Points
project_10 = Project(Geometry=list_item_16, Plane=foot_bisection_plane)  # -> Geometry, Transform
interpolate_2 = Interpolate(Vertices=move_9.Geometry, Degree=3, Periodic=False, KnotStyle=1)  # -> Curve, Length, Domain
interpolate_3 = Interpolate(Vertices=move_10.Geometry, Degree=3, Periodic=False, KnotStyle=1)  # -> Curve, Length, Domain
end_points_3 = EndPoints(Curve=brep_brep.Curves)  # -> Start, End
distance_6 = Distance(PointA=list_item_17, PointB=project_10.Geometry)
align_curves = AlignCurves(curve_1=interpolate_3.Curve, curve_2=interpolate_2.Curve)
curve_closest_point = CurveClosestPoint(Point=[end_points_3.Start, end_points_3.End], Curve=list_item_6)  # -> Point, Parameter, Distance
unit_z_4 = UnitZ(Factor=[-50, 50])
unit_z_5 = UnitZ(Factor=distance_6)
project_11 = Project(Curve=interpolate_3.Curve, Brep=extrude_4, Direction=Vector(0, 0, 1))
project_12 = Project(Curve=align_curves, Brep=extrude_4, Direction=Vector(0, 0, 1))
shatter = Shatter(Curve=list_item_6, Parameters=simplify(curve_closest_point.Parameter))
extrude_5 = Extrude(Base=circle, Direction=unit_z_4)

# ----
# Plan Profile
# (Height Adjusted)
move_11 = Move(Geometry=mesh_shadow, Motion=unit_z_5)  # -> Geometry, Transform

ruled_surface = RuledSurface(CurveA=project_11, CurveB=project_12)
length_4 = Length(Curve=shatter)
cap_holes_4 = CapHoles(Brep=extrude_5)
length_5 = Length(Curve=split_with_breps.Curve)
unit_z_6 = UnitZ(Factor=[-50, 50])
sort_list_6 = SortList(Keys=length_4, ValuesValuesA=shatter)  # -> Keys, ValuesValuesA
solid_union = SolidUnion(Breps=cap_holes_4)
sort_list_7 = SortList(Keys=length_5, ValuesValuesA=split_with_breps.Curve)  # -> Keys, ValuesValuesA
extrude_6 = Extrude(Base=ruled_surface, Direction=unit_z_6)
longer_curve_segment = ListItem(List=sort_list_6.ValuesValuesA, Index=1, Wrap=True)  # disabled
shorter_curve_segment = ListItem(List=sort_list_6.ValuesValuesA, Index=0, Wrap=True)
list_item_18 = ListItem(List=sort_list_7.ValuesValuesA, Index=0, Wrap=True)
curve_plane_4 = CurvePlane(Curve=move_11.Geometry, Plane=xz_plane)  # -> Points, ParamsC, ParamsP
curve_plane_5 = CurvePlane(Curve=move_11.Geometry, Plane=xz_plane_3)  # -> Points, ParamsC, ParamsP
curve_plane_6 = CurvePlane(Curve=mesh_shadow_2, Plane=xz_plane)  # -> Points, ParamsC, ParamsP
curve_plane_7 = CurvePlane(Curve=mesh_shadow_2, Plane=xz_plane_3)  # -> Points, ParamsC, ParamsP
join_curves = JoinCurves(Curves=flatten([brep_brep.Curves, shorter_curve_segment]), Preserve=False)
solid_union_2 = SolidUnion(Breps=extrude_6)
flip_curve = FlipCurve(Curve=move_to_point_2.Moved)  # -> Curve, Flag
list_item_19 = ListItem(List=curve_closest_point.Point, Index=0, Wrap=True)
extrude_7 = Extrude(Base=list_item_18, Direction=Vector(0, 300, 0))
insert_items_2 = InsertItems(List=curve_plane_5.ParamsC, Item=curve_plane_4.ParamsC, Indices=-1, Wrap=True)
insert_items_3 = InsertItems(List=curve_plane_7.ParamsC, Item=curve_plane_6.ParamsC, Indices=-1, Wrap=True)
rebuild_curve_2 = RebuildCurve(Curve=flip_curve.Curve, Count=50, EndTangents=False)
offset_surface_2 = OffsetSurface(Surface=extrude_7, Distance=-1, BothSides=False, CreateSolid=True)
list_item_20 = ListItem(List=flatten(join_curves), Index=-1, Wrap=True)
solid_union_3 = SolidUnion(Breps=flatten([solid_union_2, solid_union]))
shatter_2 = Shatter(Curve=move_11.Geometry, Parameters=insert_items_2)
shatter_3 = Shatter(Curve=mesh_shadow_2, Parameters=insert_items_3)
align_curve_seams_2 = AlignCurveSeams(Curves=[list_item_20, rebuild_curve_2], Guide=list_item_19, Seam=1, Snap=False, Iterative=True)  # -> Aligned, Points, ResultBoolean
match_text = MatchText(Text=shatter_2, Pattern="*Polyline Curve", Case=False)
match_text_2 = MatchText(Text=shatter_3, Pattern="*Polyline Curve", Case=False)

# ----
# Straight Shank
solid_intersection = SolidIntersection(BrepsA=offset_surface_2, BrepsB=solid_union_3)

cull_pattern_4 = CullPattern(List=shatter_2, CullPattern=match_text)
cull_pattern_5 = CullPattern(List=shatter_3, CullPattern=match_text_2)
shortest = Shortest(curves=align_curve_seams_2.Aligned)
longest = Longest(curves=align_curve_seams_2.Aligned)

# ----
# Plan Profile
# Curves
curve = Curve(cull_pattern_4)

# ----
# NOTE
# Ellipse profile is close but not perfect
# Profiles need to be distorted to square off bottom edge
# Toebox
# Curvature Control
# NOTE
# Curvature should be taken from
# raw 3D scan, either using photo with
# edge detection or with cross-section
# curves through mesh from 3D scan
# Width and Height
# Curvature Control
# Curvature
# Interpolation
# Degree
# NOTE
# Only works at 15 and 20...
# NOTE
# Curvature should be taken from
# raw 3D scan, either using photo with
# edge detection or with cross-section
# curves through mesh from 3D scan
# Gradient Thickness Shell
# Constant Thickness Shell
# Side Profile
# Curves
curve_2 = Curve(cull_pattern_5)

# ----
# Build Toebox Outer Surface
curve_plane_8 = CurvePlane(Curve=shortest, Plane=PlaneXY(0, 0, 0))  # -> Points, ParamsC, ParamsP
brep_plane_5 = BrepPlane(Brep=loft, Plane=PlaneXY(0, 0, 0))  # -> Curves, Points
list_item_21 = ListItem(List=brep_plane_5.Curves, Index=0, Wrap=True)
list_item_22 = ListItem(List=brep_plane_5.Curves, Index=1, Wrap=True)
end_points_4 = EndPoints(Curve=list_item_22)  # -> Start, End
list_item_23 = ListItem(List=curve_plane_8.Points, Index=0, Wrap=True)
end_points_5 = EndPoints(Curve=list_item_21)  # -> Start, End
list_item_24 = ListItem(List=curve_plane_8.Points, Index=1, Wrap=True)
offset_surface_3 = OffsetSurface(Surface=flatten(loft), Distance=-1, BothSides=False, CreateSolid=True)

# ----
# Inner Surface
# Thickened
solid_intersection_2 = SolidIntersection(BrepsA=offset_surface, BrepsB=offset_surface_3)

move_to_point_3 = MoveToPoint(Geometry=list_item_21, PointA=end_points_5.End, PointB=list_item_24)  # -> Moved, Vector, Transform
move_to_point_4 = MoveToPoint(Geometry=list_item_22, PointA=end_points_4.Start, PointB=list_item_23)  # -> Moved, Vector, Transform
project_13 = Project(Geometry=end_points_5.End, Plane=PlaneXZ(0, 0, 0))  # -> Geometry, Transform
project_14 = Project(Geometry=end_points_5.Start, Plane=PlaneXZ(0, 0, 0))  # -> Geometry, Transform
project_15 = Project(Geometry=end_points_4.Start, Plane=PlaneXZ(0, 0, 0))  # -> Geometry, Transform
project_16 = Project(Geometry=end_points_4.End, Plane=PlaneXZ(0, 0, 0))  # -> Geometry, Transform
curve_plane_9 = CurvePlane(Curve=shorter_curve_segment, Plane=foot_bisection_plane)  # -> Points, ParamsC, ParamsP
curve_plane_10 = CurvePlane(Curve=flip_curve.Curve, Plane=foot_bisection_plane)  # -> Points, ParamsC, ParamsP
distance_7 = Distance(PointA=project_13.Geometry, PointB=project_14.Geometry)
distance_8 = Distance(PointA=list_item_24, PointB=project_14.Geometry)
distance_9 = Distance(PointA=list_item_23, PointB=project_16.Geometry)
distance_10 = Distance(PointA=project_15.Geometry, PointB=project_16.Geometry)
deconstruct_7 = Deconstruct(Point=curve_plane_10.Points)  # -> XComponent, YComponent, ZComponent
division_5 = Division(A=distance_8, B=distance_7)
division_6 = Division(A=distance_9, B=distance_10)
sort_list_8 = SortList(Keys=deconstruct_7.ZComponent, ValuesValuesA=curve_plane_10.Points)  # -> Keys, ValuesValuesA

# ----
# Inner Surface + Shank
solid_union_4 = SolidUnion(Breps=flatten([solid_intersection_2, solid_intersection]))

list_item_25 = ListItem(List=sort_list_8.ValuesValuesA, Index=0, Wrap=True)
plane_origin = PlaneOrigin(Base=PlaneXY(0, 0, 0), Origin=list_item_23)
plane_origin_2 = PlaneOrigin(Base=PlaneXY(0, 0, 0), Origin=list_item_24)

# ----
# Guide Curve
# on Base Plane
line_5 = Line(StartPoint=curve_plane_9.Points, EndPoint=list_item_25)  # -> simplify(Line)

scale_nu_3 = ScaleNU(Geometry=move_to_point_4.Moved, Plane=plane_origin, ScaleX=division_6, ScaleY=1, ScaleZ=1)  # -> Geometry, Transform
scale_nu_4 = ScaleNU(Geometry=move_to_point_3.Moved, Plane=plane_origin_2, ScaleX=division_5, ScaleY=1, ScaleZ=1)  # -> Geometry, Transform
number_slider_2 = Slider(50, range=0..100)
flip_curve_2 = FlipCurve(Curve=scale_nu_3.Geometry)  # -> Curve, Flag
divide_curve_7 = DivideCurve(Curve=scale_nu_4.Geometry, Count=number_slider_2, Kinks=False)  # -> Points, Tangents, Parameters
divide_curve_8 = DivideCurve(Curve=flip_curve_2.Curve, Count=number_slider_2, Kinks=False)  # -> Points, Tangents, Parameters
rebuild_curve_3 = RebuildCurve(Curve=scale_nu_4.Geometry, Count=10, Degree=4, EndTangents=True)  # disabled
interpolate_4 = Interpolate(Vertices=divide_curve_7.Points, Degree=3, Periodic=False, KnotStyle=1)  # -> Curve, Length, Domain
interpolate_5 = Interpolate(Vertices=divide_curve_8.Points, Degree=3, Periodic=False, KnotStyle=1)  # -> Curve, Length, Domain
insert_items_4 = InsertItems(List=interpolate_5.Curve, Item=interpolate_4.Curve, Indices=1, Wrap=True)
flip_curve_3 = FlipCurve(Curve=longest)  # -> Curve, Flag

# ----
# TBC
insert_items_5 = InsertItems(List=insert_items_4, Item=line_5, Indices=1, Wrap=True)
reverse_list = ReverseList(List=insert_items_4)

# ----
# Outer Surface
sweep2 = Sweep2(Rail1=shortest, Rail2=flip_curve_3.Curve, Sections=reverse_list, SameHeight=False)

number_slider_3 = Slider(4, range=0..10)  # disabled
number_slider_4 = Slider(20, range=0..100)  # disabled
offset_surface_4 = OffsetSurface(Surface=sweep2, Distance=1, BothSides=False, CreateSolid=True)
rebuild_surface = RebuildSurface(Surface=sweep2, CountU=number_slider_4, CountV=number_slider_4, DegreeU=number_slider_3, DegreeV=number_slider_3)  # disabled

# ----
# Outer Surface
# Thickened
solid_union_5 = SolidUnion(Breps=flatten(offset_surface_4))

solid_union_6 = SolidUnion(Breps=flatten([solid_union_4, solid_union_5]))
# BOOLEAN
# TOE CAP
# Fillet Outer Edge
# of Toebox
cap_holes_5 = CapHoles(Brep=rebuild_surface)  # disabled

# ----
# Bending the Shank
# Original Shank Out
# Shank Length In
# Curved Shank Out
end_points_6 = EndPoints(Curve=scale_nu.Geometry)  # -> Start, End
line_6 = Line(StartPoint=end_points_6.Start, EndPoint=end_points_6.End)
divide_curve_9 = DivideCurve(Curve=line_6, Count=15, Kinks=False)  # -> Points, Tangents, Parameters

# ----
# Shank
# Curvature Control
graph_mapper_4 = GraphMapper(
    divide_curve_9.Parameters,
    x0=0,
    x1=1,
    y0=0,
    y1=1,
    container_name="Bezier",
    cpx=[0, 0.6294739246, 0.8841106296, 1],
    cpy=[0, 0.008542716503, 0.05280476809, 0.7957516909])

multiplication_2 = Multiplication(A=graph_mapper_4, B=Slider(39, range=30..60))
unit_z_7 = UnitZ(Factor=expr("x*-1", multiplication_2))
move_12 = Move(Geometry=divide_curve_9.Points, Motion=unit_z_7)  # -> Geometry, Transform
interpolate_6 = Interpolate(Vertices=move_12.Geometry, Degree=3, Periodic=False, KnotStyle=1)  # -> Curve, Length, Domain

# ----
# Full Curved Component
flow = Flow(
    Geometry=solid_union_4,
    Base=scale_nu.Geometry,
    Target=interpolate_6.Curve,
    ReverseBase=False,
    ReverseTarget=False,
    Stretch=True,
    Rigid=False)

# ==== cluster LargestMesh
content = ClusterInput()
content_2 = ClusterInput()
bounding_box = BoundingBox(Content=content, Plane=PlaneXY(0, 0, 0))  # -> Box, Box_2
bounding_box_2 = BoundingBox(Content=content_2, Plane=PlaneXY(0, 0, 0))  # -> Box, Box_2
volume = Volume(Geometry=bounding_box.Box)  # -> Volume, Centroid
volume_2 = Volume(Geometry=bounding_box_2.Box)  # -> Volume, Centroid
insert_items = InsertItems(List=content, Item=content_2, Indices=0, Wrap=True)
insert_items_2 = InsertItems(List=volume.Volume, Item=volume_2.Volume, Indices=0, Wrap=True)
sort_list = SortList(Keys=insert_items_2, ValuesValuesA=insert_items)  # -> Keys, ValuesValuesA
list_item = ListItem(List=sort_list.ValuesValuesA, Index=-1, Wrap=True)
largest_mesh = ClusterOutput(list_item)

# ==== cluster SmallestMesh
content = ClusterInput()
content_2 = ClusterInput()
bounding_box = BoundingBox(Content=content, Plane=PlaneXY(0, 0, 0))  # -> Box, Box_2
bounding_box_2 = BoundingBox(Content=content_2, Plane=PlaneXY(0, 0, 0))  # -> Box, Box_2
volume = Volume(Geometry=bounding_box.Box)  # -> Volume, Centroid
volume_2 = Volume(Geometry=bounding_box_2.Box)  # -> Volume, Centroid
insert_items = InsertItems(List=content, Item=content_2, Indices=0, Wrap=True)
insert_items_2 = InsertItems(List=volume.Volume, Item=volume_2.Volume, Indices=0, Wrap=True)
sort_list = SortList(Keys=insert_items_2, ValuesValuesA=insert_items)  # -> Keys, ValuesValuesA
list_item = ListItem(List=sort_list.ValuesValuesA, Index=0, Wrap=True)
smallest_mesh = ClusterOutput(list_item)  # Extracts the Smallest (by volume) mesh out of 2 inputs

# ==== cluster ExtractToeTip
point = ClusterInput()
deconstruct = Deconstruct(Point=point)  # -> XComponent, YComponent, ZComponent
sort_list = SortList(Keys=deconstruct.YComponent, ValuesValuesA=point)  # -> Keys, ValuesValuesA
list_item = ListItem(List=sort_list.ValuesValuesA, Index=-1, Wrap=True)
tip_of_big_toe = ClusterOutput(list_item)  # NOTE: May give an error if 2nd toe is longer than big toe

# ==== cluster PreviewMeasurement
end = ClusterInput()
start = ClusterInput()
visualisation = Line(StartPoint=start, EndPoint=end)
distance = Distance(PointA=start, PointB=end)
divide_curve = DivideCurve(Curve=visualisation, Count=2, Kinks=False)  # -> Points, Tangents, Parameters
round_to_decimal_place = RoundToDecimalPlace(NumberX=distance, DecimalPlace=3, RoundType=0)  # -> Rounded, Difference
unit_y = UnitY(Factor=3)
list_item = ListItem(List=divide_curve.Points, Index=1, Wrap=True)
move = Move(Geometry=list_item, Motion=unit_y)  # -> Geometry, Transform
text_tag_3d = TextTag3D(Location=move.Geometry, Text=round_to_decimal_place.Rounded, Size=2, Justification=5)

# ==== cluster CheckExtrudeDirection
surface = ClusterInput()
offset_surface = OffsetSurface(Surface=surface, Distance=20, Retrim=True)
area = Area(Geometry=offset_surface)  # -> Area, Centroid
# Welcome to my Ted Talk
# This cluster ensures that the extruded surface
# is extruded in the right direction
area_2 = Area(Geometry=surface)  # -> Area, Centroid
deconstruct = Deconstruct(Point=area.Centroid)  # -> XComponent, YComponent, ZComponent
deconstruct_2 = Deconstruct(Point=area_2.Centroid)  # -> XComponent, YComponent, ZComponent
number = Number(100)
larger_than = LargerThan(FirstNumber=deconstruct_2.ZComponent, SecondNumber=deconstruct.ZComponent)  # -> LargerThan, OrEqualTo
negative = Negative(Value=number)
expression = Expression(x=larger_than.OrEqualTo, y=number, z=negative, Expression="If(x,y,z)")
result = ClusterOutput(expression)

# ==== cluster MostX
point_list = ClusterInput()
deconstruct = Deconstruct(Point=point_list)  # -> XComponent, YComponent, ZComponent
sort_list = SortList(Keys=deconstruct.XComponent, ValuesValuesA=point_list)  # -> Keys, ValuesValuesA
reverse_list = ReverseList(List=sort_list.ValuesValuesA)
list_item = ListItem(List=reverse_list, Index=0, Wrap=True)
point = ClusterOutput(list_item)

# ==== cluster LeastX
point_list = ClusterInput()
deconstruct = Deconstruct(Point=point_list)  # -> XComponent, YComponent, ZComponent
sort_list = SortList(Keys=deconstruct.XComponent, ValuesValuesA=point_list)  # -> Keys, ValuesValuesA
list_item = ListItem(List=sort_list.ValuesValuesA, Index=0, Wrap=True)
point = ClusterOutput(list_item)

# ==== cluster LeastY
point = ClusterInput()
deconstruct = Deconstruct(Point=point)  # -> XComponent, YComponent, ZComponent
sort_list = SortList(Keys=deconstruct.YComponent, ValuesValuesA=point)  # -> Keys, ValuesValuesA
list_item = ListItem(List=sort_list.ValuesValuesA, Index=0, Wrap=True)
point_2 = ClusterOutput(list_item)

# ==== cluster MostY
point = ClusterInput()
deconstruct = Deconstruct(Point=point)  # -> XComponent, YComponent, ZComponent
sort_list = SortList(Keys=deconstruct.YComponent, ValuesValuesA=point)  # -> Keys, ValuesValuesA
reverse_list = ReverseList(List=sort_list.ValuesValuesA)
list_item = ListItem(List=reverse_list, Index=0, Wrap=True)
point_2 = ClusterOutput(list_item)

# ==== cluster AlignCurves
curve_1 = ClusterInput()
curve_2 = ClusterInput()
end_points = EndPoints(Curve=curve_1)  # -> Start, End
end_points_2 = EndPoints(Curve=curve_2)  # -> Start, End
deconstruct = Deconstruct(Point=end_points.Start)  # -> XComponent, YComponent, ZComponent
deconstruct_2 = Deconstruct(Point=end_points_2.Start)  # -> XComponent, YComponent, ZComponent
round = Round(Number=deconstruct.YComponent)  # -> Nearest, Floor, Ceiling
round_2 = Round(Number=deconstruct_2.YComponent)  # -> Nearest, Floor, Ceiling
equality = Equality(FirstNumber=round.Nearest, SecondNumber=round_2.Nearest)  # -> Equality, Inequality
flip_curve = FlipCurve(Curve=curve_2)  # -> Curve, Flag
expression = Expression(x=equality.Equality, y="0", z="1", Expression="If(x,y,z)")
insert_items = InsertItems(List=curve_2, Item=flip_curve.Curve, Indices=1, Wrap=True)
list_item = ListItem(List=insert_items, Index=expression, Wrap=True)
aligned_curve = ClusterOutput(list_item)

# ==== cluster Shortest
curves = ClusterInput()
length = Length(Curve=flatten(curves))
sort_list = SortList(Keys=length, ValuesValuesA=flatten(curves))  # -> Keys, ValuesValuesA
list_item = ListItem(List=sort_list.ValuesValuesA, Index=0, Wrap=True)
shortest_curve = ClusterOutput(list_item)

# ==== cluster Longest
curves = ClusterInput()
length = Length(Curve=flatten(curves))
sort_list = SortList(Keys=length, ValuesValuesA=flatten(curves))  # -> Keys, ValuesValuesA
list_item = ListItem(List=sort_list.ValuesValuesA, Index=-1, Wrap=True)
longest = ClusterOutput(list_item)
