# Grasshopper definition 130521 component.gh (Grasshopper 1.0.7)
# plug-ins: Pufferfish

# ----
# SCAN IN ->
mesh = Mesh(<mesh referenced from the Rhino model>)

c_script = CSharpScript(test=Button())  # -> reverse(out), A
# ---------- c_script: C# ----------
    var activeObjects = GrasshopperDocument.ActiveObjects(); // get all active objects

    var results = new Dictionary<string, double>();
    for (int i = 0; i < activeObjects.Count; i++) // for each active object...
    {
      IGH_ActiveObject ao = activeObjects[i] as IGH_ActiveObject;
      results.Add(string.Format("{0} {1}", i, ao.NickName), ao.ProcessorTime.Milliseconds); // ...store its time and name...
    }

    foreach (KeyValuePair<string, double> result in results.OrderBy(v => v.Value)) // ...and sort the collection...
    {
      Print("{0}\n   {1} ms", result.Key, result.Value); // ...to get the winner
    }
# ---------- end c_script ----------

# ----
# Radius/Edge Length
number_slider = Slider(100, range=0..100)  # disabled

deconstruct_mesh = DeconstructMesh(Mesh=mesh)  # -> Vertices, Faces, Colours, Normals
panel = Panel(c_script.out)

# ----
# EXPERIMENTAL
extract_toe_tip = ExtractToeTip(point=deconstruct_mesh.Vertices)
extract_heel = ExtractHeel(point=deconstruct_mesh.Vertices)

point_list = PointList(Points=deconstruct_mesh.Vertices)  # disabled
list_item = ListItem(List=deconstruct_mesh.Vertices, Index=2420, Wrap=True)  # disabled
move_to_point = MoveToPoint(Geometry=mesh, PointA=extract_toe_tip, PointB=Point(0, 0, 0))  # -> Moved, Vector, Transform
mesh_to_polysurface = MeshToPolysurface(Mesh=move_to_point.Moved, Triangles=False, FaceMerge=False)
deconstruct_mesh_2 = DeconstructMesh(Mesh=move_to_point.Moved)  # -> Vertices, Faces, Colours, Normals
# Bisect the Foot
brep_plane = BrepPlane(Brep=mesh_to_polysurface, Plane=PlaneYZ(0, 0, 0))  # -> Curves, Points
# Generate 'Base' Plane
brep_plane_2 = BrepPlane(Brep=mesh_to_polysurface, Plane=PlaneXY(0, 0, 0))  # -> Curves, Points
# Set Shank Length to 85% of Footbase
tip_of_big_toe = ListItem(List=deconstruct_mesh_2.Vertices, Index=2420, Wrap=True)
back_of_heel = ListItem(List=deconstruct_mesh_2.Vertices, Index=2027, Wrap=True)
deconstruct_brep = DeconstructBrep(Brep=mesh_to_polysurface)  # -> Faces, Edges, Vertices
line = Line(StartPoint=extract_toe_tip, EndPoint=extract_heel)
offset_curve = OffsetCurve(Curve=brep_plane_2.Curves, Distance=-5, Plane=PlaneXY(0, 0, 0), Corners=2)
offset_curve_2 = OffsetCurve(Curve=brep_plane.Curves, Distance=-1, Plane=PlaneYZ(0, 0, 0), Corners=3)
extrude = Extrude(Base=offset_curve, Direction=Vector(0, 0, -30))
extrude_2 = Extrude(Base=offset_curve_2, Direction=Vector(-70, 0, 0))
extrude_3 = Extrude(Base=offset_curve_2, Direction=Vector(70, 0, 0))
cap_holes = CapHoles(Brep=extrude)
cap_holes_2 = CapHoles(Brep=extrude_2)
cap_holes_3 = CapHoles(Brep=extrude_3)
point_in_brep = PointInBrep(Brep=cap_holes, Point=deconstruct_brep.Vertices, Strict=False)
point_in_brep_2 = PointInBrep(Brep=cap_holes_3, Point=deconstruct_brep.Vertices, Strict=False)
point_in_brep_3 = PointInBrep(Brep=cap_holes_2, Point=deconstruct_brep.Vertices, Strict=False)
cull_pattern = CullPattern(List=deconstruct_brep.Vertices, CullPattern=point_in_brep)
project = Project(Geometry=cull_pattern, Plane=PlaneXY(0, 0, 0))  # -> Geometry, Transform
cull_pattern_2 = CullPattern(List=deconstruct_brep.Vertices, CullPattern=point_in_brep_3)
cull_pattern_3 = CullPattern(List=deconstruct_brep.Vertices, CullPattern=point_in_brep_2)
project_2 = Project(Geometry=cull_pattern_3, Plane=PlaneYZ(0, 0, 0))  # -> Geometry, Transform
project_3 = Project(Geometry=cull_pattern_2, Plane=PlaneYZ(0, 0, 0))  # -> Geometry, Transform
distance = Distance(PointA=project.Geometry, PointB=cull_pattern)
number_slider_2 = Slider(20, range=0..100)
average = Average(Input=distance)
distance_2 = Distance(PointA=cull_pattern_2, PointB=project_3.Geometry)
distance_3 = Distance(PointA=cull_pattern_3, PointB=project_2.Geometry)
division = Division(A=number_slider_2, B=2)
average_2 = Average(Input=distance_2)
average_3 = Average(Input=distance_3)
negative = Negative(Value=average)
series = Series(Start=0, Step=1, Count=division)
tip_of_big_toe_2 = ListItem(List=deconstruct_mesh_2.Vertices, Index=2420, Wrap=True)  # disabled
back_of_heel_2 = ListItem(List=deconstruct_mesh_2.Vertices, Index=2027, Wrap=True)  # disabled
average_4 = Average(Input=[average_2, average_3])
subtraction = Subtraction(A=average_3, B=average_4)
construct_point = ConstructPoint(XCoordinate=subtraction, YCoordinate=0, ZCoordinate=0)
construct_point_2 = ConstructPoint(XCoordinate=subtraction, YCoordinate=0, ZCoordinate=negative)
# 1D Measurement Extraction
line_2 = Line(StartPoint=extract_toe_tip, EndPoint=extract_heel)  # disabled

# ----
# ORIGIN OUT
foot_origin = ConstructPoint(XCoordinate=subtraction, YCoordinate=0, ZCoordinate=negative)

# ----
# BASE PLANE OUT
foot_base_plane = XYPlane(Origin=construct_point_2)

# ----
# BISECTION PLANE OUT
foot_bisection_plane = YZPlane(Origin=construct_point)

project_4 = Project(Geometry=line, Plane=foot_bisection_plane)  # -> Geometry, Transform
project_5 = Project(Geometry=project_4.Geometry, Plane=foot_base_plane)  # -> Geometry, Transform
scale_nu = ScaleNU(Geometry=project_5.Geometry, Plane=foot_base_plane, ScaleX=1, ScaleY=0.85, ScaleZ=1)  # -> Geometry, Transform
# Side Profile Cutting Line
divide_curve = DivideCurve(Curve=scale_nu.Geometry, Count=20, Kinks=False)  # -> Points, Tangents, Parameters
graph_mapper = GraphMapper(
    divide_curve.Parameters,
    x0=0,
    x1=1,
    y0=0,
    y1=1,
    container_name="Bezier",
    cpx=[0, 0.3863660097, 0.3824808896, 1],
    cpy=[1, 0, 0, 0])
# Extract Instep Cross-Section
perp_frames = PerpFrames(Curve=scale_nu.Geometry, Count=number_slider_2, Align=True)  # -> Frames, Parameters
list_item_2 = ListItem(List=perp_frames.Frames, Index=series, Wrap=True)
brep_plane_3 = BrepPlane(Brep=mesh_to_polysurface, Plane=list_item_2)  # -> Curves, Points
unit_z = UnitZ(Factor=graph_mapper)
offset_curve_3 = OffsetCurve(Curve=brep_plane_3.Curves, Distance=-1, Plane=PlaneXZ(0, 0, 0), Corners=1)
multiplication = Multiplication(A=unit_z, B=100)
list_item_3 = ListItem(List=flatten(brep_plane_3.Curves), Index=1, Wrap=True)
move = Move(Geometry=divide_curve.Points, Motion=multiplication)  # -> Geometry, Transform
curve_plane = CurvePlane(Curve=list_item_3, Plane=PlaneXY(0, 0, 0))  # -> Points, ParamsC, ParamsP
rebuild_curve = RebuildCurve(Curve=brep_plane_3.Curves, Degree=2, Count=50, Tangents=False)  # -> simplify(Curve)
close_curve = CloseCurve(Curve=flatten(rebuild_curve), CloseType=0, Bulge=0.5, Tolerance=0)  # -> Closed, graft(ResultBoolean)
list_item_4 = ListItem(List=curve_plane.Points, Index=0, Wrap=True)
interpolate = Interpolate(Vertices=move.Geometry, Degree=3, Periodic=False, KnotStyle=1)  # -> Curve, Length, Domain
invert_boolean = InvertBoolean(Boolean=close_curve.ResultBoolean)  # -> Inverted, Number
cull_pattern_4 = CullPattern(List=rebuild_curve, CullPattern=invert_boolean.Inverted)  # -> flatten(List)
align_curve_seams = AlignCurveSeams(Curves=cull_pattern_4, Guide=list_item_4, Seam=1, Snap=False, Iterative=True)  # -> Aligned, Points, ResultBoolean
move_2 = Move(Geometry=interpolate.Curve, Motion=Vector(100, 0, 0))  # -> Geometry, Transform
project_6 = Project(Geometry=line_2, Plane=foot_bisection_plane)  # -> Geometry, Transform; disabled

# ----
# Cutting Plane
extrude_4 = Extrude(Base=move_2.Geometry, Direction=Vector(-200, 0, 0))

# ----
# Inner Surface
loft = Loft(
    Curves=flatten(align_curve_seams.Aligned),
    Options={Adjust=False, Closed=False, LoftEnds=0, LoftSimp=0, LoftType=0, Rebuild=10, Refit=0.01})

list_item_5 = ListItem(List=flatten(align_curve_seams.Aligned), Index=0, Wrap=True)
list_item_6 = ListItem(List=flatten(align_curve_seams.Aligned), Index=-1, Wrap=True)
# 2D Profile Extraction
# Select Forefoot Only
length = Length(Curve=project_5.Geometry)  # disabled

# ----
# Foot Length
project_7 = Project(Geometry=project_6.Geometry, Plane=foot_base_plane)  # -> Geometry, Transform; disabled

remove_null = RemoveNull(item=extrude_4)
unit_y = UnitY(Factor=expr("x/3", length))  # disabled
scale_nu_2 = ScaleNU(Geometry=project_7.Geometry, Plane=foot_base_plane, ScaleX=1, ScaleY=0.85, ScaleZ=1)  # -> Geometry, Transform; disabled
length_2 = Length(Curve=project_6.Geometry)  # -> expr("x/3", Length); disabled
split_brep = SplitBrep(Brep=loft, Cutter=remove_null)
move_3 = Move(Geometry=foot_origin, Motion=unit_y)  # -> Geometry, Transform; disabled
check_extrude_direction = CheckExtrudeDirection(surface=remove_null)  # disabled
end_points = EndPoints(Curve=scale_nu_2.Geometry)  # -> Start, End; disabled
area = Area(Geometry=split_brep)  # -> Area, Centroid
xz_plane = XZPlane(Origin=move_3.Geometry)  # disabled
deconstruct = Deconstruct(Point=end_points.Start)  # -> XComponent, YComponent, ZComponent; disabled

# ----
# Cutting Brep
# For Intersections
offset_surface = OffsetSurface(Surface=remove_null, Distance=check_extrude_direction, BothSides=False, CreateSolid=True)  # disabled

move_4 = Move(Geometry=foot_origin, Motion=Vector(0, 5, 0))  # -> Geometry, Transform; disabled
sort_list = SortList(Keys=area.Area, ValuesValuesA=split_brep)  # -> Keys, ValuesValuesA
addition = Addition(A=deconstruct.YComponent, B=length_2)  # disabled
mesh_split_plane = MeshSplitPlane(Mesh=move_to_point.Moved, Plane=xz_plane)  # -> Above, Below; disabled
construct_point_3 = ConstructPoint(XCoordinate=deconstruct.XComponent, YCoordinate=addition, ZCoordinate=deconstruct.ZComponent)  # disabled
xz_plane_2 = XZPlane(Origin=move_4.Geometry)  # disabled
smallest_mesh = SmallestMesh(content=mesh_split_plane.Above, content_2=mesh_split_plane.Below)  # disabled
# For Analysis
list_item_7 = ListItem(List=reverse(sort_list.ValuesValuesA), Index=0, Wrap=True)
# Build Straight Shank
end_points_2 = EndPoints(Curve=scale_nu.Geometry)  # -> Start, End; disabled
circle_cnr = CircleCNR(Center=construct_point_3, Normal=Vector(0, 1, 0), Radius=100)  # -> flatten(Circle); disabled
xz_plane_3 = XZPlane(Origin=construct_point_3)  # disabled
mesh_split_plane_2 = MeshSplitPlane(Mesh=smallest_mesh, Plane=xz_plane_2)  # -> Above, Below; disabled
insert_items = InsertItems(List=end_points_2.Start, Item=end_points_2.End, Indices=0, Wrap=True)  # disabled

# ----
# Build Platform
platform_height_mm = Slider(34, range=0..100)
foot_origin_2 = Point(foot_origin)
platform_width_mm = Slider(36, range=0..100)
platform_width_mm_2 = Slider(42, range=0..100)
division_2 = Division(A=platform_width_mm_2, B=2)
division_3 = Division(A=platform_height_mm, B=2)
division_4 = Division(A=platform_width_mm, B=2)
negative_2 = Negative(Value=division_2)
negative_3 = Negative(Value=division_4)
unit_z_2 = UnitZ(Factor=division_3)
unit_x = UnitX(Factor=[division_2, negative_2])
unit_x_2 = UnitX(Factor=[division_4, negative_3])
move_5 = Move(Geometry=foot_origin_2, Motion=unit_x)  # -> Geometry, Transform
move_6 = Move(Geometry=foot_origin_2, Motion=unit_x_2)  # -> Geometry, Transform
unit_z_3 = UnitZ(Factor=Slider(7, range=0..10))
move_7 = Move(Geometry=move_5.Geometry, Motion=unit_z_3)  # -> Geometry, Transform
list_item_8 = ListItem(List=move_6.Geometry, Index=0, Wrap=True)
list_item_9 = ListItem(List=move_6.Geometry, Index=1, Wrap=True)
move_8 = Move(Geometry=foot_origin_2, Motion=unit_z_2)  # -> Geometry, Transform
list_item_10 = ListItem(List=move_7.Geometry, Index=1, Wrap=True)
list_item_11 = ListItem(List=move_7.Geometry, Index=0, Wrap=True)
nurbs_curve = NurbsCurve(Vertices=[list_item_8, list_item_11, move_8.Geometry, list_item_10, list_item_9], Degree=2, Periodic=False)  # -> Curve, Length, Domain
close_curve_2 = CloseCurve(Curve=nurbs_curve.Curve, CloseType=2, Bulge=0.2, Tolerance=0)  # -> Closed, ResultBoolean
curve_plane_2 = CurvePlane(Curve=close_curve_2.Closed, Plane=foot_bisection_plane)  # -> Points, ParamsC, ParamsP
deconstruct_2 = Deconstruct(Point=curve_plane_2.Points)  # -> XComponent, YComponent, ZComponent
sort_list_2 = SortList(Keys=deconstruct_2.ZComponent, ValuesValuesA=curve_plane_2.Points)  # -> Keys, ValuesValuesA
list_item_12 = ListItem(List=sort_list_2.ValuesValuesA, Index=0, Wrap=True)
move_to_point_2 = MoveToPoint(Geometry=close_curve_2.Closed, PointA=list_item_12, PointB=foot_origin_2)  # -> Moved, Vector, Transform

boundary_surfaces = BoundarySurfaces(Edges=circle_cnr)  # disabled

# ----
# Forefoot
# Mesh
mesh_2 = Mesh(smallest_mesh)  # disabled

brep_plane_4 = BrepPlane(Brep=mesh_to_polysurface, Plane=xz_plane_3)  # -> Curves, Points; disabled
least_y = LeastY()  # disabled
most_y = MostY(point=insert_items)  # disabled
largest_mesh = LargestMesh(content=mesh_split_plane_2.Above, content_2=mesh_split_plane_2.Below)  # disabled
split_brep_2 = SplitBrep(Brep=mesh_to_polysurface, Cutter=boundary_surfaces)  # disabled
divide_curve_2 = DivideCurve(Curve=brep_plane_4.Curves, Count=50, Kinks=False)  # -> Points, Tangents, Parameters; disabled
circle = Circle(Plane=most_y, Radius=15)  # disabled
xz_plane_4 = XZPlane(Origin=most_y)  # disabled
area_2 = Area(Geometry=split_brep_2)  # -> Area, Centroid; disabled
project_8 = Project(Geometry=divide_curve_2.Points, Plane=PlaneYZ(0, 0, 0))  # -> Geometry, Transform; disabled
project_9 = Project(Geometry=divide_curve_2.Points, Plane=PlaneXY(0, 0, 0))  # -> Geometry, Transform; disabled
curve_plane_3 = CurvePlane(Curve=circle, Plane=xz_plane_4)  # -> Points, ParamsC, ParamsP; disabled
sort_list_3 = SortList(Keys=area_2.Area, ValuesValuesA=split_brep_2)  # -> Keys, ValuesValuesA; disabled
brep_curve = BrepCurve(Brep=remove_null, Curve=list_item_6)  # -> Curves, Points; disabled
deconstruct_3 = Deconstruct(Point=project_9.Geometry)  # -> XComponent, YComponent, ZComponent; disabled
deconstruct_4 = Deconstruct(Point=project_8.Geometry)  # -> XComponent, YComponent, ZComponent; disabled
list_item_13 = ListItem(List=flatten(remove_null), Index=1, Wrap=True)  # disabled
most_x = MostX(point_list=curve_plane_3.Points)  # disabled
least_x = LeastX(point_list=curve_plane_3.Points)  # disabled
list_item_14 = ListItem(List=sort_list_3.ValuesValuesA, Index=0, Wrap=True)  # disabled
split_brep_3 = SplitBrep(Brep=list_item_14, Cutter=remove_null)  # disabled

# ----
# Plan Profile
mesh_shadow = MeshShadow(Mesh=largest_mesh, Light=Vector(0, 0, 1), Plane=foot_base_plane)  # disabled

# ----
# Side Profile
mesh_shadow_2 = MeshShadow(Mesh=largest_mesh, Light=Vector(1, 0, 0), Plane=foot_bisection_plane)  # disabled

least_x_2 = LeastX(point_list=brep_curve.Points)  # disabled
most_x_2 = MostX(point_list=brep_curve.Points)  # disabled
sort_list_4 = SortList(Keys=deconstruct_3.XComponent, ValuesValuesA=project_9.Geometry)  # -> Keys, ValuesValuesA; disabled
sort_list_5 = SortList(Keys=deconstruct_4.ZComponent, ValuesValuesA=project_8.Geometry)  # -> Keys, ValuesValuesA; disabled
divide_curve_3 = DivideCurve(Curve=mesh_shadow, Count=400, Kinks=False)  # -> Points, Tangents, Parameters; disabled
area_3 = Area(Geometry=split_brep_3)  # -> Area, Centroid; disabled
divide_curve_4 = DivideCurve(Curve=mesh_shadow_2, Count=400, Kinks=False)  # -> Points, Tangents, Parameters; disabled
line_3 = Line(StartPoint=least_x_2, EndPoint=least_x)  # disabled
line_4 = Line(StartPoint=most_x_2, EndPoint=most_x)  # disabled
split_with_breps = SplitWithBreps(Curve=list_item_6, Brep=remove_null)  # -> Curve, Points; disabled
list_item_15 = ListItem(List=sort_list_5.ValuesValuesA, Index=0, Wrap=True)  # disabled
list_item_16 = ListItem(List=sort_list_4.ValuesValuesA, Index=0, Wrap=True)  # disabled
list_item_17 = ListItem(List=sort_list_4.ValuesValuesA, Index=-1, Wrap=True)  # disabled
list_item_18 = ListItem(List=sort_list_5.ValuesValuesA, Index=-1, Wrap=True)  # disabled
divide_curve_5 = DivideCurve(Curve=line_3, Count=20, Kinks=False)  # -> Points, Tangents, Parameters; disabled
deconstruct_5 = Deconstruct(Point=divide_curve_3.Points)  # -> XComponent, YComponent, ZComponent; disabled
divide_curve_6 = DivideCurve(Curve=line_4, Count=20, Kinks=False)  # -> Points, Tangents, Parameters; disabled
deconstruct_6 = Deconstruct(Point=divide_curve_4.Points)  # -> XComponent, YComponent, ZComponent; disabled
sort_list_6 = SortList(Keys=area_3.Area, ValuesValuesA=split_brep_3)  # -> Keys, flatten(ValuesValuesA); disabled
preview_measurement = PreviewMeasurement(start=list_item_16, end=list_item_17)  # disabled
preview_measurement_2 = PreviewMeasurement(start=list_item_15, end=list_item_18)  # disabled
graph_mapper_2 = GraphMapper(
    divide_curve_5.Parameters,
    x0=0,
    x1=1,
    y0=-1,
    y1=1,
    container_name="Bezier",
    cpx=[0, 0.159441635, 0, 1],
    cpy=[0.5015228987, 0.5297356844, 0.3050661087, 0.5008969307])  # disabled
sort_list_7 = SortList(Keys=deconstruct_5.YComponent, ValuesValuesA=divide_curve_3.Points)  # -> Keys, ValuesValuesA; disabled
list_item_19 = ListItem(List=reverse(sort_list_6.ValuesValuesA), Index=0, Wrap=True)  # disabled
sort_list_8 = SortList(Keys=deconstruct_6.YComponent, ValuesValuesA=divide_curve_4.Points)  # -> Keys, ValuesValuesA; disabled
graph_mapper_3 = GraphMapper(
    divide_curve_6.Parameters,
    x0=0,
    x1=1,
    y0=-1,
    y1=1,
    container_name="Bezier",
    cpx=[0, 0, 0.4491433203, 1],
    cpy=[0.50220263, 0.5211445093, 0.4125546217, 0.499735415])  # disabled

# ----
# Foot Length
length_3 = Length(Curve=project_7.Geometry)  # disabled

# ----
# Instep Width
distance_4 = Distance(PointA=list_item_16, PointB=list_item_17)  # disabled

# ----
# Instep Height
distance_5 = Distance(PointA=list_item_15, PointB=list_item_18)  # disabled

brep_plane_5 = BrepPlane(Brep=list_item_19, Plane=xz_plane_3)  # -> Curves, Points; disabled
list_item_20 = ListItem(List=sort_list_7.ValuesValuesA, Index=0, Wrap=True)  # disabled
list_item_21 = ListItem(List=sort_list_8.ValuesValuesA, Index=0, Wrap=True)  # disabled
unit_x_3 = UnitX(Factor=expr("x*(-40)", graph_mapper_2))  # disabled
unit_x_4 = UnitX(Factor=expr("x*40", graph_mapper_3))  # disabled
project_10 = Project(Geometry=list_item_20, Plane=foot_bisection_plane)  # -> Geometry, Transform; disabled
move_9 = Move(Geometry=divide_curve_5.Points, Motion=unit_x_3)  # -> Geometry, Transform; disabled
move_10 = Move(Geometry=divide_curve_6.Points, Motion=unit_x_4)  # -> Geometry, Transform; disabled
# Build Toebox
brep_brep = BrepBrep(BrepA=remove_null, BrepB=loft)  # -> Curves, Points; disabled
distance_6 = Distance(PointA=list_item_21, PointB=project_10.Geometry)  # disabled
curve = Curve(move_to_point_2.Moved)  # disabled
interpolate_2 = Interpolate(Vertices=move_9.Geometry, Degree=3, Periodic=False, KnotStyle=1)  # -> Curve, Length, Domain; disabled
interpolate_3 = Interpolate(Vertices=move_10.Geometry, Degree=3, Periodic=False, KnotStyle=1)  # -> Curve, Length, Domain; disabled
end_points_3 = EndPoints(Curve=brep_brep.Curves)  # -> Start, End; disabled
unit_z_4 = UnitZ(Factor=distance_6)  # disabled
project_11 = Project(Geometry=curve, Plane=xz_plane_3)  # -> Geometry, Transform; disabled
align_curves = AlignCurves(curve_1=interpolate_3.Curve, curve_2=interpolate_2.Curve)  # disabled
curve_closest_point = CurveClosestPoint(Point=[end_points_3.Start, end_points_3.End], Curve=list_item_6)  # -> Point, Parameter, Distance; disabled
unit_z_5 = UnitZ(Factor=[-50, 50])  # disabled

# ----
# Plan Profile
# (Height Adjusted)
move_11 = Move(Geometry=mesh_shadow, Motion=unit_z_4)  # -> Geometry, Transform; disabled

bounding_rectangle = BoundingRectangle(Geometry=project_11.Geometry, Plane=xz_plane_3, Axis=0, Slide=0, Union=True)  # -> Bounding, DimensionX, DimensionY; disabled
project_12 = Project(Curve=interpolate_3.Curve, Brep=remove_null, Direction=Vector(0, 0, 1))  # disabled
project_13 = Project(Curve=align_curves, Brep=remove_null, Direction=Vector(0, 0, 1))  # disabled
shatter = Shatter(Curve=list_item_6, Parameters=simplify(curve_closest_point.Parameter))  # disabled
extrude_5 = Extrude(Base=circle, Direction=unit_z_5)  # disabled
division_5 = Division(A=distance_4, B=bounding_rectangle.DimensionX)  # disabled
division_6 = Division(A=distance_5, B=bounding_rectangle.DimensionY)  # disabled
ruled_surface = RuledSurface(CurveA=project_12, CurveB=project_13)  # disabled
length_4 = Length(Curve=shatter)  # disabled
cap_holes_4 = CapHoles(Brep=extrude_5)  # disabled
scale_nu_3 = ScaleNU(Geometry=project_11.Geometry, Plane=xz_plane_3, ScaleX=division_5, ScaleY=division_6, ScaleZ=1)  # -> Geometry, Transform; disabled
length_5 = Length(Curve=split_with_breps.Curve)  # disabled
unit_z_6 = UnitZ(Factor=[-50, 50])  # disabled
sort_list_9 = SortList(Keys=length_4, ValuesValuesA=shatter)  # -> Keys, ValuesValuesA; disabled
solid_union = SolidUnion(Breps=cap_holes_4)  # disabled
curve_plane_4 = CurvePlane(Curve=move_11.Geometry, Plane=xz_plane)  # -> Points, ParamsC, ParamsP; disabled
curve_plane_5 = CurvePlane(Curve=move_11.Geometry, Plane=xz_plane_2)  # -> Points, ParamsC, ParamsP; disabled
curve_plane_6 = CurvePlane(Curve=mesh_shadow_2, Plane=xz_plane)  # -> Points, ParamsC, ParamsP; disabled
curve_plane_7 = CurvePlane(Curve=mesh_shadow_2, Plane=xz_plane_2)  # -> Points, ParamsC, ParamsP; disabled
sort_list_10 = SortList(Keys=length_5, ValuesValuesA=split_with_breps.Curve)  # -> Keys, ValuesValuesA; disabled
extrude_6 = Extrude(Base=ruled_surface, Direction=unit_z_6)  # disabled
longer_curve_segment = ListItem(List=sort_list_9.ValuesValuesA, Index=1, Wrap=True)  # disabled
shorter_curve_segment = ListItem(List=sort_list_9.ValuesValuesA, Index=0, Wrap=True)  # disabled
insert_items_2 = InsertItems(List=curve_plane_5.ParamsC, Item=curve_plane_4.ParamsC, Indices=-1, Wrap=True)  # disabled
insert_items_3 = InsertItems(List=curve_plane_7.ParamsC, Item=curve_plane_6.ParamsC, Indices=-1, Wrap=True)  # disabled
list_item_22 = ListItem(List=sort_list_10.ValuesValuesA, Index=0, Wrap=True)  # disabled
join_curves = JoinCurves(Curves=flatten([brep_brep.Curves, shorter_curve_segment]), Preserve=False)  # disabled
solid_union_2 = SolidUnion(Breps=extrude_6)  # disabled
flip_curve = FlipCurve(Curve=move_to_point_2.Moved)  # -> Curve, Flag; disabled
curve_plane_8 = CurvePlane(Curve=curve, Plane=foot_bisection_plane)  # -> Points, ParamsC, ParamsP; disabled
curve_plane_9 = CurvePlane(Curve=scale_nu_3.Geometry, Plane=foot_bisection_plane)  # -> Points, ParamsC, ParamsP; disabled
curve_plane_10 = CurvePlane(Curve=curve, Plane=PlaneXY(0, 0, 0))  # -> Points, ParamsC, ParamsP; disabled
curve_plane_11 = CurvePlane(Curve=scale_nu_3.Geometry, Plane=PlaneXY(0, 0, 0))  # -> Points, ParamsC, ParamsP; disabled
list_item_23 = ListItem(List=curve_closest_point.Point, Index=0, Wrap=True)  # disabled
extrude_7 = Extrude(Base=list_item_22, Direction=Vector(0, 300, 0))  # disabled
shatter_2 = Shatter(Curve=move_11.Geometry, Parameters=insert_items_2)  # disabled
shatter_3 = Shatter(Curve=mesh_shadow_2, Parameters=insert_items_3)  # disabled
panel_2 = Panel("*Polyline Curve")  # disabled
panel_3 = Panel("*Polyline Curve")  # disabled
rebuild_curve_2 = RebuildCurve(Curve=flip_curve.Curve, Count=50, EndTangents=False)  # disabled
offset_surface_2 = OffsetSurface(Surface=extrude_7, Distance=-1, BothSides=False, CreateSolid=True)  # disabled
list_item_24 = ListItem(List=flatten(join_curves), Index=-1, Wrap=True)  # disabled
solid_union_3 = SolidUnion(Breps=flatten([solid_union_2, solid_union]))  # disabled
match_text = MatchText(Text=shatter_2, Pattern=panel_2, Case=False)  # disabled
match_text_2 = MatchText(Text=shatter_3, Pattern=panel_3, Case=False)  # disabled
most_y_2 = MostY(point=curve_plane_9.Points)  # disabled
least_y_2 = LeastY(point=curve_plane_8.Points)  # disabled
most_y_3 = MostY(point=curve_plane_8.Points)  # disabled
least_y_3 = LeastY(point=curve_plane_9.Points)  # disabled
most_x_3 = MostX(point_list=curve_plane_10.Points)  # disabled
most_x_4 = MostX(point_list=curve_plane_11.Points)  # disabled
least_x_3 = LeastX(point_list=curve_plane_11.Points)  # disabled
least_x_4 = LeastX(point_list=curve_plane_10.Points)  # disabled
cull_pattern_5 = CullPattern(List=shatter_2, CullPattern=match_text)  # disabled
cull_pattern_6 = CullPattern(List=shatter_3, CullPattern=match_text_2)  # disabled
align_curve_seams_2 = AlignCurveSeams(Curves=[list_item_24, rebuild_curve_2], Guide=list_item_23, Seam=1, Snap=False, Iterative=True)  # -> Aligned, Points, ResultBoolean; disabled
line_5 = Line(StartPoint=most_y_3, EndPoint=most_y_2)  # disabled
line_6 = Line(StartPoint=most_x_3, EndPoint=most_x_4)  # disabled
line_7 = Line(StartPoint=least_x_4, EndPoint=least_x_3)  # disabled
line_8 = Line(StartPoint=least_y_2, EndPoint=least_y_3)  # disabled

# ----
# Straight Shank
solid_intersection = SolidIntersection(BrepsA=offset_surface_2, BrepsB=solid_union_3)  # disabled

divide_curve_7 = DivideCurve(Curve=line_5, Count=20, Kinks=False)  # -> Points, Tangents, Parameters; disabled
divide_curve_8 = DivideCurve(Curve=line_6, Count=20, Kinks=False)  # -> Points, Tangents, Parameters; disabled
divide_curve_9 = DivideCurve(Curve=line_7, Count=20, Kinks=False)  # -> Points, Tangents, Parameters; disabled
shortest = Shortest(curves=align_curve_seams_2.Aligned)  # disabled

# ----
# Plan Profile
# Curves
curve_2 = Curve(cull_pattern_5)  # disabled

longest = Longest(curves=align_curve_seams_2.Aligned)  # disabled

# ----
# Side Profile
# Curves
curve_3 = Curve(cull_pattern_6)  # disabled

graph_mapper_4 = GraphMapper(
    divide_curve_7.Parameters,
    x0=0,
    x1=1,
    y0=-1,
    y1=1,
    container_name="Bezier",
    cpx=[0, 0.2363742292, 0.7115955353, 1],
    cpy=[0.4959677458, 0.6737805605, 0.5579320192, 0.499735415])  # disabled
graph_mapper_5 = GraphMapper(
    divide_curve_8.Parameters,
    x0=0,
    x1=1,
    y0=-1,
    y1=1,
    container_name="Bezier",
    cpx=[0, 0.1373097152, 0.7853909731, 1],
    cpy=[0.4959677458, 0.6488764286, 0.5597574711, 0.499735415])  # disabled
graph_mapper_6 = GraphMapper(
    divide_curve_9.Parameters,
    x0=0,
    x1=1,
    y0=-1,
    y1=1,
    container_name="Bezier",
    cpx=[0, 0.1373097152, 0.7853909731, 1],
    cpy=[0.4959677458, 0.6488764286, 0.5597574711, 0.499735415])  # disabled
most_z_curve = MostZCurve(curve=curve_3)  # disabled
least_z_curve = LeastZCurve(relay=curve_3)  # disabled
least_x_curve = LeastXCurve(relay=curve_2)  # disabled
most_x_curve = MostXCurve(relay=curve_2)  # disabled
least_z_curve_2 = LeastZCurve_2(relay=curve_3)  # disabled
most_z_curve_2 = MostZCurve_2(relay=curve_3)  # disabled
most_x_curve_2 = MostXCurve_2(relay=curve_2)  # disabled
least_x_curve_2 = LeastXCurve_2(relay=curve_2)  # disabled
curve_4 = Curve(most_x_curve_2)  # disabled
curve_5 = Curve(least_z_curve_2)  # disabled
curve_6 = Curve(least_x_curve_2)  # disabled
curve_7 = Curve(most_z_curve_2)  # disabled
unit_z_7 = UnitZ(Factor=expr("x*40", graph_mapper_4))  # disabled
unit_x_5 = UnitX(Factor=expr("x*40", graph_mapper_5))  # disabled
unit_x_6 = UnitX(Factor=expr("x*-40", graph_mapper_6))  # disabled
line_9 = Line(StartPoint=foot_origin, EndPoint=construct_point_3)  # disabled
# Build Toebox Outer Surface
curve_plane_12 = CurvePlane(Curve=shortest, Plane=PlaneXY(0, 0, 0))  # -> Points, ParamsC, ParamsP; disabled
move_12 = Move(Geometry=divide_curve_7.Points, Motion=unit_z_7)  # -> Geometry, Transform; disabled
move_13 = Move(Geometry=divide_curve_8.Points, Motion=unit_x_5)  # -> Geometry, Transform; disabled
move_14 = Move(Geometry=divide_curve_9.Points, Motion=unit_x_6)  # -> Geometry, Transform; disabled
perp_frames_2 = PerpFrames(Curve=line_9, Count=20, Align=True)  # -> graft(Frames), Parameters; disabled

# ----
# Inside Instep Curve
interpolate_4 = Interpolate(Vertices=move_13.Geometry, Degree=3, Periodic=False, KnotStyle=1)  # -> Curve, Length, Domain; disabled

# ----
# Upper Instep Curve
interpolate_5 = Interpolate(Vertices=move_12.Geometry, Degree=3, Periodic=False, KnotStyle=1)  # -> Curve, Length, Domain; disabled

brep_plane_6 = BrepPlane(Brep=loft, Plane=PlaneXY(0, 0, 0))  # -> Curves, Points; disabled

# ----
# Outside Instep Curve
interpolate_6 = Interpolate(Vertices=move_14.Geometry, Degree=3, Periodic=False, KnotStyle=1)  # -> Curve, Length, Domain; disabled

project_14 = Project(Geometry=curve, Plane=perp_frames_2.Frames)  # -> Geometry, Transform; disabled
line_10 = Line(StartPoint=foot_origin, EndPoint=construct_point_3)  # disabled
least_x_curve_3 = LeastXCurve(relay=brep_plane_6.Curves)  # disabled
perp_frames_3 = PerpFrames(Curve=line_10, Count=20, Align=True)  # -> graft(Frames), Parameters; disabled
most_x_curve_3 = MostXCurve(relay=brep_plane_6.Curves)  # disabled
least_x_5 = LeastX(point_list=curve_plane_12.Points)  # disabled
end_points_4 = EndPoints(Curve=least_x_curve_3)  # -> Start, End; disabled
most_x_5 = MostX(point_list=curve_plane_12.Points)  # disabled
end_points_5 = EndPoints(Curve=most_x_curve_3)  # -> Start, End; disabled
bounding_rectangle_2 = BoundingRectangle(Geometry=project_14.Geometry, Plane=perp_frames_2.Frames, Axis=0, Slide=0, Union=True)  # -> Bounding, DimensionX, DimensionY; disabled
curve_plane_13 = CurvePlane(Curve=curve_6, Plane=perp_frames_2.Frames)  # -> Points, ParamsC, ParamsP; disabled
offset_surface_3 = OffsetSurface(Surface=flatten(loft), Distance=-1, BothSides=False, CreateSolid=True)  # disabled
curve_plane_14 = CurvePlane(Curve=curve_5, Plane=perp_frames_2.Frames)  # -> Points, ParamsC, ParamsP; disabled
curve_plane_15 = CurvePlane(Curve=curve_4, Plane=perp_frames_2.Frames)  # -> Points, ParamsC, ParamsP; disabled
curve_plane_16 = CurvePlane(Curve=curve_7, Plane=perp_frames_2.Frames)  # -> Points, ParamsC, ParamsP; disabled
project_15 = Project(Geometry=curve, Plane=perp_frames_3.Frames)  # -> Geometry, Transform; disabled
distance_7 = Distance(PointA=curve_plane_13.Points, PointB=curve_plane_15.Points)  # disabled
distance_8 = Distance(PointA=curve_plane_14.Points, PointB=curve_plane_16.Points)  # disabled

# ----
# Inner Surface
# Thickened
solid_intersection_2 = SolidIntersection(BrepsA=offset_surface, BrepsB=offset_surface_3)  # disabled

move_to_point_3 = MoveToPoint(Geometry=most_x_curve_3, PointA=end_points_5.End, PointB=most_x_5)  # -> Moved, Vector, Transform; disabled
move_to_point_4 = MoveToPoint(Geometry=least_x_curve_3, PointA=end_points_4.Start, PointB=least_x_5)  # -> Moved, Vector, Transform; disabled
project_16 = Project(Geometry=end_points_5.End, Plane=PlaneXZ(0, 0, 0))  # -> Geometry, Transform; disabled
project_17 = Project(Geometry=end_points_5.Start, Plane=PlaneXZ(0, 0, 0))  # -> Geometry, Transform; disabled
project_18 = Project(Geometry=end_points_4.Start, Plane=PlaneXZ(0, 0, 0))  # -> Geometry, Transform; disabled
project_19 = Project(Geometry=end_points_4.End, Plane=PlaneXZ(0, 0, 0))  # -> Geometry, Transform; disabled
curve_plane_17 = CurvePlane(Curve=interpolate_4.Curve, Plane=perp_frames_3.Frames)  # -> Points, ParamsC, ParamsP; disabled
curve_plane_18 = CurvePlane(Curve=line_8, Plane=perp_frames_3.Frames)  # -> Points, ParamsC, ParamsP; disabled
curve_plane_19 = CurvePlane(Curve=interpolate_5.Curve, Plane=perp_frames_3.Frames)  # -> Points, ParamsC, ParamsP; disabled
curve_plane_20 = CurvePlane(Curve=interpolate_6.Curve, Plane=perp_frames_3.Frames)  # -> Points, ParamsC, ParamsP; disabled
bounding_rectangle_3 = BoundingRectangle(Geometry=project_15.Geometry, Plane=perp_frames_3.Frames, Axis=0, Slide=0, Union=True)  # -> Bounding, DimensionX, DimensionY; disabled
division_7 = Division(A=distance_7, B=bounding_rectangle_2.DimensionY)  # disabled
division_8 = Division(A=distance_8, B=bounding_rectangle_2.DimensionX)  # disabled
interpolate_7 = Interpolate(Vertices=flatten(curve_plane_15.Points), Degree=3, Periodic=False, KnotStyle=1)  # -> Curve, Length, Domain; disabled
curve_plane_21 = CurvePlane(Curve=shorter_curve_segment, Plane=foot_bisection_plane)  # -> Points, ParamsC, ParamsP; disabled
curve_plane_22 = CurvePlane(Curve=flip_curve.Curve, Plane=foot_bisection_plane)  # -> Points, ParamsC, ParamsP; disabled
distance_9 = Distance(PointA=project_16.Geometry, PointB=project_17.Geometry)  # disabled
distance_10 = Distance(PointA=most_x_5, PointB=project_17.Geometry)  # disabled
distance_11 = Distance(PointA=curve_plane_17.Points, PointB=curve_plane_20.Points)  # disabled
distance_12 = Distance(PointA=curve_plane_18.Points, PointB=curve_plane_19.Points)  # disabled
distance_13 = Distance(PointA=least_x_5, PointB=project_19.Geometry)  # disabled
distance_14 = Distance(PointA=project_18.Geometry, PointB=project_19.Geometry)  # disabled
scale_nu_4 = ScaleNU(Geometry=project_14.Geometry, Plane=perp_frames_2.Frames, ScaleX=division_8, ScaleY=division_7, ScaleZ=1)  # -> simplify(Geometry), Transform; disabled
deconstruct_7 = Deconstruct(Point=curve_plane_22.Points)  # -> XComponent, YComponent, ZComponent; disabled
division_9 = Division(A=distance_10, B=distance_9)  # disabled
divide_curve_10 = DivideCurve(Curve=interpolate_7.Curve, Count=2, Kinks=False)  # -> Points, Tangents, Parameters; disabled
end_points_6 = EndPoints(Curve=interpolate_7.Curve)  # -> Start, End; disabled
division_10 = Division(A=distance_13, B=distance_14)  # disabled
sort_list_11 = SortList(Keys=deconstruct_7.ZComponent, ValuesValuesA=curve_plane_22.Points)  # -> Keys, ValuesValuesA; disabled

# ----
# Inner Surface + Shank
solid_union_4 = SolidUnion(Breps=flatten([solid_intersection_2, solid_intersection]))  # disabled

division_11 = Division(A=distance_11, B=bounding_rectangle_3.DimensionY)  # disabled
list_item_25 = ListItem(List=divide_curve_10.Points, Index=1, Wrap=True)  # disabled
division_12 = Division(A=distance_12, B=bounding_rectangle_3.DimensionX)  # disabled
list_item_26 = ListItem(List=sort_list_11.ValuesValuesA, Index=0, Wrap=True)  # disabled
plane_origin = PlaneOrigin(Base=PlaneXY(0, 0, 0), Origin=least_x_5)  # disabled
plane_3pt = Plane3Pt(PointA=end_points_6.Start, PointB=list_item_25, PointC=end_points_6.End)  # disabled
plane_origin_2 = PlaneOrigin(Base=PlaneXY(0, 0, 0), Origin=most_x_5)  # disabled

# ----
# Guide Curve
# on Base Plane
line_11 = Line(StartPoint=curve_plane_21.Points, EndPoint=list_item_26)  # -> simplify(Line); disabled

scale_nu_5 = ScaleNU(Geometry=project_15.Geometry, Plane=perp_frames_3.Frames, ScaleX=division_12, ScaleY=division_11, ScaleZ=1)  # -> Geometry, Transform; disabled
curve_plane_23 = CurvePlane(Curve=scale_nu_4.Geometry, Plane=plane_3pt)  # -> Points, ParamsC, ParamsP; disabled
scale_nu_6 = ScaleNU(Geometry=move_to_point_4.Moved, Plane=plane_origin, ScaleX=division_10, ScaleY=1, ScaleZ=1)  # -> Geometry, Transform; disabled
scale_nu_7 = ScaleNU(Geometry=move_to_point_3.Moved, Plane=plane_origin_2, ScaleX=division_9, ScaleY=1, ScaleZ=1)  # -> Geometry, Transform; disabled
number_slider_3 = Slider(50, range=0..100)  # disabled
loft_2 = Loft(
    Curves=flatten(scale_nu_5.Geometry),
    Options={Adjust=False, Closed=False, LoftEnds=0, LoftSimp=0, LoftType=0, Rebuild=10, Refit=0.01})  # disabled
most_x_6 = MostX(point_list=curve_plane_23.Points)  # disabled
flip_curve_2 = FlipCurve(Curve=scale_nu_6.Geometry)  # -> Curve, Flag; disabled
split_brep_4 = SplitBrep(Brep=loft_2, Cutter=remove_null)  # disabled
divide_curve_11 = DivideCurve(Curve=scale_nu_7.Geometry, Count=number_slider_3, Kinks=False)  # -> Points, Tangents, Parameters; disabled
divide_curve_12 = DivideCurve(Curve=flip_curve_2.Curve, Count=number_slider_3, Kinks=False)  # -> Points, Tangents, Parameters; disabled
move_to_point_5 = MoveToPoint(Geometry=scale_nu_4.Geometry, PointA=most_x_6, PointB=curve_plane_13.Points)  # -> simplify(Moved), Vector, Transform; disabled
rebuild_curve_3 = RebuildCurve(Curve=scale_nu_7.Geometry, Count=10, Degree=4, EndTangents=True)  # disabled
area_4 = Area(Geometry=split_brep_4)  # -> Area, Centroid; disabled
interpolate_8 = Interpolate(Vertices=divide_curve_11.Points, Degree=3, Periodic=False, KnotStyle=1)  # -> Curve, Length, Domain; disabled
interpolate_9 = Interpolate(Vertices=divide_curve_12.Points, Degree=3, Periodic=False, KnotStyle=1)  # -> Curve, Length, Domain; disabled
clean_tree = CleanTree(RemoveNulls=True, RemoveInvalid=True, RemoveEmpty=True, Tree=move_to_point_5.Moved)  # disabled
sort_list_12 = SortList(Keys=area_4.Area, ValuesValuesA=split_brep_4)  # -> Keys, ValuesValuesA; disabled
flip_curve_3 = FlipCurve(Curve=longest)  # -> Curve, Flag; disabled
insert_items_4 = InsertItems(List=interpolate_9.Curve, Item=interpolate_8.Curve, Indices=1, Wrap=True)  # disabled
loft_3 = Loft(
    Curves=flatten(clean_tree),
    Options={Adjust=False, Closed=False, LoftEnds=0, LoftSimp=0, LoftType=0, Rebuild=10, Refit=0.01})  # disabled
list_item_27 = ListItem(List=sort_list_12.ValuesValuesA, Index=-1, Wrap=True)  # disabled

# ----
# TBC
insert_items_5 = InsertItems(List=insert_items_4, Item=line_11, Indices=1, Wrap=True)  # disabled
reverse_list = ReverseList(List=insert_items_4)  # disabled

end_points_7 = EndPoints(Curve=brep_plane_5.Curves)  # -> Start, End; disabled

# ----
# Outer Surface
sweep2 = Sweep2(Rail1=shortest, Rail2=flip_curve_3.Curve, Sections=reverse_list, SameHeight=False)  # disabled

brep_plane_7 = BrepPlane(Brep=list_item_27, Plane=xz_plane_3)  # -> Curves, Points; disabled
most_x_7 = MostX(point_list=[end_points_7.Start, end_points_7.End])  # disabled
number_slider_4 = Slider(4, range=0..10)  # disabled
number_slider_5 = Slider(20, range=0..100)  # disabled
end_points_8 = EndPoints(Curve=brep_plane_7.Curves)  # -> Start, End; disabled
offset_surface_4 = OffsetSurface(Surface=sweep2, Distance=1, BothSides=False, CreateSolid=True)  # disabled
most_x_8 = MostX(point_list=[end_points_8.Start, end_points_8.End])  # disabled
move_to_point_6 = MoveToPoint(Geometry=list_item_19, PointA=most_x_7, PointB=most_x_8)  # -> Moved, Vector, Transform; disabled
rebuild_surface = RebuildSurface(Surface=sweep2, CountU=number_slider_5, CountV=number_slider_5, DegreeU=number_slider_4, DegreeV=number_slider_4)  # disabled

# ----
# Outer Surface
# Thickened
solid_union_5 = SolidUnion(Breps=flatten(offset_surface_4))  # disabled

solid_union_6 = SolidUnion(Breps=flatten([solid_union_4, solid_union_5]))  # disabled
cap_holes_5 = CapHoles(Brep=rebuild_surface)  # disabled

# ----
# Foot Surface
brep = Brep(move_to_point_6.Moved)  # disabled

fit_analysis = FitAnalysis(component_brep=list_item_7, foot_srf_brep=brep)  # -> fit_heatmap_component, fit_heatmap_foot, flatten(mean_distance), flatten(st_dev); disabled
mesh_3 = Mesh(fit_analysis.fit_heatmap_component)
mesh_4 = Mesh(fit_analysis.fit_heatmap_foot)
mean_distance = Panel(fit_analysis.mean_distance)
standard_deviation = Panel(fit_analysis.st_dev)

# ----
# Component Surface
brep_2 = Brep(list_item_27)  # disabled

fit_analysis_2 = FitAnalysis(component_brep=brep_2, foot_srf_brep=brep)  # -> fit_heatmap_component, fit_heatmap_foot, flatten(mean_distance), flatten(st_dev); disabled
# ..._1D_COMPMAP
mesh_5 = Mesh(fit_analysis_2.fit_heatmap_component)
mesh_6 = Mesh(fit_analysis_2.fit_heatmap_foot)
# ..._1D_FOOTMAP
mean_distance_2 = Panel(fit_analysis_2.mean_distance)
standard_deviation_2 = Panel(fit_analysis_2.st_dev)
fit_analysis_3 = FitAnalysis(component_brep=loft_3, foot_srf_brep=brep)  # -> fit_heatmap_component, fit_heatmap_foot, flatten(mean_distance), flatten(st_dev); disabled
mesh_7 = Mesh(fit_analysis_3.fit_heatmap_component)
mesh_8 = Mesh(fit_analysis_3.fit_heatmap_foot)
mean_distance_3 = Panel(fit_analysis_3.mean_distance)
standard_deviation_3 = Panel(fit_analysis_3.st_dev)

# ----
# Fit Heatmap Test
division_13 = Division(A=number_slider, B=2)  # disabled
negative_4 = Negative(Value=division_13)  # disabled
construct_domain = ConstructDomain(DomainStart=negative_4, DomainEnd=division_13)  # disabled

# ----
# Construct Cube
unit_z_8 = UnitZ(Factor=number_slider)  # disabled
rectangle = Rectangle(Plane=PlaneXY(0, 0, 0), XSize=construct_domain, YSize=construct_domain, Radius=0)  # -> Rectangle, Length; disabled
extrude_8 = Extrude(Base=rectangle.Rectangle, Direction=unit_z_8)  # disabled
cap_holes_6 = CapHoles(Brep=extrude_8)  # disabled

area_5 = Area(Geometry=extrude_8)  # -> Area, Centroid; disabled

# ----
# Construct Sphere
sphere = Sphere(Base=area_5.Centroid, Radius=division_13)  # disabled

# ----
# Mesh Sphere
settings_quality = SettingsQuality()  # disabled
mesh_brep = MeshBrep(Brep=sphere, Settings=settings_quality)  # disabled

deconstruct_mesh_3 = DeconstructMesh(Mesh=mesh_brep)  # -> Vertices, Faces, Colours, Normals; disabled
list_length = ListLength(List=deconstruct_mesh_3.Vertices)  # disabled
division_14 = Division(A=list_length, B=6)  # disabled
square_root = SquareRoot(Value=division_14)  # disabled
round = Round(Number=square_root)  # -> Nearest, Floor, Ceiling; disabled

# ----
# Mesh Cube w/
# similar vertices
mesh_box = MeshBox(Base=cap_holes_6, XCount=round.Nearest, YCount=round.Nearest, ZCount=round.Nearest)  # disabled

# ----
# Analysis Cluster
fit_analysis_4 = FitAnalysis(component_brep=mesh_box, foot_srf_brep=mesh_brep)  # -> fit_heatmap_component, fit_heatmap_foot, mean_distance, st_dev; disabled

# ----
# Results
panel_4 = Panel(fit_analysis_4.mean_distance)  # disabled
panel_5 = Panel(fit_analysis_4.st_dev)  # disabled
mesh_9 = Mesh(fit_analysis_4.fit_heatmap_component)  # disabled
mesh_10 = Mesh(fit_analysis_4.fit_heatmap_foot)  # disabled

# ----
# Bending the Shank
# Original Shank Out
# Shank Length In
# Curved Shank Out
end_points_9 = EndPoints(Curve=scale_nu.Geometry)  # -> Start, End; disabled
line_12 = Line(StartPoint=end_points_9.Start, EndPoint=end_points_9.End)  # disabled
divide_curve_13 = DivideCurve(Curve=line_12, Count=15, Kinks=False)  # -> Points, Tangents, Parameters; disabled

# ----
# Shank
# Curvature Control
graph_mapper_7 = GraphMapper(
    divide_curve_13.Parameters,
    x0=0,
    x1=1,
    y0=0,
    y1=1,
    container_name="Bezier",
    cpx=[0, 0.6294739246, 0.8841106296, 1],
    cpy=[0, 0.008542716503, 0.05280476809, 0.7957516909])  # disabled
number_slider_6 = Slider(39, range=30..60)  # disabled

multiplication_2 = Multiplication(A=graph_mapper_7, B=number_slider_6)  # disabled
unit_z_9 = UnitZ(Factor=expr("x*-1", multiplication_2))  # disabled
move_15 = Move(Geometry=divide_curve_13.Points, Motion=unit_z_9)  # -> Geometry, Transform; disabled
interpolate_10 = Interpolate(Vertices=move_15.Geometry, Degree=3, Periodic=False, KnotStyle=1)  # -> Curve, Length, Domain; disabled

# ----
# Full Curved Component
flow = Flow(
    Geometry=solid_union_4,
    Base=scale_nu.Geometry,
    Target=interpolate_10.Curve,
    ReverseBase=False,
    ReverseTarget=False,
    Stretch=True,
    Rigid=False)  # disabled

# ==== cluster LargestMesh
content = ClusterInput()
content_2 = ClusterInput()
bounding_box = BoundingBox(Content=content, Plane=PlaneXY(0, 0, 0))  # -> Box, Box_2
bounding_box_2 = BoundingBox(Content=content_2, Plane=PlaneXY(0, 0, 0))  # -> Box, Box_2
volume = Volume(Geometry=bounding_box.Box)  # -> Volume, Centroid
volume_2 = Volume(Geometry=bounding_box_2.Box)  # -> Volume, Centroid
insert_items = InsertItems(List=content, Item=content_2, Indices=0, Wrap=True)
insert_items_2 = InsertItems(List=volume.Volume, Item=volume_2.Volume, Indices=0, Wrap=True)
sort_list = SortList(Keys=insert_items_2, ValuesValuesA=insert_items)  # -> Keys, ValuesValuesA
list_item = ListItem(List=sort_list.ValuesValuesA, Index=-1, Wrap=True)
largest_mesh = ClusterOutput(list_item)

# ==== cluster SmallestMesh
content = ClusterInput()
content_2 = ClusterInput()
bounding_box = BoundingBox(Content=content, Plane=PlaneXY(0, 0, 0))  # -> Box, Box_2
bounding_box_2 = BoundingBox(Content=content_2, Plane=PlaneXY(0, 0, 0))  # -> Box, Box_2
volume = Volume(Geometry=bounding_box.Box)  # -> Volume, Centroid
volume_2 = Volume(Geometry=bounding_box_2.Box)  # -> Volume, Centroid
insert_items = InsertItems(List=content, Item=content_2, Indices=0, Wrap=True)
insert_items_2 = InsertItems(List=volume.Volume, Item=volume_2.Volume, Indices=0, Wrap=True)
sort_list = SortList(Keys=insert_items_2, ValuesValuesA=insert_items)  # -> Keys, ValuesValuesA
list_item = ListItem(List=sort_list.ValuesValuesA, Index=0, Wrap=True)
smallest_mesh = ClusterOutput(list_item)  # Extracts the Smallest (by volume) mesh out of 2 inputs

# ==== cluster ExtractToeTip
point = ClusterInput()
deconstruct = Deconstruct(Point=point)  # -> XComponent, YComponent, ZComponent
sort_list = SortList(Keys=deconstruct.YComponent, ValuesValuesA=point)  # -> Keys, reverse(ValuesValuesA)
list_item = ListItem(List=sort_list.ValuesValuesA, Index=-1, Wrap=True)
tip_of_big_toe = ClusterOutput(list_item)  # NOTE: May give an error if 2nd toe is longer than big toe

# ==== cluster PreviewMeasurement
end = ClusterInput()
start = ClusterInput()
visualisation = Line(StartPoint=start, EndPoint=end)
distance = Distance(PointA=start, PointB=end)
divide_curve = DivideCurve(Curve=visualisation, Count=2, Kinks=False)  # -> Points, Tangents, Parameters
round_to_decimal_place = RoundToDecimalPlace(NumberX=distance, DecimalPlace=3, RoundType=0)  # -> Rounded, Difference
unit_y = UnitY(Factor=3)
list_item = ListItem(List=divide_curve.Points, Index=1, Wrap=True)
move = Move(Geometry=list_item, Motion=unit_y)  # -> Geometry, Transform
text_tag_3d = TextTag3D(Location=move.Geometry, Text=round_to_decimal_place.Rounded, Size=2, Justification=5)

# ==== cluster CheckExtrudeDirection
surface = ClusterInput()
offset_surface = OffsetSurface(Surface=surface, Distance=20, Retrim=True)
area = Area(Geometry=offset_surface)  # -> Area, Centroid
# Welcome to my Ted Talk
# This cluster ensures that the extruded surface
# is extruded in the right direction
area_2 = Area(Geometry=surface)  # -> Area, Centroid
deconstruct = Deconstruct(Point=area.Centroid)  # -> XComponent, YComponent, ZComponent
deconstruct_2 = Deconstruct(Point=area_2.Centroid)  # -> XComponent, YComponent, ZComponent
number = Number(100)
larger_than = LargerThan(FirstNumber=deconstruct_2.ZComponent, SecondNumber=deconstruct.ZComponent)  # -> LargerThan, OrEqualTo
negative = Negative(Value=number)
expression = Expression(x=larger_than.OrEqualTo, y=number, z=negative, Expression="If(x,y,z)")
result = ClusterOutput(expression)

# ==== cluster MostX
point_list = ClusterInput()
deconstruct = Deconstruct(Point=flatten(point_list))  # -> XComponent, YComponent, ZComponent
sort_list = SortList(Keys=deconstruct.XComponent, ValuesValuesA=flatten(point_list))  # -> Keys, ValuesValuesA
reverse_list = ReverseList(List=sort_list.ValuesValuesA)
list_item = ListItem(List=reverse_list, Index=0, Wrap=True)
point = ClusterOutput(list_item)

# ==== cluster LeastX
point_list = ClusterInput()
deconstruct = Deconstruct(Point=point_list)  # -> XComponent, YComponent, ZComponent
sort_list = SortList(Keys=deconstruct.XComponent, ValuesValuesA=point_list)  # -> Keys, ValuesValuesA
list_item = ListItem(List=sort_list.ValuesValuesA, Index=0, Wrap=True)
point = ClusterOutput(list_item)

# ==== cluster LeastY
point = ClusterInput()
deconstruct = Deconstruct(Point=point)  # -> XComponent, YComponent, ZComponent
sort_list = SortList(Keys=deconstruct.YComponent, ValuesValuesA=point)  # -> Keys, ValuesValuesA
list_item = ListItem(List=sort_list.ValuesValuesA, Index=0, Wrap=True)
point_2 = ClusterOutput(list_item)

# ==== cluster MostY
point = ClusterInput()
deconstruct = Deconstruct(Point=point)  # -> XComponent, YComponent, ZComponent
sort_list = SortList(Keys=deconstruct.YComponent, ValuesValuesA=point)  # -> Keys, ValuesValuesA
reverse_list = ReverseList(List=sort_list.ValuesValuesA)
list_item = ListItem(List=reverse_list, Index=0, Wrap=True)
point_2 = ClusterOutput(list_item)

# ==== cluster AlignCurves
curve_1 = ClusterInput()
curve_2 = ClusterInput()
end_points = EndPoints(Curve=curve_1)  # -> Start, End
end_points_2 = EndPoints(Curve=curve_2)  # -> Start, End
deconstruct = Deconstruct(Point=end_points.Start)  # -> XComponent, YComponent, ZComponent
deconstruct_2 = Deconstruct(Point=end_points_2.Start)  # -> XComponent, YComponent, ZComponent
round = Round(Number=deconstruct.YComponent)  # -> Nearest, Floor, Ceiling
round_2 = Round(Number=deconstruct_2.YComponent)  # -> Nearest, Floor, Ceiling
equality = Equality(FirstNumber=round.Nearest, SecondNumber=round_2.Nearest)  # -> Equality, Inequality
flip_curve = FlipCurve(Curve=curve_2)  # -> Curve, Flag
expression = Expression(x=equality.Equality, y="0", z="1", Expression="If(x,y,z)")
insert_items = InsertItems(List=curve_2, Item=flip_curve.Curve, Indices=1, Wrap=True)
list_item = ListItem(List=insert_items, Index=expression, Wrap=True)
aligned_curve = ClusterOutput(list_item)

# ==== cluster Shortest
curves = ClusterInput()
length = Length(Curve=flatten(curves))
sort_list = SortList(Keys=length, ValuesValuesA=flatten(curves))  # -> Keys, ValuesValuesA
list_item = ListItem(List=sort_list.ValuesValuesA, Index=0, Wrap=True)
shortest_curve = ClusterOutput(list_item)

# ==== cluster Longest
curves = ClusterInput()
length = Length(Curve=flatten(curves))
sort_list = SortList(Keys=length, ValuesValuesA=flatten(curves))  # -> Keys, ValuesValuesA
list_item = ListItem(List=sort_list.ValuesValuesA, Index=-1, Wrap=True)
longest = ClusterOutput(list_item)

# ==== cluster FitAnalysis
component_brep = ClusterInput()
foot_srf_brep = ClusterInput()
# HEY LOOK
# I FOUND A WAY TO AVOID USING MATLAB
# GO ME
# LOOK AT THE PRETTY COLOURS
deconstruct_mesh = DeconstructMesh(Mesh=component_brep)  # -> Vertices, Faces, reverse(Colours), Normals
deconstruct_mesh_2 = DeconstructMesh(Mesh=foot_srf_brep)  # -> Vertices, Faces, Colours, Normals
mesh_closest_point = MeshClosestPoint(Point=deconstruct_mesh.Vertices, Mesh=foot_srf_brep)  # -> Point, Index, Parameter
mesh_closest_point_2 = MeshClosestPoint(Point=deconstruct_mesh_2.Vertices, Mesh=component_brep)  # -> Point, Index, Parameter
distance = Distance(PointA=deconstruct_mesh_2.Vertices, PointB=mesh_closest_point_2.Point)
distance_2 = Distance(PointA=deconstruct_mesh.Vertices, PointB=mesh_closest_point.Point)
bounds = Bounds(Numbers=distance)
bounds_2 = Bounds(Numbers=distance_2)
remap_numbers = RemapNumbers(Value=distance, Source=bounds, Target=Domain(0, 1))  # -> Mapped, Clipped
remap_numbers_2 = RemapNumbers(Value=distance_2, Source=bounds_2, Target=Domain(0, 1))  # -> Mapped, Clipped
# CHOOSE YOUR GRADIENT
# 'viridis'
gradient = Gradient(
    LowerLimit=0,
    UpperLimit=1,
    stops=[0.046: RGB(255, 215, 0), 0.4: RGB(0, 192, 0), 0.884: RGB(25, 25, 112), 1: RGB(75, 0, 130)])
# 'magma'
gradient_2 = Gradient(
    LowerLimit=0,
    UpperLimit=1,
    stops=[0.046: RGB(255, 255, 192), 0.307: RGB(255, 140, 0), 0.637: RGB(255, 0, 0), 0.943: RGB(75, 0, 130)])
gradient_3 = Gradient(
    LowerLimit=0,
    UpperLimit=1,
    stops=[0: RGB(0, 0, 255), 0.202: RGB(0, 255, 0), 0.512: RGB(255, 255, 0), 0.908: RGB(220, 0, 40)])
# 'ygb'
gradient_4 = Gradient(
    LowerLimit=0,
    UpperLimit=1,
    stops=[0.046: RGB(255, 255, 192), 0.291: RGB(192, 255, 192), 0.609: RGB(0, 128, 128), 0.943: RGB(75, 0, 130)])
gradient_5 = Gradient(
    LowerLimit=0,
    UpperLimit=1,
    Parameter=remap_numbers.Mapped,
    stops=[0.046: RGB(255, 255, 192), 0.307: RGB(255, 140, 0), 0.637: RGB(255, 0, 0), 0.943: RGB(75, 0, 130)])
gradient_6 = Gradient(
    LowerLimit=0,
    UpperLimit=1,
    Parameter=remap_numbers_2.Mapped,
    stops=[0.046: RGB(255, 255, 192), 0.307: RGB(255, 140, 0), 0.637: RGB(255, 0, 0), 0.943: RGB(75, 0, 130)])
statistics = Statistics(Values=distance_2)  # -> Average, StandardDeviation
construct_mesh = ConstructMesh(Vertices=deconstruct_mesh.Vertices, Faces=deconstruct_mesh.Faces, Colours=gradient_6)
construct_mesh_2 = ConstructMesh(Vertices=deconstruct_mesh_2.Vertices, Faces=deconstruct_mesh_2.Faces, Colours=gradient_5)
mean_distance = ClusterOutput(statistics.Average)
st_dev = ClusterOutput(statistics.StandardDeviation)
fit_heatmap_component = ClusterOutput(construct_mesh)
fit_heatmap_foot = ClusterOutput(construct_mesh_2)

# ==== cluster MostZCurve
curve = ClusterInput()
end_points = EndPoints(Curve=curve)  # -> Start, End
deconstruct = Deconstruct(Point=end_points.Start)  # -> XComponent, YComponent, ZComponent
sort_list = SortList(Keys=deconstruct.ZComponent, ValuesValuesA=curve)  # -> Keys, ValuesValuesA
list_item = ListItem(List=reverse(sort_list.ValuesValuesA), Index=0, Wrap=True)
i = ClusterOutput(list_item)

# ==== cluster LeastZCurve
relay = ClusterInput()
end_points = EndPoints(Curve=relay)  # -> Start, End
deconstruct = Deconstruct(Point=end_points.Start)  # -> XComponent, YComponent, ZComponent
sort_list = SortList(Keys=deconstruct.ZComponent, ValuesValuesA=relay)  # -> Keys, ValuesValuesA
list_item = ListItem(List=sort_list.ValuesValuesA, Index=0, Wrap=True)
i = ClusterOutput(list_item)

# ==== cluster MostXCurve
relay = ClusterInput()
end_points = EndPoints(Curve=relay)  # -> Start, End
deconstruct = Deconstruct(Point=end_points.Start)  # -> XComponent, YComponent, ZComponent
sort_list = SortList(Keys=deconstruct.XComponent, ValuesValuesA=relay)  # -> Keys, ValuesValuesA
list_item = ListItem(List=reverse(sort_list.ValuesValuesA), Index=0, Wrap=True)
i = ClusterOutput(list_item)

# ==== cluster LeastXCurve
relay = ClusterInput()
end_points = EndPoints(Curve=relay)  # -> Start, End
deconstruct = Deconstruct(Point=end_points.Start)  # -> XComponent, YComponent, ZComponent
sort_list = SortList(Keys=deconstruct.XComponent, ValuesValuesA=relay)  # -> Keys, ValuesValuesA
list_item = ListItem(List=sort_list.ValuesValuesA, Index=0, Wrap=True)
i = ClusterOutput(list_item)

# ==== cluster ExtractHeel
point = ClusterInput()
deconstruct = Deconstruct(Point=point)  # -> XComponent, YComponent, ZComponent
sort_list = SortList(Keys=deconstruct.YComponent, ValuesValuesA=point)  # -> Keys, reverse(ValuesValuesA)
list_item = ListItem(List=sort_list.ValuesValuesA, Index=0, Wrap=True)
i = ClusterOutput(list_item)

# ==== cluster MostZCurve_2
relay = ClusterInput()
end_points = EndPoints(Curve=relay)  # -> Start, End
deconstruct = Deconstruct(Point=end_points.Start)  # -> XComponent, YComponent, ZComponent
deconstruct_2 = Deconstruct(Point=end_points.End)  # -> XComponent, YComponent, ZComponent
addition = Addition(A=deconstruct.ZComponent, B=deconstruct_2.ZComponent)
sort_list = SortList(Keys=addition, ValuesValuesA=relay)  # -> Keys, ValuesValuesA
list_item = ListItem(List=sort_list.ValuesValuesA, Index=-1, Wrap=True)
i = ClusterOutput(list_item)

# ==== cluster LeastZCurve_2
relay = ClusterInput()
end_points = EndPoints(Curve=relay)  # -> Start, End
deconstruct = Deconstruct(Point=end_points.Start)  # -> XComponent, YComponent, ZComponent
deconstruct_2 = Deconstruct(Point=end_points.End)  # -> XComponent, YComponent, ZComponent
addition = Addition(A=deconstruct.ZComponent, B=deconstruct_2.ZComponent)
sort_list = SortList(Keys=addition, ValuesValuesA=relay)  # -> Keys, ValuesValuesA
list_item = ListItem(List=sort_list.ValuesValuesA, Index=0, Wrap=True)
i = ClusterOutput(list_item)

# ==== cluster LeastXCurve_2
relay = ClusterInput()
end_points = EndPoints(Curve=relay)  # -> Start, End
deconstruct = Deconstruct(Point=end_points.Start)  # -> XComponent, YComponent, ZComponent
deconstruct_2 = Deconstruct(Point=end_points.End)  # -> XComponent, YComponent, ZComponent
addition = Addition(A=deconstruct.XComponent, B=deconstruct_2.XComponent)
sort_list = SortList(Keys=addition, ValuesValuesA=relay)  # -> Keys, ValuesValuesA
list_item = ListItem(List=sort_list.ValuesValuesA, Index=-1, Wrap=True)
i = ClusterOutput(list_item)

# ==== cluster MostXCurve_2
relay = ClusterInput()
end_points = EndPoints(Curve=relay)  # -> Start, End
deconstruct = Deconstruct(Point=end_points.Start)  # -> XComponent, YComponent, ZComponent
deconstruct_2 = Deconstruct(Point=end_points.End)  # -> XComponent, YComponent, ZComponent
addition = Addition(A=deconstruct.XComponent, B=deconstruct_2.XComponent)
sort_list = SortList(Keys=addition, ValuesValuesA=relay)  # -> Keys, ValuesValuesA
list_item = ListItem(List=sort_list.ValuesValuesA, Index=0, Wrap=True)
i = ClusterOutput(list_item)

# ==== cluster RemoveNull
item = ClusterInput()
null_item = NullItem(Item=flatten(item))  # -> NullFlags, InvalidFlags, Description
invert_boolean = InvertBoolean(Boolean=null_item.NullFlags)  # -> Inverted, Number
cull_pattern = CullPattern(List=flatten(item), CullPattern=invert_boolean.Inverted)
list = ClusterOutput(cull_pattern)
