# Grasshopper definition 190221 component (recovered).gh (Grasshopper 1.0.7)
# plug-ins: Pufferfish, Human

# ----
# Foot Length (mm)
number_slider = Slider(150, range=50..300)

construct_point = ConstructPoint(XCoordinate=0, YCoordinate=0, ZCoordinate=0)
unit_y = UnitY(Factor=number_slider)
move = Move(Geometry=construct_point, Motion=unit_y)  # -> Geometry, Transform
line = Line(StartPoint=construct_point, EndPoint=move.Geometry)

# ----
# Curvature
# Interpolation
# Degree
control_knob = ControlKnob(Decimals=0, Limit=True, Maximum=20, Minimum=10, Range=20, Value=15)

divide_curve = DivideCurve(Curve=line, Count=control_knob, Kinks=False)  # -> Points, Tangents, Parameters

# ----
# Curvature Control
graph_mapper = GraphMapper(
    divide_curve.Parameters,
    x0=0,
    x1=1,
    y0=0,
    y1=1,
    container_name="Bezier",
    cpx=[0, 0.630520463, 0.9479647875, 1],
    cpy=[0, 0, 0.05223429203, 0.7957516909])

multiplication = Multiplication(A=graph_mapper, B=Slider(50, range=30..60))
negative = Negative(Value=multiplication)
unit_z = UnitZ(Factor=negative)
move_2 = Move(Geometry=divide_curve.Points, Motion=unit_z)  # -> Geometry, Transform

# ----
# Width and Height
# Curvature Control
graph_mapper_2 = GraphMapper(
    divide_curve.Parameters,
    x0=0,
    x1=1,
    y0=0,
    y1=1,
    container_name="Bezier",
    cpx=[0, 0.1042688861, 0.4497973323, 1],
    cpy=[0.489772439, 1, 1, 0.3865298629])
graph_mapper_3 = GraphMapper(
    divide_curve.Parameters,
    x0=0,
    x1=1,
    y0=0,
    y1=1,
    container_name="Bezier",
    cpx=[0, 0.2022953182, 0.7379239798, 1],
    cpy=[0.2621584535, 0.7947866321, 0.006016790867, 1])
multiplication_2 = Multiplication(A=graph_mapper_2, B=Slider(17, range=10..60))
multiplication_3 = Multiplication(A=graph_mapper_3, B=Slider(60, range=30..60))

interpolate = Interpolate(Vertices=move_2.Geometry, Degree=3, Periodic=False, KnotStyle=1)  # -> Curve, Length, Domain
perp_frame = PerpFrame(Curve=interpolate.Curve, Parameter=move_2.Geometry)
area = Area(Geometry=perp_frame)  # -> Area, graft(Centroid)
ellipse = Ellipse(Plane=perp_frame, Radius1=multiplication_2, Radius2=multiplication_3)  # -> Ellipse, Focus1, Focus2
divide_curve_2 = DivideCurve(Curve=ellipse.Ellipse, Count=2, Kinks=False)  # -> Points, Tangents, Parameters
list_item = ListItem(List=divide_curve_2.Points, Index=0, Wrap=True)
move_to_point = MoveToPoint(Geometry=graft(ellipse.Ellipse), PointA=list_item, PointB=area.Centroid)  # -> Moved, Vector, Transform
loft = Loft(
    Curves=flatten(move_to_point.Moved),
    Options={Adjust=False, Closed=False, LoftEnds=0, LoftSimp=0, LoftType=0, Rebuild=10, Refit=0.01})

# ----
# Cull the first 40mm
length = Length(Curve=line)
division = Division(A=length, B=control_knob)
division_2 = Division(A=40, B=division)
series = Series(Start=0, Step=1, Count=division_2)
cull_index = CullIndex(List=divide_curve.Points, Indices=series, Wrap=True)

interpolate_2 = Interpolate(Vertices=cull_index, Degree=3, Periodic=False, KnotStyle=1)  # -> Curve, Length, Domain
list_length = ListLength(List=cull_index)
divide_curve_3 = DivideCurve(Curve=interpolate_2.Curve, Count=list_length, Kinks=False)  # -> Points, Tangents, Parameters
sort_list = SortList(Keys=divide_curve_3.Parameters)  # -> Keys, ValuesValuesA
reverse_list = ReverseList(List=sort_list.Keys)
cull_index_2 = CullIndex(List=divide_curve_3.Points, Indices=0, Wrap=True)
list_item_2 = ListItem(List=reverse_list, Index=0, Wrap=True)
division_3 = Division(A=divide_curve_3.Parameters, B=list_item_2)
cull_index_3 = CullIndex(List=division_3, Indices=0, Wrap=True)
# Curvature Control
graph_mapper_4 = GraphMapper(division_3, x0=0, x1=1, y0=-1, y1=1, container_name="Bezier", cpx=[0, 0.09408602118, 1, 1], cpy=[1, 0, 0.441611886, 0])
multiplication_4 = Multiplication(A=graph_mapper_4, B=Slider(34, range=30..60))
unit_z_2 = UnitZ(Factor=multiplication_4)
move_3 = Move(Geometry=divide_curve_3.Points, Motion=unit_z_2)  # -> Geometry, Transform
list_length_2 = ListLength(List=series)
subtraction = Subtraction(A=list_length_2, B=1)
cull_index_4 = CullIndex(List=series, Indices=subtraction, Wrap=True)
list_item_3 = ListItem(List=move_3.Geometry, Index=cull_index_4, Wrap=True)
list_length_3 = ListLength(List=series)
list_length_4 = ListLength(List=list_item_3)
addition = Addition(A=list_length_4, B=list_length_3)
series_2 = Series(Start=0, Step=1, Count=addition)
cull_index_5 = CullIndex(List=move_2.Geometry, Indices=series_2, Wrap=True)
insert_items = InsertItems(List=cull_index_5, Item=list_item_3, Indices=0, Wrap=True)
panel = Panel("""80
-80""")
interpolate_3 = Interpolate(Vertices=insert_items, Degree=3, Periodic=False, KnotStyle=1)  # -> Curve, Length, Domain
unit_x = UnitX(Factor=panel)
extrude = Extrude(Base=interpolate_3.Curve, Direction=unit_x)
control_knob_2 = ControlKnob(Decimals=1, Limit=True, Maximum=10, Minimum=0, Range=1, Value=5)
brep_join = BrepJoin(Breps=extrude)  # -> Breps, Closed
unit_z_3 = UnitZ(Factor=control_knob_2)
move_4 = Move(Geometry=brep_join.Breps, Motion=unit_z_3)  # -> Geometry, Transform
split_brep = SplitBrep(Brep=loft, Cutter=move_4.Geometry)
list_item_4 = ListItem(List=split_brep, Index=1, Wrap=True)

# ----
# Curvature Control
graph_mapper_5 = GraphMapper(
    cull_index_3,
    x0=0,
    x1=1,
    y0=0,
    y1=2,
    container_name="Bezier",
    cpx=[0, 0.04237288237, 0.8940678239, 1],
    cpy=[0.4649999738, 0, 0.3349999785, 0])

multiplication_5 = Multiplication(A=graph_mapper_5, B=Slider(52, range=30..60))
negative_2 = Negative(Value=multiplication_5)
unit_x_2 = UnitX(Factor=negative_2)
move_5 = Move(Geometry=cull_index_2, Motion=unit_x_2)  # -> Geometry, Transform
cull_last_item = CullLastItem(list=move_5.Geometry)
mirror = Mirror(Geometry=cull_last_item, Plane=PlaneYZ(0, 0, 0))  # -> Geometry, Transform
reverse_list_2 = ReverseList(List=mirror.Geometry)
interpolate_4 = Interpolate(Vertices=[cull_last_item, reverse_list_2], Degree=3, Periodic=False, KnotStyle=1)  # -> Curve, Length, Domain
panel_2 = Panel("""-40
40""")
unit_z_4 = UnitZ(Factor=panel_2)
extrude_2 = Extrude(Base=interpolate_4.Curve, Direction=unit_z_4)
brep_join_2 = BrepJoin(Breps=extrude_2)  # -> Breps, Closed
split_brep_2 = SplitBrep(Brep=list_item_4, Cutter=brep_join_2.Breps)
item_selector = ItemSelector(split_brep_2, {"Trimmed Surface", "Open Brep", "Trimmed Surface"}, selected="Trimmed Surface")
offset_surface = OffsetSurface(Surface=item_selector, Distance=1, BothSides=False, CreateSolid=True)
xz_plane = XZPlane(Origin=Point(0, 0, 0))
plane_offset = PlaneOffset(BasePlane=xz_plane, Offset=-5)
list_item_5 = ListItem(List=flatten(move_to_point.Moved), Index=0, Wrap=True)
brep_plane = BrepPlane(Brep=item_selector, Plane=plane_offset)  # -> Curves, Points
loft_2 = Loft(Curves=[list_item_5, brep_plane.Curves], Options=brep_plane.Curves)

# ==== cluster CullLastItem
list = ClusterInput()
list_length = ListLength(List=list)
subtraction = Subtraction(A=list_length, B=1)
cull_index = CullIndex(List=list, Indices=subtraction, Wrap=True)
list_2 = ClusterOutput(cull_index)
