# Grasshopper definition 230321 component.gh (Grasshopper 1.0.7)
# plug-ins: Pufferfish

# ----
# SCAN IN ->
mesh = Mesh(<mesh referenced from the Rhino model>)

# ----
# IMPORT MESH
deconstruct_mesh = DeconstructMesh(Mesh=mesh)  # -> Vertices, Faces, Colours, Normals
point_list = PointList(Points=deconstruct_mesh.Vertices)
panel = Panel(deconstruct_mesh.Vertices)
panel_2 = Panel("""8594
12722
10481
658
7004
869
12059
12003
9808
6220
6174
6112
6107
6063
3659
3664""")
panel_3 = Panel("""9454
9436
9414
9356
7506
718
414
1608
4584
6441
12371
5190
7972
8186
4854
2081
1977
8007
2325""")
panel_4 = Panel("""8646
11329
12329
9761
293
2121
7651
324
6350
7262""")
image_sampler = ImageSampler(
    FilePath="C:\Users\Luke Hillery\Documents\DE4\SOLO\Component CAD\foot top view.jpg",
    Filter="Colour",
    Interpolate=False,
    Umax=1,
    Umin=0,
    Vmax=1,
    Vmin=0,
    Wrap=1)

# ----
# Back of Heel
list_item = ListItem(List=deconstruct_mesh.Vertices, Index=2027, Wrap=True)

# ----
# Tip of Big Toe
list_item_2 = ListItem(List=deconstruct_mesh.Vertices, Index=2420, Wrap=True)

xy_plane = XYPlane(Origin=Point(0, 0, 0))
xy_plane_2 = XYPlane(Origin=Point(0, 0, 0))
yz_plane = YZPlane(Origin=Point(0, 0, 0))
unit_z = UnitZ(Factor=-1)
unit_z_2 = UnitZ(Factor=-1)
xy_plane_3 = XYPlane(Origin=Point(0, 0, 0))
xy_plane_4 = XYPlane(Origin=Point(0, 0, 0))
project_point = ProjectPoint(Point=list_item, Direction=unit_z, Geometry=xy_plane_3)  # -> Point, Index
# FOOT LENGTH
project_point_2 = ProjectPoint(Point=list_item_2, Direction=unit_z_2, Geometry=xy_plane_4)  # -> Point, Index

# ----
# Foot Length
distance = Distance(PointA=project_point_2.Point, PointB=project_point.Point)

multiplication = Multiplication(A=distance, B=0.8)
round = Round(Number=multiplication)  # -> Nearest, Floor, Ceiling
series = Series(Start=0, Step=1, Count=5)
series_2 = Series(Start=0, Step=1, Count=5)
xz_plane = XZPlane(Origin=Point(0, 0, 0))

# ----
# CHRONOLOGICAL ORDER -->
# Foot Length (mm)
number_slider = Slider(150, range=50..300)

construct_point = ConstructPoint(XCoordinate=0, YCoordinate=0, ZCoordinate=0)
move_to_point = MoveToPoint(Geometry=mesh, PointA=list_item_2, PointB=construct_point)  # -> Moved, Vector, Transform
deconstruct_mesh_2 = DeconstructMesh(Mesh=move_to_point.Moved)  # -> Vertices, Faces, Colours, Normals

# ----
# Outside Instep
list_item_3 = ListItem(List=deconstruct_mesh_2.Vertices, Index=panel_2, Wrap=True)

# ----
# Instep Profile
list_item_4 = ListItem(List=deconstruct_mesh_2.Vertices, Index=panel_3, Wrap=True)

# ----
# Inside Instep
list_item_5 = ListItem(List=deconstruct_mesh_2.Vertices, Index=panel_4, Wrap=True)

interpolate = Interpolate(Vertices=list_item_3, Degree=1, Periodic=False, KnotStyle=1)  # -> Curve, Length, Domain
interpolate_2 = Interpolate(Vertices=list_item_4, Degree=1, Periodic=False, KnotStyle=1)  # -> Curve, Length, Domain
interpolate_3 = Interpolate(Vertices=list_item_5, Degree=1, Periodic=False, KnotStyle=1)  # -> Curve, Length, Domain
project = Project(Geometry=interpolate.Curve, Plane=xy_plane)  # -> Geometry, Transform
project_2 = Project(Geometry=interpolate_2.Curve, Plane=yz_plane)  # -> Geometry, Transform
project_3 = Project(Geometry=interpolate_3.Curve, Plane=xy_plane_2)  # -> Geometry, Transform
rebuild_curve = RebuildCurve(Curve=project.Geometry, Count=4, Degree=3, EndTangents=False)
rebuild_curve_2 = RebuildCurve(Curve=project_3.Geometry, Count=3, Degree=2, EndTangents=False)
rebuild_curve_3 = RebuildCurve(Curve=project_2.Geometry, Count=8, Degree=5, EndTangents=False)
# Tip of 2nd Toe
list_item_6 = ListItem(List=deconstruct_mesh_2.Vertices, Index=9089, Wrap=True)
# Tip of Big Toe
list_item_7 = ListItem(List=deconstruct_mesh_2.Vertices, Index=2420, Wrap=True)
line = Line(StartPoint=list_item_7, EndPoint=list_item_6)
curve_middle = CurveMiddle(Curve=line)
unit_y = UnitY(Factor=round.Nearest)
move = Move(Geometry=construct_point, Motion=unit_y)  # -> Geometry, Transform
point = Point(curve_middle)
line_2 = Line(StartPoint=point, EndPoint=move.Geometry)

# ----
# Curvature
# Interpolation
# Degree
# NOTE
# Only works at 15 and 20...
control_knob = ControlKnob(Decimals=0, Limit=True, Maximum=20, Minimum=10, Range=20, Value=15)

# ----
# TOEBOX SHAPE
divide_curve = DivideCurve(Curve=line_2, Count=control_knob, Kinks=False)  # -> Points, Tangents, Parameters

# ----
# Toebox
# Curvature Control
graph_mapper = GraphMapper(
    divide_curve.Parameters,
    x0=0,
    x1=1,
    y0=0,
    y1=1,
    container_name="Bezier",
    cpx=[0, 0.630081296, 0.9479647875, 1],
    cpy=[0, 0, 0.05223429203, 0.7957516909])
# NOTE
# Curvature should be taken from
# raw 3D scan, either using photo with
# edge detection or with cross-section
# curves through mesh from 3D scan
number_slider_2 = Slider(50, range=30..60)

multiplication_2 = Multiplication(A=graph_mapper, B=number_slider_2)
negative = Negative(Value=multiplication_2)
unit_z_3 = UnitZ(Factor=negative)
# BOUNDING VOLUME SHAPE
move_2 = Move(Geometry=divide_curve.Points, Motion=unit_z_3)  # -> Geometry, Transform

# ----
# Width and Height
# Curvature Control
graph_mapper_2 = GraphMapper(
    divide_curve.Parameters,
    x0=0,
    x1=1,
    y0=0,
    y1=1,
    container_name="Bezier",
    cpx=[0, 0.1070338339, 0.4497973323, 1],
    cpy=[0.489772439, 1, 1, 0.3865298629])
graph_mapper_3 = GraphMapper(
    divide_curve.Parameters,
    x0=0,
    x1=1,
    y0=0,
    y1=1,
    container_name="Bezier",
    cpx=[0, 0.331707716, 0.7379239798, 1],
    cpy=[0.2553995252, 0.8880677819, 0.006016790867, 1])
# NOTE
# Curvature should be taken from
# raw 3D scan, either using photo with
# edge detection or with cross-section
# curves through mesh from 3D scan
number_slider_3 = Slider(60, range=30..60)
multiplication_3 = Multiplication(A=graph_mapper_2, B=Slider(17, range=10..60))
multiplication_4 = Multiplication(A=graph_mapper_3, B=number_slider_3)

interpolate_4 = Interpolate(Vertices=move_2.Geometry, Degree=3, Periodic=False, KnotStyle=1)  # -> Curve, Length, Domain
perp_frame = PerpFrame(Curve=interpolate_4.Curve, Parameter=move_2.Geometry)
curve_plane = CurvePlane(Curve=rebuild_curve_3, Plane=perp_frame)  # -> flatten(Points), ParamsC, ParamsP
curve_plane_2 = CurvePlane(Curve=rebuild_curve_2, Plane=perp_frame)  # -> graft(Points), ParamsC, ParamsP
curve_plane_3 = CurvePlane(Curve=rebuild_curve, Plane=perp_frame)  # -> graft(Points), ParamsC, ParamsP
cull_index = CullIndex(List=curve_plane.Points, Indices=0, Wrap=True)
list_item_8 = ListItem(List=flatten(curve_plane_2.Points), Index=series, Wrap=True)
list_item_9 = ListItem(List=flatten(curve_plane_3.Points), Index=series_2, Wrap=True)
arc_3pt = Arc3Pt(PointA=list_item_8, PointB=cull_index, PointC=list_item_9)  # -> Arc, Plane, Radius
close_curve = CloseCurve(Curve=arc_3pt.Arc, CloseType=2, Bulge=0.3, Tolerance=0)  # -> Closed, ResultBoolean
rebuild_curve_4 = RebuildCurve(Curve=close_curve.Closed, Count=6, Degree=4, EndTangents=False)  # -> graft(Rebuilt)
list_item_10 = ListItem(List=flatten(rebuild_curve_4), Index=0, Wrap=True)
loft = Loft(
    Curves=flatten(rebuild_curve_4),
    Options={Adjust=False, Closed=False, LoftEnds=0, LoftSimp=0, LoftType=0, Rebuild=10, Refit=0.01})
project_4 = Project(Geometry=list_item_10, Plane=xz_plane)  # -> Geometry, Transform
list_item_11 = ListItem(List=flatten(rebuild_curve_4), Index=4, Wrap=True)
series_3 = Series(Start=9, Step=1, Count=7)
# NOTE
# Ellipse profile is close but not perfect
# Profiles need to be distorted to square off bottom edge
area = Area(Geometry=perp_frame)  # -> Area, graft(Centroid)
ellipse = Ellipse(Plane=perp_frame, Radius1=multiplication_3, Radius2=multiplication_4)  # -> Ellipse, Focus1, Focus2
list_item_12 = ListItem(List=flatten(ellipse.Ellipse), Index=8, Wrap=True)
flip_curve = FlipCurve(Curve=list_item_12)  # -> Curve, Flag
align_curve_seams = AlignCurveSeams(Curves=[flip_curve.Curve, list_item_11], Snap=False, Iterative=True)  # -> Aligned, Points, ResultBoolean
list_item_13 = ListItem(List=flatten(align_curve_seams.Aligned), Index=1, Wrap=True)
list_item_14 = ListItem(List=flatten(align_curve_seams.Aligned), Index=0, Wrap=True)
tween_curve = TweenCurve(CurveA=list_item_14, CurveB=list_item_13, Factor=Slider(0.5, range=0..1), BlendType=0)
insert_items = InsertItems(List=flatten(rebuild_curve_4), Item=tween_curve, Indices=5, Wrap=True)
list_item_15 = ListItem(List=ellipse.Ellipse, Index=series_3, Wrap=False)
flip_curve_2 = FlipCurve(Curve=list_item_15)  # -> Curve, Flag
reverse_list = ReverseList(List=insert_items)
reverse_list_2 = ReverseList(List=flip_curve_2.Curve)
divide_curve_2 = DivideCurve(Curve=ellipse.Ellipse, Count=2, Kinks=False)  # -> Points, Tangents, Parameters
insert_items_2 = InsertItems(List=flatten(reverse_list), Item=reverse_list_2, Indices=0, Wrap=True)
list_item_16 = ListItem(List=divide_curve_2.Points, Index=0, Wrap=True)
align_curve_seams_2 = AlignCurveSeams(Curves=insert_items_2, Snap=False, Iterative=True)  # -> Aligned, Points, ResultBoolean
move_to_point_2 = MoveToPoint(Geometry=graft(ellipse.Ellipse), PointA=list_item_16, PointB=area.Centroid)  # -> Moved, Vector, Transform
loft_2 = Loft(
    Curves=align_curve_seams_2.Aligned,
    Options={Adjust=False, Closed=False, LoftEnds=0, LoftSimp=0, LoftType=0, Rebuild=10, Refit=0.01})
loft_3 = Loft(
    Curves=flatten(move_to_point_2.Moved),
    Options={Adjust=False, Closed=False, LoftEnds=0, LoftSimp=0, LoftType=0, Rebuild=10, Refit=0.01})  # disabled

# ----
# Cull the first 40mm
length = Length(Curve=line_2)
division = Division(A=length, B=control_knob)
division_2 = Division(A=40, B=division)
series_4 = Series(Start=0, Step=1, Count=division_2)
cull_index_2 = CullIndex(List=divide_curve.Points, Indices=series_4, Wrap=True)

interpolate_5 = Interpolate(Vertices=cull_index_2, Degree=3, Periodic=False, KnotStyle=1)  # -> Curve, Length, Domain
list_length = ListLength(List=cull_index_2)
divide_curve_3 = DivideCurve(Curve=interpolate_5.Curve, Count=list_length, Kinks=False)  # -> Points, Tangents, Parameters
sort_list = SortList(Keys=divide_curve_3.Parameters)  # -> Keys, ValuesValuesA
reverse_list_3 = ReverseList(List=sort_list.Keys)
cull_index_3 = CullIndex(List=divide_curve_3.Points, Indices=0, Wrap=True)
list_item_17 = ListItem(List=reverse_list_3, Index=0, Wrap=True)
# HORIZONTAL SPLITLINE
division_3 = Division(A=divide_curve_3.Parameters, B=list_item_17)
cull_index_4 = CullIndex(List=division_3, Indices=0, Wrap=True)

# ----
# Split Line
# Curvature Control
number_slider_4 = Slider(34, range=30..60)
graph_mapper_4 = GraphMapper(division_3, x0=0, x1=1, y0=-1, y1=1, container_name="Bezier", cpx=[0, 0.09408602118, 1, 1], cpy=[1, 0, 0.441611886, 0])

multiplication_5 = Multiplication(A=graph_mapper_4, B=number_slider_4)
unit_z_4 = UnitZ(Factor=multiplication_5)
move_3 = Move(Geometry=divide_curve_3.Points, Motion=unit_z_4)  # -> Geometry, Transform
list_length_2 = ListLength(List=series_4)
subtraction = Subtraction(A=list_length_2, B=1)
cull_index_5 = CullIndex(List=series_4, Indices=subtraction, Wrap=True)
list_item_18 = ListItem(List=move_3.Geometry, Index=cull_index_5, Wrap=True)
list_length_3 = ListLength(List=series_4)
list_length_4 = ListLength(List=list_item_18)
addition = Addition(A=list_length_4, B=list_length_3)
series_5 = Series(Start=0, Step=1, Count=addition)
cull_index_6 = CullIndex(List=move_2.Geometry, Indices=series_5, Wrap=True)
insert_items_3 = InsertItems(List=cull_index_6, Item=list_item_18, Indices=0, Wrap=True)
panel_5 = Panel("""80
-80""")
interpolate_6 = Interpolate(Vertices=insert_items_3, Degree=3, Periodic=False, KnotStyle=1)  # -> Curve, Length, Domain
unit_x = UnitX(Factor=panel_5)
extrude = Extrude(Base=interpolate_6.Curve, Direction=unit_x)
control_knob_2 = ControlKnob(Decimals=1, Limit=True, Maximum=10, Minimum=0, Range=1, Value=5)
brep_join = BrepJoin(Breps=extrude)  # -> Breps, Closed
unit_z_5 = UnitZ(Factor=control_knob_2)
move_4 = Move(Geometry=brep_join.Breps, Motion=unit_z_5)  # -> Geometry, Transform
split_brep = SplitBrep(Brep=loft_3, Cutter=move_4.Geometry)
# VERTICAL TRIM
list_item_19 = ListItem(List=split_brep, Index=1, Wrap=True)

# ----
# Vertical Trim
# Curvature Control
graph_mapper_5 = GraphMapper(cull_index_4, x0=0, x1=1, y0=0, y1=2, container_name="Bezier", cpx=[0, 0, 1, 1], cpy=[0.8611767292, 0, 0.3125, 0])

multiplication_6 = Multiplication(A=graph_mapper_5, B=Slider(34, range=30..60))
negative_2 = Negative(Value=multiplication_6)
unit_x_2 = UnitX(Factor=negative_2)
move_5 = Move(Geometry=cull_index_3, Motion=unit_x_2)  # -> Geometry, Transform
cull_last_item = CullLastItem(list=move_5.Geometry)
mirror = Mirror(Geometry=cull_last_item, Plane=PlaneYZ(0, 0, 0))  # -> Geometry, Transform
reverse_list_4 = ReverseList(List=mirror.Geometry)
interpolate_7 = Interpolate(Vertices=[cull_last_item, reverse_list_4], Degree=3, Periodic=False, KnotStyle=1)  # -> Curve, Length, Domain
panel_6 = Panel("""-40
40""")
unit_z_6 = UnitZ(Factor=panel_6)
extrude_2 = Extrude(Base=interpolate_7.Curve, Direction=unit_z_6)
brep_join_2 = BrepJoin(Breps=extrude_2)  # -> Breps, Closed
split_brep_2 = SplitBrep(Brep=list_item_19, Cutter=brep_join_2.Breps)
panel_7 = Panel("*Trimmed*")  # disabled
match_text = MatchText(Text=split_brep_2, Pattern=panel_7, Case=True)  # disabled
cull_pattern = CullPattern(List=split_brep_2, CullPattern=match_text)  # disabled
offset_surface = OffsetSurface(Surface=cull_pattern, Distance=1, BothSides=False, CreateSolid=True)  # disabled
xz_plane_2 = XZPlane(Origin=Point(0, 0, 0))  # disabled
plane_offset = PlaneOffset(BasePlane=xz_plane_2, Offset=-4)  # disabled
# TOE CAP
list_item_20 = ListItem(List=flatten(move_to_point_2.Moved), Index=0, Wrap=True)  # disabled
brep_plane = BrepPlane(Brep=cull_pattern, Plane=plane_offset)  # -> Curves, Points; disabled
curve = Curve(simplify(flatten(brep_plane.Curves)))  # disabled
curve_2 = Curve(list_item_20)  # disabled
loft_4 = Loft(
    Curves=[list_item_20, curve],
    Options={Adjust=False, Closed=False, LoftEnds=0, LoftSimp=0, LoftType=0, Rebuild=10, Refit=0.01})  # disabled
cap_holes = CapHoles(Brep=loft_4)  # disabled
# BOOLEAN
solid_union = SolidUnion(Breps=flatten([cap_holes, offset_surface]))  # disabled
deconstruct_brep = DeconstructBrep(Brep=solid_union)  # -> Faces, Edges, Vertices; disabled
panel_8 = Panel("*Elliptical*")  # disabled
panel_9 = Panel("*Elliptical*")  # disabled
panel_11 = Panel(deconstruct_brep.Edges)  # disabled
match_text_2 = MatchText(Text=deconstruct_brep.Edges, Pattern=panel_8, Case=True)  # disabled
list_indices = ListIndices(List=deconstruct_brep.Edges)  # disabled
cull_pattern_2 = CullPattern(List=list_indices, CullPattern=match_text_2)  # disabled
# Fillet Outer Edge
# of Toebox
fillet_edge = FilletEdge(Shape=solid_union, Blend=0, Metric=0, Edges=cull_pattern_2, Radii=4)  # disabled
# TOEBOX FILLET
panel_12 = Panel("*Planar*")  # disabled
match_text_3 = MatchText(Text=deconstruct_brep.Edges, Pattern=panel_12, Case=True)  # disabled
list_indices_2 = ListIndices(List=deconstruct_brep.Edges)  # disabled
cull_pattern_3 = CullPattern(List=list_indices_2, CullPattern=match_text_3)  # disabled
cull_pattern_4 = CullPattern(List=deconstruct_brep.Edges, CullPattern=match_text_3)  # disabled
length_2 = Length(Curve=cull_pattern_4)  # disabled
sort_list_2 = SortList(Keys=length_2, ValuesValuesA=cull_pattern_3)  # -> Keys, ValuesValuesA; disabled
sort_list_3 = SortList(Keys=length_2, ValuesValuesA=cull_pattern_4)  # -> Keys, ValuesValuesA; disabled
panel_13 = Panel("""0
1
2""")  # disabled
list_item_21 = ListItem(List=sort_list_3.ValuesValuesA, Index=panel_13, Wrap=True)  # disabled
list_item_22 = ListItem(List=sort_list_2.ValuesValuesA, Index=panel_13, Wrap=True)  # disabled
fillet_edge_2 = FilletEdge(Shape=fillet_edge, Blend=0, Metric=0, Edges=list_item_22, Radii=2)  # disabled
create_material = CreateMaterial(Diffuse=RGB(255, 148, 180), Specular=RGB(255, 255, 255), Emission=RGB(0, 0, 0), Transparency=0, Shine=0)  # disabled
custom_preview = CustomPreview(Geometry=fillet_edge_2, Material=create_material)  # disabled

# ==== cluster CullLastItem
list = ClusterInput()
list_length = ListLength(List=list)
subtraction = Subtraction(A=list_length, B=1)
cull_index = CullIndex(List=list, Indices=subtraction, Wrap=True)
list_2 = ClusterOutput(cull_index)
