# Grasshopper definition 270521 heatmap averaging.gh (Grasshopper 1.0.7)
# plug-ins: KTTools, Human, Pufferfish

fit_analysis = FitAnalysis()  # -> fit_heatmap_component, fit_heatmap_foot, flatten(mean_distance), flatten(st_dev)
fit_analysis_2 = FitAnalysis()  # -> fit_heatmap_component, fit_heatmap_foot, flatten(mean_distance), flatten(st_dev)
mesh = Mesh(<mesh referenced from the Rhino model>)
mesh_2 = Mesh(<mesh referenced from the Rhino model>)
mesh_3 = Mesh(fit_analysis.fit_heatmap_component)
mesh_4 = Mesh(fit_analysis.fit_heatmap_foot)
mesh_5 = Mesh(fit_analysis_2.fit_heatmap_component)
mesh_6 = Mesh(fit_analysis_2.fit_heatmap_foot)
deconstruct_mesh = DeconstructMesh(FootSrf=mesh_2)  # -> Vertices, Faces, Colours, Normals
# HEY LOOK
# I FOUND A WAY TO AVOID USING MATLAB
# GO ME
# LOOK AT THE PRETTY COLOURS
deconstruct_mesh_2 = DeconstructMesh(ComponentSrf=mesh)  # -> Vertices, Faces, reverse(Colours), Normals
mesh_closest_point = MeshClosestPoint(Point=deconstruct_mesh.Vertices, Mesh=mesh)  # -> Point, Index, Parameter
mesh_closest_point_2 = MeshClosestPoint(Point=deconstruct_mesh_2.Vertices, Mesh=mesh_2)  # -> Point, Index, Parameter
distance = Distance(PointA=deconstruct_mesh.Vertices, PointB=mesh_closest_point.Point)
distance_2 = Distance(PointA=deconstruct_mesh_2.Vertices, PointB=mesh_closest_point_2.Point)
bounds = Bounds(Numbers=distance_2)
bounds_2 = Bounds(Numbers=distance)
remap_numbers = RemapNumbers(Value=distance_2, Source=bounds, Target=Domain(0, 1))  # -> Mapped, Clipped
remap_numbers_2 = RemapNumbers(Value=distance, Source=bounds_2, Target=Domain(0, 1))  # -> Mapped, Clipped
statistics = Statistics(Values=distance_2)  # -> Average, StandardDeviation
gradient = Gradient(
    LowerLimit=0,
    UpperLimit=1,
    Parameter=remap_numbers_2.Mapped,
    stops=[0.046: RGB(255, 255, 192), 0.307: RGB(255, 140, 0), 0.637: RGB(255, 0, 0), 0.943: RGB(75, 0, 130)])
gradient_2 = Gradient(
    LowerLimit=0,
    UpperLimit=1,
    Parameter=remap_numbers.Mapped,
    stops=[0.046: RGB(255, 255, 192), 0.307: RGB(255, 140, 0), 0.637: RGB(255, 0, 0), 0.943: RGB(75, 0, 130)])
# CHOOSE YOUR GRADIENT
# 'viridis'
gradient_3 = Gradient(
    LowerLimit=0,
    UpperLimit=1,
    stops=[0.046: RGB(255, 215, 0), 0.4: RGB(0, 192, 0), 0.884: RGB(25, 25, 112), 1: RGB(75, 0, 130)])
# 'magma'
gradient_4 = Gradient(
    LowerLimit=0,
    UpperLimit=1,
    stops=[0.046: RGB(255, 255, 192), 0.307: RGB(255, 140, 0), 0.637: RGB(255, 0, 0), 0.943: RGB(75, 0, 130)])
gradient_5 = Gradient(
    LowerLimit=0,
    UpperLimit=1,
    stops=[0: RGB(0, 0, 255), 0.202: RGB(0, 255, 0), 0.512: RGB(255, 255, 0), 0.908: RGB(220, 0, 40)])
# 'ygb'
gradient_6 = Gradient(
    LowerLimit=0,
    UpperLimit=1,
    stops=[0.046: RGB(255, 255, 192), 0.291: RGB(192, 255, 192), 0.609: RGB(0, 128, 128), 0.943: RGB(75, 0, 130)])
construct_mesh = ConstructMesh(Vertices=deconstruct_mesh_2.Vertices, Faces=deconstruct_mesh_2.Faces, Colours=gradient_2)
construct_mesh_2 = ConstructMesh(Vertices=deconstruct_mesh.Vertices, Faces=deconstruct_mesh.Faces, Colours=gradient)

# ----
# Radius/Edge Length
number_slider = Slider(100, range=0..100)  # disabled

text = Text(statistics.StandardDeviation)
text_2 = Text(statistics.Average)
mean_distance = Panel(fit_analysis_2.mean_distance)
standard_deviation = Panel(fit_analysis_2.st_dev)
standard_deviation_2 = Panel(fit_analysis.st_dev)
standard_deviation_3 = Panel(statistics.StandardDeviation)
# ..._1D_COMPMAP
# ..._1D_FOOTMAP
mean_distance_2 = Panel(fit_analysis.mean_distance)
mean_distance_3 = Panel(statistics.Average)
mesh_7 = Mesh(construct_mesh_2)
mesh_8 = Mesh(construct_mesh)
graft_tree = GraftTree(
    Tree=[mean_distance_2, standard_deviation_2, mean_distance, standard_deviation, mean_distance_3, standard_deviation_3],
    IncludeEmptyLists=True,
    IncludeNullItems=True)
flip_matrix = FlipMatrix(Data=graft_tree)
panel = Panel(flip_matrix)

# ----
# Legend Size
# add mean line
number_slider_2 = Slider(46, range=0..100)
number_slider_3 = Slider(10, range=0..10)
bounds_3 = Bounds(Numbers=distance_2)
construct_domain = ConstructDomain(DomainStart=expr("x*-1", number_slider_2), DomainEnd=number_slider_2)
construct_point = ConstructPoint(XCoordinate=40, YCoordinate=number_slider_2, ZCoordinate=0)
number_slider_4 = Slider(50, range=0..100)
deconstruct_domain = DeconstructDomain(Domain=bounds_3)  # -> Start, End
construct_domain_2 = ConstructDomain(DomainStart=expr("x*-1", number_slider_3), DomainEnd=number_slider_3)
rectangle = Rectangle(Plane=construct_point, XSize=construct_domain_2, YSize=construct_domain, Radius=0)  # -> Rectangle, Length
round_to_decimal_place = RoundToDecimalPlace(NumberX=deconstruct_domain.End, DecimalPlace=0, RoundType=2)  # -> Rounded, Difference
explode = Explode(Curve=rectangle.Rectangle, Recursive=True)  # -> graft(Segments), Vertices
boundary_surfaces = BoundarySurfaces(Edges=rectangle.Rectangle)
font_table = FontTable()
mesh_plane = MeshPlane(Boundary=boundary_surfaces, WidthCount=number_slider_4, HeightCount=number_slider_4)  # -> Mesh, Area
item_selector = ItemSelector(
    font_table,
    {"3ds", "3DS Fonticon", "Adobe Devanagari", "Adobe Heiti Std R", "Adobe Ming Std L", "Adobe Myungjo Std M"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}, selected="HelveticaNowText Regular")
number_slider_5 = Slider(10, range=2..20)
deconstruct_mesh_3 = DeconstructMesh(FootSrf=mesh_plane.Mesh)  # -> Vertices, Faces, Colours, Normals
cluster = Cluster_2(relay=explode.Segments)
unit_z = UnitZ(Factor=number_slider_2)
cluster_2 = Cluster(relay=explode.Vertices)
cluster_3 = Cluster(relay=explode.Vertices)
south_east_point = Point(cluster_3)
north_east_point = Point(cluster_2)
extrude = Extrude(Base=cluster, Direction=unit_z)
move = Move(Geometry=north_east_point, Motion=Vector(5, 0, 0))  # -> Geometry, Transform
screen_oriented_text = ScreenOrientedText(
    Text=round_to_decimal_place.Rounded,
    Font=item_selector,
    Justification=7,
    Location=move.Geometry,
    SizeFactor=number_slider_5,
    Depth=0,
    Absolute=False)
move_2 = Move(Geometry=south_east_point, Motion=Vector(5, 0, 0))  # -> Geometry, Transform
screen_oriented_text_2 = ScreenOrientedText(
    Text=deconstruct_domain.Start,
    Font=item_selector,
    Justification=7,
    Location=move_2.Geometry,
    SizeFactor=number_slider_5,
    Depth=0,
    Absolute=False)
number_slider_6 = Slider(50, range=0..100)
number_slider_7 = Slider(20, range=0..100)
number_slider_8 = Slider(6, range=0..10)
mesh_plane_2 = MeshPlane(Boundary=extrude, WidthCount=number_slider_6, HeightCount=number_slider_6)  # -> Mesh, Area
line = Line(StartPoint=move_2.Geometry, EndPoint=move.Geometry)
series = Series(Start=1, Step=1, Count=number_slider_8)
division = Division(A=round_to_decimal_place.Rounded, B=number_slider_8)
divide_curve = DivideCurve(Curve=line, Count=number_slider_8, Kinks=False)  # -> Points, Tangents, Parameters
mesh_closest_point_3 = MeshClosestPoint(Point=deconstruct_mesh_3.Vertices, Mesh=mesh_plane_2.Mesh)  # -> Point, Index, Parameter
deconstruct = Deconstruct(Point=north_east_point)  # -> XComponent, YComponent, ZComponent
multiplication = Multiplication(A=division, B=series)
insert_items = InsertItems(List=multiplication, Item=0, Indices=0, Wrap=True)
distance_3 = Distance(PointA=deconstruct_mesh_3.Vertices, PointB=mesh_closest_point_3.Point)
addition = Addition(A=deconstruct.YComponent, B=Slider(9, range=0..10))
move_3 = Move(Geometry=divide_curve.Points, Motion=Vector(-10, 0, 0))  # -> Geometry, Transform
subtraction = Subtraction(A=deconstruct.XComponent, B=Slider(23, range=0..100))
construct_point_2 = ConstructPoint(XCoordinate=subtraction, YCoordinate=addition, ZCoordinate=deconstruct.ZComponent)
screen_oriented_text_3 = ScreenOrientedText(
    Text=insert_items,
    Font="HelveticaNowText Regular",
    Justification=7,
    Location=divide_curve.Points,
    SizeFactor=number_slider_7,
    Depth=0,
    Absolute=False)
bounds_4 = Bounds(Numbers=distance_3)
line_2 = Line(StartPoint=divide_curve.Points, EndPoint=move_3.Geometry)
screen_oriented_text_4 = ScreenOrientedText(
    Text="Distance (mm)",
    Font="HelveticaNowText Regular",
    Justification=7,
    Location=construct_point_2,
    SizeFactor=number_slider_7,
    Depth=0,
    Absolute=False)
remap_numbers_3 = RemapNumbers(Value=distance_3, Source=bounds_4, Target=Domain(0, 1))  # -> Mapped, Clipped
pipe = Pipe(Curve=line_2, Radius=0.2, Caps=2)
custom_preview = CustomPreview(Geometry=pipe, Material=ColourSwatch(SwatchColor=RGB(0, 0, 0)))
gradient_7 = Gradient(
    LowerLimit=0,
    UpperLimit=1,
    Parameter=remap_numbers_3.Mapped,
    stops=[0.046: RGB(255, 255, 192), 0.307: RGB(255, 140, 0), 0.637: RGB(255, 0, 0), 0.943: RGB(75, 0, 130)])
construct_mesh_3 = ConstructMesh(Vertices=deconstruct_mesh_3.Vertices, Faces=deconstruct_mesh_3.Faces, Colours=gradient_7)
length = Length(Curve=line)
division_2 = Division(A="0.082", B=round_to_decimal_place.Rounded)
multiplication_2 = Multiplication(A=length, B=division_2)
unit_y = UnitY(Factor=multiplication_2)
unit_x = UnitX(Factor=expr("x*-2", number_slider_3))
move_4 = Move(Geometry=south_east_point, Motion=unit_y)  # -> Geometry, Transform
move_5 = Move(Geometry=move_4.Geometry, Motion=unit_x)  # -> Geometry, Transform
line_3 = Line(StartPoint=move_4.Geometry, EndPoint=move_5.Geometry)
pipe_2 = Pipe(Curve=line_3, Radius=0.5, Caps=2)
custom_preview_2 = CustomPreview(Geometry=pipe_2, Material=ColourSwatch(SwatchColor=RGB(0, 0, 0)))

c_script = CSharpScript(test=Button())  # -> reverse(out), A
# ---------- c_script: C# ----------
    var activeObjects = GrasshopperDocument.ActiveObjects(); // get all active objects

    var results = new Dictionary<string, double>();
    for (int i = 0; i < activeObjects.Count; i++) // for each active object...
    {
      IGH_ActiveObject ao = activeObjects[i] as IGH_ActiveObject;
      results.Add(string.Format("{0} {1}", i, ao.NickName), ao.ProcessorTime.Milliseconds); // ...store its time and name...
    }

    foreach (KeyValuePair<string, double> result in results.OrderBy(v => v.Value)) // ...and sort the collection...
    {
      Print("{0}\n   {1} ms", result.Key, result.Value); // ...to get the winner
    }
# ---------- end c_script ----------
panel_2 = Panel(c_script.out)

# ----
# Fit Heatmap Test
division_3 = Division(A=number_slider, B=2)  # disabled
negative = Negative(Value=division_3)  # disabled
construct_domain_3 = ConstructDomain(DomainStart=negative, DomainEnd=division_3)  # disabled

# ----
# Construct Cube
unit_z_2 = UnitZ(Factor=number_slider)  # disabled
rectangle_2 = Rectangle(Plane=PlaneXY(0, 0, 0), XSize=construct_domain_3, YSize=construct_domain_3, Radius=0)  # -> Rectangle, Length; disabled
extrude_2 = Extrude(Base=rectangle_2.Rectangle, Direction=unit_z_2)  # disabled
cap_holes = CapHoles(Brep=extrude_2)  # disabled

area = Area(Geometry=extrude_2)  # -> Area, Centroid; disabled

# ----
# Construct Sphere
sphere = Sphere(Base=area.Centroid, Radius=division_3)  # disabled

# ----
# Mesh Sphere
settings_quality = SettingsQuality()  # disabled
mesh_brep = MeshBrep(Brep=sphere, Settings=settings_quality)  # disabled

deconstruct_mesh_4 = DeconstructMesh(Mesh=mesh_brep)  # -> Vertices, Faces, Colours, Normals; disabled
list_length = ListLength(List=deconstruct_mesh_4.Vertices)  # disabled
division_4 = Division(A=list_length, B=6)  # disabled
square_root = SquareRoot(Value=division_4)  # disabled
round = Round(Number=square_root)  # -> Nearest, Floor, Ceiling; disabled

# ----
# Mesh Cube w/
# similar vertices
mesh_box = MeshBox(Base=cap_holes, XCount=round.Nearest, YCount=round.Nearest, ZCount=round.Nearest)  # disabled

# ----
# Analysis Cluster
fit_analysis_3 = FitAnalysis(component_brep=mesh_box, foot_srf_brep=mesh_brep)  # -> fit_heatmap_component, fit_heatmap_foot, mean_distance, st_dev; disabled

# ----
# Results
panel_3 = Panel(fit_analysis_3.mean_distance)  # disabled
panel_4 = Panel(fit_analysis_3.st_dev)  # disabled
mesh_9 = Mesh(fit_analysis_3.fit_heatmap_component)  # disabled
mesh_10 = Mesh(fit_analysis_3.fit_heatmap_foot)  # disabled

# ==== cluster FitAnalysis
component_brep = ClusterInput()
foot_srf_brep = ClusterInput()
# HEY LOOK
# I FOUND A WAY TO AVOID USING MATLAB
# GO ME
# LOOK AT THE PRETTY COLOURS
deconstruct_mesh = DeconstructMesh(Mesh=component_brep)  # -> Vertices, Faces, reverse(Colours), Normals
deconstruct_mesh_2 = DeconstructMesh(Mesh=foot_srf_brep)  # -> Vertices, Faces, Colours, Normals
mesh_closest_point = MeshClosestPoint(Point=deconstruct_mesh_2.Vertices, Mesh=component_brep)  # -> Point, Index, Parameter
mesh_closest_point_2 = MeshClosestPoint(Point=deconstruct_mesh.Vertices, Mesh=foot_srf_brep)  # -> Point, Index, Parameter
distance = Distance(PointA=deconstruct_mesh_2.Vertices, PointB=mesh_closest_point.Point)
distance_2 = Distance(PointA=deconstruct_mesh.Vertices, PointB=mesh_closest_point_2.Point)
bounds = Bounds(Numbers=distance)
bounds_2 = Bounds(Numbers=distance_2)
remap_numbers = RemapNumbers(Value=distance_2, Source=bounds_2, Target=Domain(0, 1))  # -> Mapped, Clipped
remap_numbers_2 = RemapNumbers(Value=distance, Source=bounds, Target=Domain(0, 1))  # -> Mapped, Clipped
statistics = Statistics(Values=distance_2)  # -> Average, StandardDeviation
gradient = Gradient(
    LowerLimit=0,
    UpperLimit=1,
    Parameter=remap_numbers_2.Mapped,
    stops=[0.046: RGB(255, 255, 192), 0.307: RGB(255, 140, 0), 0.637: RGB(255, 0, 0), 0.943: RGB(75, 0, 130)])
gradient_2 = Gradient(
    LowerLimit=0,
    UpperLimit=1,
    Parameter=remap_numbers.Mapped,
    stops=[0.046: RGB(255, 255, 192), 0.307: RGB(255, 140, 0), 0.637: RGB(255, 0, 0), 0.943: RGB(75, 0, 130)])
# CHOOSE YOUR GRADIENT
# 'viridis'
gradient_3 = Gradient(
    LowerLimit=0,
    UpperLimit=1,
    stops=[0.046: RGB(255, 215, 0), 0.4: RGB(0, 192, 0), 0.884: RGB(25, 25, 112), 1: RGB(75, 0, 130)])
# 'magma'
gradient_4 = Gradient(
    LowerLimit=0,
    UpperLimit=1,
    stops=[0.046: RGB(255, 255, 192), 0.307: RGB(255, 140, 0), 0.637: RGB(255, 0, 0), 0.943: RGB(75, 0, 130)])
gradient_5 = Gradient(
    LowerLimit=0,
    UpperLimit=1,
    stops=[0: RGB(0, 0, 255), 0.202: RGB(0, 255, 0), 0.512: RGB(255, 255, 0), 0.908: RGB(220, 0, 40)])
# 'ygb'
gradient_6 = Gradient(
    LowerLimit=0,
    UpperLimit=1,
    stops=[0.046: RGB(255, 255, 192), 0.291: RGB(192, 255, 192), 0.609: RGB(0, 128, 128), 0.943: RGB(75, 0, 130)])
construct_mesh = ConstructMesh(Vertices=deconstruct_mesh.Vertices, Faces=deconstruct_mesh.Faces, Colours=gradient_2)
construct_mesh_2 = ConstructMesh(Vertices=deconstruct_mesh_2.Vertices, Faces=deconstruct_mesh_2.Faces, Colours=gradient)
fit_heatmap_component = ClusterOutput(construct_mesh)
fit_heatmap_foot = ClusterOutput(construct_mesh_2)
mean_distance = ClusterOutput(statistics.Average)
st_dev = ClusterOutput(statistics.StandardDeviation)

# ==== cluster Cluster
relay = ClusterInput()
deconstruct = Deconstruct(Point=relay)  # -> XComponent, YComponent, ZComponent
sort_list = SortList(Keys=deconstruct.YComponent, ValuesValuesA=relay)  # -> Keys, ValuesValuesA
list_item = ListItem(List=sort_list.ValuesValuesA, Index=[1, 0], Wrap=True)
deconstruct_2 = Deconstruct(Point=list_item)  # -> XComponent, YComponent, ZComponent
sort_list_2 = SortList(Keys=deconstruct_2.XComponent, ValuesValuesA=list_item)  # -> Keys, reverse(ValuesValuesA)
list_item_2 = ListItem(List=sort_list_2.ValuesValuesA, Index=0, Wrap=True)
i = ClusterOutput(list_item_2)

# ==== cluster Cluster_2
relay = ClusterInput()
end_points = EndPoints(Curve=relay)  # -> Start, End
deconstruct = Deconstruct(Point=end_points.Start)  # -> XComponent, YComponent, ZComponent
deconstruct_2 = Deconstruct(Point=end_points.End)  # -> XComponent, YComponent, ZComponent
addition = Addition(A=deconstruct.YComponent, B=deconstruct_2.YComponent)
sort_list = SortList(Keys=addition, ValuesValuesA=relay)  # -> Keys, ValuesValuesA
# south edge
least_x = ListItem(List=flatten(sort_list.ValuesValuesA), Index=0, Wrap=True)
i = ClusterOutput(least_x)
