# Grasshopper definition 290521 run time complexity computation.gh (Grasshopper 1.0.7)
# plug-ins: Kangaroo2 Components, Pufferfish

series = Series(Start=1, Step=1, Count=9)
mesh = Mesh(<mesh referenced from the Rhino model>)
number_slider = Slider(9, range=0..10)  # disabled
triremesh = TriRemesh(Geometry=mesh, Iterations=series)  # -> Triangulation, Dual, Creases
list_item = ListItem(List=triremesh.Triangulation, Index=Slider(1, range=0..1), Wrap=True)
list_item_2 = ListItem(List=triremesh.Triangulation, Index=0, Wrap=True)
list_item_3 = ListItem(List=triremesh.Triangulation, Index=Slider(4, range=0..10), Wrap=True)
list_item_4 = ListItem(List=triremesh.Triangulation, Index=Slider(3, range=0..10), Wrap=True)
list_item_5 = ListItem(List=triremesh.Triangulation, Index=Slider(2, range=0..10), Wrap=True)
list_item_6 = ListItem(List=triremesh.Triangulation, Index=Slider(5, range=0..10), Wrap=True)
list_item_7 = ListItem(List=triremesh.Triangulation, Index=Slider(7, range=0..10), Wrap=True)
list_item_8 = ListItem(List=triremesh.Triangulation, Index=Slider(6, range=0..10), Wrap=True)
list_item_9 = ListItem(List=triremesh.Triangulation, Index=Slider(8, range=0..10), Wrap=True)
list_item_10 = ListItem(List=triremesh.Triangulation, Index=number_slider, Wrap=True)  # disabled
deconstruct_mesh = DeconstructMesh(Mesh=triremesh.Triangulation)  # -> Vertices, Faces, Colours, Normals
mesh_to_polysurface = MeshToPolysurface(Mesh=list_item, Triangles=False, FaceMerge=False)
mesh_to_polysurface_2 = MeshToPolysurface(Mesh=list_item_2, Triangles=False, FaceMerge=False)
mesh_to_polysurface_3 = MeshToPolysurface(Mesh=list_item_3, Triangles=False, FaceMerge=False)
mesh_to_polysurface_4 = MeshToPolysurface(Mesh=list_item_4, Triangles=False, FaceMerge=False)
mesh_to_polysurface_5 = MeshToPolysurface(Mesh=list_item_5, Triangles=False, FaceMerge=False)
mesh_to_polysurface_6 = MeshToPolysurface(Mesh=list_item_6, Triangles=False, FaceMerge=False)
mesh_to_polysurface_7 = MeshToPolysurface(Mesh=list_item_7, Triangles=False, FaceMerge=False)
mesh_to_polysurface_8 = MeshToPolysurface(Mesh=list_item_8, Triangles=False, FaceMerge=False)
mesh_to_polysurface_9 = MeshToPolysurface(Mesh=list_item_9, Triangles=False, FaceMerge=False)
mesh_to_polysurface_10 = MeshToPolysurface(Mesh=list_item_10, Triangles=False, FaceMerge=False)  # disabled
list_length = ListLength(List=deconstruct_mesh.Vertices)  # -> simplify(flatten(Length))
list_length_2 = ListLength(List=deconstruct_mesh.Faces)  # -> simplify(flatten(Length))
vertices = Panel(list_length)
faces = Panel(list_length_2)
c_script = CSharpScript(test=Button())  # -> reverse(out), A
# ---------- c_script: C# ----------
    var activeObjects = GrasshopperDocument.ActiveObjects(); // get all active objects

    var results = new Dictionary<string, double>();
    for (int i = 0; i < activeObjects.Count; i++) // for each active object...
    {
      IGH_ActiveObject ao = activeObjects[i] as IGH_ActiveObject;
      results.Add(string.Format("{0} {1}", i, ao.NickName), ao.ProcessorTime.Milliseconds); // ...store its time and name...
    }

    foreach (KeyValuePair<string, double> result in results.OrderBy(v => v.Value)) // ...and sort the collection...
    {
      Print("{0}\n   {1} ms", result.Key, result.Value); // ...to get the winner
    }
# ---------- end c_script ----------
panel = Panel("""279
358
970
947
954
798
707
603
533""")
panel_2 = Panel(c_script.out)
